# Grasshopper definition Tree_generator_v2.gh (Grasshopper 1.0.8)

range = Range(Domain=Domain(0, 1), Steps="4")
range_2 = Range(Domain=Domain(0, 1), Steps="4")
graph = GraphMapper(range, x0=0, x1=1, y0=0, y1=1, container_name="Bezier", cpx=[0, 0.3447926939, 1, 1], cpy=[0, 0, 0.6926424503, 1])
graph_2 = GraphMapper(range_2, x0=0, x1=1, y0=0, y1=1, container_name="Bezier", cpx=[0, 0.3527153432, 1, 1], cpy=[0, 0, 0.533995688, 1])
bnd = Bounds(Numbers=graph)
bnd_2 = Bounds(Numbers=graph_2)
pt = Point([Point(173.1600008, 48.10000076, 20.1), Point(173.1600008, 57.72000076, 20.1)])
rec = Rectangle({Plane=PlaneXY(173.1600008, 52.91000076, 24.8), Size=Domain2(u=-4.81..4.81, v=-14.43..14.43)})
pt_2 = Point([Point(163.5400008, 48.10000076, 16.1), Point(163.5400008, 57.72000076, 16.1)])
rec_2 = Rectangle({Plane=PlaneXY(163.5400008, 52.91000076, 24.8), Size=Domain2(u=-4.81..4.81, v=-14.43..14.43)})
remap = RemapNumbers(Value=graph, Source=bnd, Target="8.7")  # -> Mapped, Clipped
remap_2 = RemapNumbers(Value=graph_2, Source=bnd_2, Target="4.7")  # -> Mapped, Clipped
panel = Panel(remap_2.Mapped)
panel_2 = Panel(remap.Mapped)
py3 = Python3Script(boundary=rec_2, div_x="4", div_y="6", height="8.7", height_list=remap.Mapped)  # -> out, beams_out, vertices_out, lines_out; inputs anchors: list of Point3d, boundary: Polyline, div_x: Int32, div_y: Int32, height: Double, height_list: list of Double
# ---------- py3: Python ----------
#locate class file in the same folder
from compas_rhino import unload_modules
import sys
import os
"""
#get current file path
path = ghenv.Component.OnPingDocument().FilePath
#get parent directory of the parent directory
parentdir = os.path.dirname(path)
#get src folder which contains classes
dire = os.path.join(parentdir,'scripts')

sys.path.append(dire)
"""

# path = 'Users/jerrywang/Local/DFAB/T2'
path = 'D:\\ETH\\T2\\Tree_joint_prototype_v3'
sys.path.append(path)

unload_modules('Line_model_v2')

##########------------Imports------------###########
from Line_model_v2 import Beam, VertexList
from compas.geometry import Box, Frame, Vector

from compas_rhino.conversions import point_to_compas, point_to_rhino
from compas_rhino.conversions import line_to_rhino
from compas_rhino.conversions import polygon_to_compas

from Grasshopper import DataTree
from Grasshopper.Kernel.Data import GH_Path

#######------Conversions-------########
# anchors = [point_to_compas(a) for a in anchors]
boundary = polygon_to_compas(boundary)


#########------Main Code------###############
v_list = VertexList()
v_list.compute_diagrid(
    boundary=boundary,
    division_x=div_x,
    division_y=div_y,
    height=height,
    height_list=height_list
)
# print (v_list.pairs)

vertices = v_list.vertices


# Move certain vertices
move_list = [61, 66, 71] + [75, 76, 80, 79]
move_val_z = [0.8] * 3 + [1.2] * 4
for idx, val_z in zip(move_list, move_val_z):
    vertices[idx] += Vector(0, 0, val_z)


# Construct beams
beams = []
lines = []
remove_list = [83]
# print ((len(v_list.pairs)))
# v_list.remove_pair(83)

for pair in v_list.pairs:
    if pair[0] in remove_list or pair[1] in remove_list:
        continue
    beam = Beam(pair[0], pair[1], vertices)
    beams.append(beam)
    lines.append(beam.axis)

# Output data
beams_out = beams
vertices_out = vertices
lines_out = lines
# ---------- end py3 ----------
py3_2 = Python3Script(boundary=rec, div_x="4", div_y="6", height="4.7", height_list=remap_2.Mapped)  # -> out, beams_out, vertices_out, lines_out; inputs anchors: list of Point3d, boundary: Polyline, div_x: Int32, div_y: Int32, height: Double, height_list: list of Double
# ---------- py3_2: Python ----------
#locate class file in the same folder
from compas_rhino import unload_modules
import sys
import os
"""
#get current file path
path = ghenv.Component.OnPingDocument().FilePath
#get parent directory of the parent directory
parentdir = os.path.dirname(path)
#get src folder which contains classes
dire = os.path.join(parentdir,'scripts')

sys.path.append(dire)
"""

# path = 'Users/jerrywang/Local/DFAB/T2'
path = 'D:\\ETH\\T2\\Tree_joint_prototype_v3'
sys.path.append(path)

unload_modules('Line_model_v2')

##########------------Imports------------###########
from Line_model_v2 import Beam, VertexList
from compas.geometry import Box, Frame, Vector

from compas_rhino.conversions import point_to_compas, point_to_rhino
from compas_rhino.conversions import line_to_rhino
from compas_rhino.conversions import polygon_to_compas

from Grasshopper import DataTree
from Grasshopper.Kernel.Data import GH_Path

#######------Conversions-------########
# anchors = [point_to_compas(a) for a in anchors]
boundary = polygon_to_compas(boundary)


#########------Main Code------###############
v_list = VertexList()
vertices, idx_pairs = v_list.compute_diagrid(
    boundary=boundary,
    division_x=div_x,
    division_y=div_y,
    height=height,
    height_list=height_list
)
# print (idx_pairs)

beams = []
lines = []

# Move certain vertices
# move_list = [61, 66, 71] + [75, 76, 80, 79]
# move_val_z = [0.8] * 3 + [1.2] * 4
# for idx, val_z in zip(move_list, move_val_z):
#     vertices[idx] += Vector(0, 0, val_z)


remove_list = [83]
for pair in idx_pairs:
    if pair[0] in remove_list or pair[1] in remove_list:
        continue
    beam = Beam(pair[0], pair[1], vertices)
    beams.append(beam)
    lines.append(beam.axis)

beams_out = beams
vertices_out = vertices
lines_out = lines
# ---------- end py3_2 ----------
draw = COMPASDraw(cg=py3.vertices_out)  # -> rg
#   port cg: The COMPAS geometry or datastructure to be drawn.
#   port rg: The Rhino geometry object.
# ---------- draw: Python ----------
# r: compas>=2.14.1
"""
Draws COMPAS geometry in Grasshopper.
"""

from typing import Any

import Grasshopper

from compas.scene import SceneObject


class CompasToRhinoGeometry(Grasshopper.Kernel.GH_ScriptInstance):
    def RunScript(self, cg):
        if not cg:
            return None

        return SceneObject(item=cg).draw()
# ---------- end draw ----------
draw_2 = COMPASDraw(cg=py3.lines_out)  # -> rg; same code as draw
draw_3 = COMPASDraw(cg=py3_2.vertices_out)  # -> rg; same code as draw
draw_4 = COMPASDraw(cg=py3_2.lines_out)  # -> rg; same code as draw
points = PointList(Points=draw, Size=Slider(0.41, range=0..1))
points_2 = PointList(Points=draw_3, Size=Slider(0.41, range=0..1))
