# Grasshopper definition unnamed.gh (Grasshopper 1.0.8)

py3 = Python3Script()  # -> out, a; unedited script template
line = Line([Line((158.7300008, 38.48000076, 24.8), (159.9325008, 40.88500076, 24.08640044)), Line((158.7300008, 43.29000076, 24.8), (159.9325008, 40.88500076, 24.08640044)), Line((161.1350008, 43.29000076, 24.8), (159.9325008, 40.88500076, 24.08640044)), Line((161.1350008, 38.48000076, 24.8), (159.9325008, 40.88500076, 24.08640044)), Line((158.7300008, 43.29000076, 24.8), (159.9325008, 45.69500076, 24.08640044)), Line((158.7300008, 48.10000076, 24.8), (159.9325008, 45.69500076, 24.08640044))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])
python_3_script = Python3Script(all_lines=line, save=Button())  # inputs all_lines: list
# ---------- python_3_script: Python ----------
import os
import json

target_folder = r"C:\Users\Juste\Documents\_GitHub\MAS-2526\llhil-t2-fabrication\design\structure_model\data\Exchange Files\Files_In\_working"
json_path = os.path.join(target_folder, "out_lines.json")
os.makedirs(target_folder, exist_ok=True)

def serialize_compas(obj):
    # Preferred: COMPAS data protocol
    if hasattr(obj, "__jsondump__"):
        try:
            return obj.__jsondump__()
        except Exception:
            pass

    # Fallback: generic Data-like object
    if hasattr(obj, "to_data"):
        try:
            return {
                "dtype": obj.__class__.__module__ + "/" + obj.__class__.__name__,
                "data": obj.to_data()
            }
        except Exception:
            pass

    # Last resort
    return str(obj)

data = []
for line in all_lines:
    data.append({
        "line": serialize_compas(line),
        "type": getattr(line, "name", None)
    })

if save:
    with open(json_path, "w", encoding="utf-8") as f:
        json.dump(data, f, indent=2)
# ---------- end python_3_script ----------
