# Grasshopper definition line_model_Global Design.ghx (Grasshopper 1.0.8)
# plug-ins: Pufferfish, Human

range = Range(Domain=Domain(0, 1), Steps="3")
range_2 = Range(Domain=Domain(0, 1), Steps="3")
range_3 = Range(Domain=Domain(0, 1), Steps="3")
range_4 = Range(Domain=Domain(0, 1), Steps="3")
graph_mapper = GraphMapper(
    range,
    x0=0,
    x1=1,
    y0=0,
    y1=1,
    container_name="Bezier",
    cpx=[0, 0.415862143, 0.8706001639, 1],
    cpy=[0, 0.0582934618, 0.2888201475, 1])
graph_mapper_2 = GraphMapper(
    range_2,
    x0=0,
    x1=1,
    y0=0,
    y1=1,
    container_name="Bezier",
    cpx=[0, 0.415862143, 0.940971911, 1],
    cpy=[0, 0.0582934618, 0.3582203984, 1])
graph_mapper_3 = GraphMapper(
    range_3,
    x0=0,
    x1=1,
    y0=0,
    y1=1,
    container_name="Bezier",
    cpx=[0, 0.415862143, 0.940971911, 1],
    cpy=[0, 0.0582934618, 0.3582203984, 1])
graph_mapper_4 = GraphMapper(
    range_4,
    x0=0,
    x1=1,
    y0=0,
    y1=1,
    container_name="Bezier",
    cpx=[0, 0.415862143, 0.940971911, 1],
    cpy=[0, 0.0582934618, 0.3582203984, 1])

entwine = Entwine(Branch00=graph_mapper, Branch01=graph_mapper_2, Branch02=graph_mapper_3, Branch03=graph_mapper_4, FlattenInputs=True)  # -> simplify(Result)

# ----
# 12 x 2.4 m
# Rectangle Breps for structure
# Irregular Breps for CLT
brep = Brep([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])
brep_2 = Brep([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])

# ----
# 10 x 2.4m
# Rectangle Breps for structure
# Irregular Breps for CLT
brep_3 = Brep([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])
brep_4 = Brep([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])

# ----
# 10 x 3m
# Rectangle Breps for structure
# Irregular Breps for CLT
brep_5 = Brep([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])
brep_6 = Brep([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])

# ----
# 12 x 3m
# Rectangle Breps for structure
# Irregular Breps for CLT
brep_7 = Brep([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])
brep_8 = Brep([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])

# ----
# m
point = Point([Point(2.7, 7.810000534, 0), Point(0.3, 1.810000534, 0), Point(2.7, 1.810000534, 0), Point(0.3, 7.810000534, 0)])

# ----
# Flat roof with 2% inclination10 x 3m
brep_9 = Brep([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])

# ----
# create and manipulate graph
point_2 = Point(point)
python_3_script = Python3Script(roof_breps=brep_7, supports=point_2, z_steps=entwine)  # -> out, ridges_tree, all_edges, graph, all_nodes, node_keys; inputs roof_breps: list of Brep, supports: list of Point3d, z_steps: tree of Double
# ---------- python_3_script: Python ----------
import os
import sys
from compas_rhino import unload_modules
import compas
compas.PRECISION = ".3f"

gh_dir = os.path.dirname(ghenv.Component.OnPingDocument().FilePath)
sys.path.append(gh_dir)

import tree_builder
import nodegraph
import importlib

importlib.reload(nodegraph)
importlib.reload(tree_builder)


from tree_builder import build_tree_graph_from_breps
from Grasshopper import DataTree
from Grasshopper.Kernel.Data import GH_Path

# lines_tree will be our output
lines_tree = DataTree[object]()
z_tree = []
# 1. Iterate using the Branch count
for i in range(z_steps.BranchCount):
    branch = list(z_steps.Branch(i)) 
    z_tree.append(branch)

# CONSTANTS #
div_x = 3
div_y = 3
num_levels = 3

inset_edge = 0.5
inset_interior = 0.5

# Build the graph (all logic is in tree_builder.py)
ng = build_tree_graph_from_breps(
    supports=supports,
    input_breps=roof_breps,
    div_x=div_x if div_x else 8,
    div_y=div_y if div_y else 6,
    num_levels=num_levels if num_levels else 4,
    z_steps=z_tree,
    inset_edge=inset_edge if inset_edge else 0.5,
    inset_interior=inset_interior if inset_interior else 0.4,
    reach_tol=0.05,
    debug=False
)

# Outputs
all_edges = ng.edge_lines()
graph = ng
all_nodes = ng.node_points()
node_keys = list(ng.nodes())
# ---------- end python_3_script ----------
compas_draw = COMPASDraw(cg=python_3_script.all_edges)  # -> rg
#   port cg: The COMPAS geometry or datastructure to be drawn.
#   port rg: The Rhino geometry object.
# ---------- compas_draw: Python ----------
# r: compas>=2.14.1
"""
Draws COMPAS geometry in Grasshopper.
"""

from typing import Any

import Grasshopper

from compas.scene import SceneObject


class CompasToRhinoGeometry(Grasshopper.Kernel.GH_ScriptInstance):
    def RunScript(self, cg):
        if not cg:
            return None

        return SceneObject(item=cg).draw()
# ---------- end compas_draw ----------
compas_draw_2 = COMPASDraw(cg=python_3_script.all_nodes)  # -> rg; same code as compas_draw

# ----
# transform points
brep_10 = Brep(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)
python_3_script_2 = Python3Script(graph=python_3_script.graph, repellors=brep_10)  # -> out, edges, nodes, node_graph; inputs repellors: list of Brep
# ---------- python_3_script_2: Python ----------
import os, sys, importlib
gh_dir = os.path.dirname(ghenv.Component.OnPingDocument().FilePath)
if gh_dir not in sys.path:
    sys.path.insert(0, gh_dir)

### -----------------------------
## IMPORT
### -----------------------------
import nodegraph

importlib.reload(nodegraph)

from copy import deepcopy
from compas.geometry import Vector, Line, Point, centroid_points

ng = deepcopy(graph)



ng, results = ng.move_nodes_from_geometry(
    repellors,               # Mix of anything
    max_distance = 2.0,
    strength = 2,
    falloff = "smooth"
)

# Outputs
node_graph = ng
edges = ng.edge_lines()
nodes = ng.node_points()
moved_pts = [r['new'] for r in results.values()]
# ---------- end python_3_script_2 ----------

panel = Panel("modify points")

# ----
# preview graph
number_slider = Slider(0.1, range=-0.5..0.5)
compas_draw_3 = COMPASDraw(cg=python_3_script_2.edges)  # -> rg; same code as compas_draw
compas_draw_4 = COMPASDraw(cg=python_3_script_2.nodes)  # -> rg; same code as compas_draw
dot_display = DotDisplay(Point=compas_draw_4, Colour=ColourSwatch(SwatchColor=RGB(128, 128, 128)), Size=number_slider)

custom_preview_lineweights = CustomPreviewLineweights(
    Geometry=compas_draw_3,
    Shader=ColourSwatch(SwatchColor=RGB(144, 209, 232)),
    Thickness=Slider(4, range=0..10),
    Absolute=False)

crv = Curve([<curve referenced from the Rhino model> x2])
dispatch = Dispatch(List=crv, DispatchPattern=[True, False])  # -> ListA, ListB
crvprox = CurveProximity(CurveA=dispatch.ListA, CurveB=dispatch.ListB)  # -> PointA, PointB, Distance
offset_surface = OffsetSurface(Surface=brep_8, Distance=Slider(0.06, range=0..0.1), BothSides=0, CreateSolid=True)
panel_2 = Panel(crvprox.Distance)

# ----
# classify
python_3_script_3 = Python3Script(graph=python_3_script_2.node_graph)  # -> out, main_primary_lines, primary_lines, secondary_lines, tertiary_lines, graph_out
# ---------- python_3_script_3: Python ----------
import os, sys, importlib
gh_dir = os.path.dirname(ghenv.Component.OnPingDocument().FilePath)
if gh_dir not in sys.path:
    sys.path.insert(0, gh_dir)

import edge_classifier
importlib.reload(edge_classifier)

from edge_classifier import classify_edges_by_support_direction, edges_from_keys
from edge_classifier import assign_edges_dimensions
# Call the function
main_primary_keys, primary_keys, secondary_keys, tertiary_keys = classify_edges_by_support_direction(
    graph,
    parallel_tol=None,
    debug=False,
    seed_plane_tol=1e-3
)

# # Set default beams' dimensions
# assign_edges_dimensions(graph)


# Convert to Line objects for visualization
primary_lines = edges_from_keys(graph, primary_keys)
main_primary_lines = edges_from_keys(graph, main_primary_keys)
secondary_lines = edges_from_keys(graph, secondary_keys)
tertiary_lines = edges_from_keys(graph, tertiary_keys)

# output 
graph_out = graph

# for edge in graph.edges():
#     w = graph.edge_attribute(edge, 'width')
#     h = graph.edge_attribute(edge, 'height')
#     print (w, h)
# ---------- end python_3_script_3 ----------
draw = COMPASDraw(cg=python_3_script_3.primary_lines)  # -> rg; same code as compas_draw
draw_2 = COMPASDraw(cg=python_3_script_3.secondary_lines)  # -> rg; same code as compas_draw
draw_3 = COMPASDraw(cg=python_3_script_3.tertiary_lines)  # -> rg; same code as compas_draw
custom_preview_lineweights_2 = CustomPreviewLineweights(Geometry=draw, Shader=ColourSwatch(SwatchColor=RGB(137, 50, 143)), Thickness="8", Absolute=False)
custom_preview_lineweights_3 = CustomPreviewLineweights(Geometry=draw_2, Shader=ColourSwatch(SwatchColor=RGB(50, 143, 103)), Thickness="6", Absolute=False)
custom_preview_lineweights_4 = CustomPreviewLineweights(Geometry=draw_3, Shader=ColourSwatch(SwatchColor=RGB(218, 157, 103)), Thickness="6", Absolute=False)

draw_4 = COMPASDraw(cg=python_3_script_3.main_primary_lines)  # -> rg; same code as compas_draw

custom_preview_lineweights_5 = CustomPreviewLineweights(Geometry=draw_4, Shader=ColourSwatch(SwatchColor=RGB(231, 23, 143)), Thickness="8", Absolute=False)

# ----
# Add shoes
number_slider_2 = Slider(200, range=0..1000)
python_3_script_4 = Python3Script(graph=python_3_script_3.graph_out, extension=Slider(0.2, range=0..1))  # -> out, graph_out, shoe_lines; inputs extension: Double
# ---------- python_3_script_4: Python ----------
import os, sys, importlib
gh_dir = os.path.dirname(ghenv.Component.OnPingDocument().FilePath)
if gh_dir not in sys.path:
    sys.path.insert(0, gh_dir)


import leaf_solver
importlib.reload(leaf_solver)
from leaf_solver import create_shoes_from_graph
from copy import deepcopy



ng = deepcopy(graph)
result = create_shoes_from_graph(ng, extension_length = extension)

shoe_lines = result["shoe_lines"]
graph_out = ng


for edge in ng.edges():
    level = ng.edge_attribute(edge, 'level')
    print (level)
# ---------- end python_3_script_4 ----------
draw_5 = COMPASDraw(cg=python_3_script_4.shoe_lines)  # -> rg; same code as compas_draw

# ----
# Set default cross sections
python_3_script_5 = Python3Script(graph=python_3_script_4.graph_out)  # -> out, graph_out
# ---------- python_3_script_5: Python ----------
import os, sys, importlib
gh_dir = os.path.dirname(ghenv.Component.OnPingDocument().FilePath)
if gh_dir not in sys.path:
    sys.path.insert(0, gh_dir)


import edge_classifier
importlib.reload(edge_classifier)
from edge_classifier import assign_edges_dimensions


# Set default beams' dimensions
assign_edges_dimensions(graph, scale="m")


graph_out = graph
# ---------- end python_3_script_5 ----------

# ----
# Shifting
py3 = Python3Script(ng=python_3_script_5.graph_out, z_shift=Slider(0.05, range=0..0.1))  # -> out, graph_out, edges, shifted; inputs z_shift: Double
# ---------- py3: Python ----------
import os, sys, importlib
from copy import deepcopy

gh_dir = os.path.dirname(ghenv.Component.OnPingDocument().FilePath)
if gh_dir not in sys.path:
    sys.path.insert(0, gh_dir)

import edge_classifier
import reciprocal
import line_constraints

importlib.reload(edge_classifier)
importlib.reload(reciprocal)
importlib.reload(line_constraints)

graph = deepcopy(ng)

# -----------------------------
# controls
# -----------------------------
sign_primary = +1
sign_secondary = +1
engage_len = 0.015
tol = 0.1
iters = 5


# -----------------------------
# 1) reciprocal primary
# -----------------------------
res_primary = reciprocal.reciprocal_width_from_subgraph(
    graph,
    target_hierarchy="primary",
    engage_len=engage_len,
    tol=tol,
    rotation_sign=sign_primary,
    min_degree=3,
    iterations=iters,
    max_angle=180.0, 
    max_degree = 4
)
g = res_primary["graph"]

# Snap to primary primary

line_constraints.snap_to_host(
    g,
    target_hierarchy="main_primary",
    move_node_level = 0,
    host_hierarchy="primary",
    z_offset = 0.10,
    write_attribute=True,
    debug=False
)

res_main_primary = reciprocal.reciprocal_width_from_subgraph(
    graph,
    target_hierarchy="main_primary",
    engage_len=engage_len,
    tol=tol,
    rotation_sign=sign_primary,
    min_degree=3,
    iterations=iters,
    max_angle=180.0
)
g = res_main_primary["graph"]
# -----------------------------
# 2) regenerate secondary (level 1 up)
# -----------------------------
line_constraints.snap_to_host(
    g,
    target_hierarchy="secondary",
    move_node_level = 1,
    host_hierarchy="primary",
    z_offset = z_shift,
    write_attribute=True,
    debug=False
)

line_constraints.snap_to_host(
    g,
    target_hierarchy="secondary",
    move_node_level = 1,
    host_hierarchy="main_primary",
    z_offset = z_shift,
    write_attribute=True,
    debug=False
)

# -----------------------------
# 3) reciprocal secondary
# -----------------------------
res_secondary = reciprocal.reciprocal_width_from_subgraph(
    g,
    target_hierarchy="secondary",
    engage_len=engage_len,
    tol=tol,
    rotation_sign=sign_secondary,
    min_degree=3,
    iterations=iters,
    max_angle=180.0
)
g = res_secondary["graph"]

# -----------------------------
# 5) regenerate tertiary (level 0 up)
# -----------------------------
line_constraints.snap_to_host(
    g,
    target_hierarchy="tertiary",
    move_node_level=0,
    host_hierarchy="secondary" ,
    z_offset = z_shift,
    write_attribute=True,
    debug=False
)

line_constraints.snap_to_host(
    g,
    target_hierarchy="tertiary",
    move_node_level=0,
    host_hierarchy="primary",
    z_offset = z_shift,
    write_attribute=True,
    debug=False
)

line_constraints.snap_to_host(
    g,
    target_hierarchy="tertiary",
    move_node_level=0,
    host_hierarchy="main_primary",
    z_offset = z_shift,
    write_attribute=True,
    debug=False
)


graph_out = g
shifted = []
for e in g.edges():
    shifted.append(g.edge_attribute(e, "shifted_line"))
# ---------- end py3 ----------
draw_6 = COMPASDraw(cg=py3.shifted)  # -> rg; same code as compas_draw
draw_7 = COMPASDraw(cg=py3.edges)  # -> rg; same code as compas_draw

# ----
# Shifting - op 2 different joint middle node
py3_2 = Python3Script(ng=python_3_script_5.graph_out, z_shift=Slider(0.05, range=0..0.1))  # -> out, graph_out, a, edges, shifted; inputs z_shift: Double
# ---------- py3_2: Python ----------
import os, sys, importlib
from copy import deepcopy

gh_dir = os.path.dirname(ghenv.Component.OnPingDocument().FilePath)
if gh_dir not in sys.path:
    sys.path.insert(0, gh_dir)

import edge_classifier
import reciprocal
import line_constraints

importlib.reload(edge_classifier)
importlib.reload(reciprocal)
importlib.reload(line_constraints)

graph = deepcopy(ng)

# -----------------------------
# controls
# -----------------------------
sign_primary = +1
sign_secondary = +1
engage_len = 0.01
tol = 0.1
iters = 5


# -----------------------------
# 1) reciprocal primary
# -----------------------------
for e in graph.edges():
    h  = ng.edge_attribute(e, "hierarchy")
    if h == "main_primary":
        graph.edge_attribute(e, "hierarchy", "primary")


res_primary = reciprocal.reciprocal_width_from_subgraph(
    graph,
    target_hierarchy="primary",
    engage_len=engage_len,
    tol=tol,
    rotation_sign=sign_primary,
    min_degree=3,
    iterations=iters,
    max_angle=180.0, 
    max_degree = 3
)
g = res_primary["graph"]

# Snap to primary primary


# -----------------------------
# 2) regenerate secondary (level 1 up)
# -----------------------------
line_constraints.snap_to_host(
    g,
    target_hierarchy="secondary",
    move_node_level = 1,
    host_hierarchy="primary",
    z_offset = z_shift,
    write_attribute=True,
    debug=False
)


# -----------------------------
# 3) reciprocal secondary
# -----------------------------
res_secondary = reciprocal.reciprocal_width_from_subgraph(
    g,
    target_hierarchy="secondary",
    engage_len=engage_len,
    tol=tol,
    rotation_sign=sign_secondary,
    min_degree=3,
    iterations=iters,
    max_angle=180.0
)
g = res_secondary["graph"]


# -----------------------------
# 5) regenerate tertiary (level 0 up)
# -----------------------------
line_constraints.snap_to_host(
    g,
    target_hierarchy="tertiary",
    move_node_level=0,
    host_hierarchy="secondary" ,
    z_offset = z_shift,
    write_attribute=True,
    debug=False
)

line_constraints.snap_to_host(
    g,
    target_hierarchy="tertiary",
    move_node_level=0,
    host_hierarchy="primary",
    z_offset = z_shift,
    write_attribute=True,
    debug=False
)



graph_out = g
a = res_primary["shifted_lines"]
shifted = []
for e in g.edges():
    shifted.append(g.edge_attribute(e, "shifted_line"))
# ---------- end py3_2 ----------
draw_8 = COMPASDraw(cg=py3_2.edges)  # -> rg; same code as compas_draw
draw_9 = COMPASDraw(cg=py3_2.shifted)  # -> rg; same code as compas_draw

draw_10 = COMPASDraw(cg=py3_2.a)  # -> rg; same code as compas_draw

# ----
# foundation
python_3_script_6 = Python3Script(graph=py3.graph_out)  # -> out, graph_out, crosecs, cut_planes, sup_lines, total_lines
# ---------- python_3_script_6: Python ----------
import os, sys, importlib
gh_dir = os.path.dirname(ghenv.Component.OnPingDocument().FilePath)
if gh_dir not in sys.path:
    sys.path.insert(0, gh_dir)


import foundation_solver
importlib.reload(foundation_solver)
from foundation_solver import trim_anchored_beams_and_find_cut_planes
from copy import deepcopy

from compas.geometry import Polygon

############--------Main Code----------#########
ng = deepcopy(graph)
result = trim_anchored_beams_and_find_cut_planes(ng, min_gap=0.01, min_height=0.01, _step = 0.1)

########--------Output Data---------#########
cro_sec_dict = result["cross_sections"]
crosecs = []
for node, cro_sec_list in cro_sec_dict.items():
    for crosec in cro_sec_list:
        poly = Polygon(crosec)
        crosecs.append(poly)

cut_pln_dict = result["cut_planes"]
cut_planes = []
for node, pln in cut_pln_dict.items():
    cut_planes.append(pln)


sup_lines = []
for edge in ng.get_support_edges():
    if "shifted_line" in graph.edge_attributes(edge):
        ln = ng.edge_attribute(edge, "shifted_line")
    else:
        ln = ng.edge_line(edge)
    sup_lines.append(ln)


total_lines = []
for e in ng.edges():
    total_lines.append(ng.edge_attribute(e, "shifted_line"))


graph_out = ng
#############-----------Print----------##########
# print (result["cross_sections"])
# print ()
# print (result["cut_planes"])
print (result["foundation_heights"])


for node in ng.get_support_nodes():
    print (ng.node_attribute(node, 'cut_plane'))
# ---------- end python_3_script_6 ----------
draw_11 = COMPASDraw(cg=python_3_script_6.crosecs)  # -> rg; same code as compas_draw
draw_12 = COMPASDraw(cg=python_3_script_6.sup_lines)  # -> rg; same code as compas_draw
draw_13 = COMPASDraw(cg=python_3_script_6.cut_planes)  # -> rg; same code as compas_draw

draw_14 = COMPASDraw(cg=python_3_script_6.total_lines)  # -> rg; same code as compas_draw

python_3_script_7 = Python3Script(graph=py3.graph_out)  # -> out, lines, colors
# ---------- python_3_script_7: Python ----------
import rhinoscriptsyntax as rs
import scriptcontext as sc
import Rhino.Display as rd
import System.Drawing as sd
from compas.geometry import Line, Point
from copy import deepcopy

ng = deepcopy(graph)

HIERARCHY_COLORS = {
    "primary":      sd.Color.FromArgb(255, 220,  50,  50),
    "main_primary": sd.Color.FromArgb(255, 150,  80, 220),
    "secondary":    sd.Color.FromArgb(255,  50, 150, 220),
    "tertiary":     sd.Color.FromArgb(255,  80, 200, 100),
    "shoe":         sd.Color.FromArgb(255,  20, 150, 100)
}

lines = []
colors = []

for e in ng.edges():
    h  = ng.edge_attribute(e, "hierarchy")
    ln = ng.edge_attribute(e, "shifted_line")

    if ln is None or h not in HIERARCHY_COLORS:
        continue

    lines.append(ln)
    colors.append(HIERARCHY_COLORS[h])
# ---------- end python_3_script_7 ----------
compas_draw_5 = COMPASDraw(cg=python_3_script_7.lines)  # -> rg; same code as compas_draw
custom_preview_lineweights_6 = CustomPreviewLineweights(Geometry=compas_draw_5, Shader=python_3_script_7.colors, Thickness="8", Absolute=False)

# ----
# export line model for compas timber
button = Button()
py3_3 = Python3Script(export=button, graph=python_3_script_6.graph_out)  # -> out, a; inputs export: Boolean
# ---------- py3_3: Python ----------
from compas.data import json_dump

import os, sys, importlib

gh_dir = os.path.dirname(ghenv.Component.OnPingDocument().FilePath)
if gh_dir not in sys.path:
    sys.path.insert(0, gh_dir)

file_path = os.path.join(gh_dir, "data", "0805_shifted_lines.json")
print(file_path)
if export:
    json_dump(graph, file_path, pretty = True)
# ---------- end py3_3 ----------

py3_4 = Python3Script(graph=python_3_script_6.graph_out)  # -> out, lines, widths, heights
# ---------- py3_4: Python ----------
lines = []
widths = []
heights = []
for edge in graph.edges():
    attrs = graph.edge_attributes(edge)
    if "shifted_line" in attrs:
        ln = graph.edge_attribute(edge, "shifted_line")
    else:
        ln = graph.edge_line(edge)

    lines.append(ln)
    widths.append(graph.edge_attribute(edge, "width"))
    heights.append(graph.edge_attribute(edge, "height"))
# ---------- end py3_4 ----------
draw_15 = COMPASDraw(cg=py3_4.lines)  # -> rg; same code as compas_draw
beam = CTBeam(centerline=draw_15, width=py3_4.widths, height=py3_4.heights)  # -> Beam, Blank; inputs centerline: list, z_vector: list of Vector3d, width: list of Double, height: list of Double, category: list of String, updateRefObj: Boolean
#   port centerline: Referenced curve or line, Guid of curve or line in the active Rhino document.
#   port z_vector: Vector defining the orientation of the cross-section (corresponds to the height dimension). If None, a default will be taken.
#   port width: Width of the cross-section (usually the smaller dimension).
#   port height: Height of the cross-section (usually the larger dimension).
#   port category: Category of a beam.
#   port updateRefObj: (optional) If True, the attributes in the referenced object will be updated/overwritten with the new values given here.
#   port Beam: Beam object(s).
#   port Blank: Shape of the beam's blank.
# ---------- beam: Python ----------
# env: C:\Users\jfrancisco\Documents\GitHub\timber_design\src
# r: compas_timber>=0.16.2
"""Creates a Beam from a LineCurve."""

# flake8: noqa
import Grasshopper
import Rhino
import rhinoscriptsyntax as rs
import System
from compas.scene import Scene
from compas_rhino.conversions import line_to_compas
from compas_rhino.conversions import vector_to_compas

from compas_timber.elements import Beam as CTBeam
from timber_design.ghpython.ghcomponent_helpers import list_input_valid_cpython


class Beam_fromCurve(Grasshopper.Kernel.GH_ScriptInstance):
    def RunScript(self,
            centerline: System.Collections.Generic.List[object],
            z_vector: System.Collections.Generic.List[Rhino.Geometry.Vector3d],
            width: System.Collections.Generic.List[float],
            height: System.Collections.Generic.List[float],
            category: System.Collections.Generic.List[str],
            updateRefObj: bool):
        # minimum inputs required
        if not list_input_valid_cpython(ghenv, centerline, "Centerline"):
            return
        if not width:
            length = self._get_centerline_length(centerline)
            width = [length / 20]
        if not height:
            length = self._get_centerline_length(centerline)
            height = [length / 10]

        # reformat unset parameters for consistency
        if not z_vector:
            z_vector = [None]
        if not category:
            category = [None]

        beams = []
        blanks = []
        scene = Scene()

        if centerline and height and width:
            # check list lengths for consistency
            N = len(centerline)
            if len(z_vector) not in (0, 1, N):
                ghenv.Component.AddRuntimeMessage(
                    Grasshopper.Kernel.GH_RuntimeMessageLevel.Error, " In 'ZVector' I need either none, one or the same number of inputs as the Crv parameter."
                )
            if len(width) not in (1, N):
                ghenv.Component.AddRuntimeMessage(Grasshopper.Kernel.GH_RuntimeMessageLevel.Error, " In 'W' I need either one or the same number of inputs as the Crv parameter.")
            if len(height) not in (1, N):
                ghenv.Component.AddRuntimeMessage(Grasshopper.Kernel.GH_RuntimeMessageLevel.Error, " In 'H' I need either one or the same number of inputs as the Crv parameter.")
            if len(category) not in (0, 1, N):
                ghenv.Component.AddRuntimeMessage(
                    Grasshopper.Kernel.GH_RuntimeMessageLevel.Error, " In 'Category' I need either none, one or the same number of inputs as the Crv parameter."
                )

            # duplicate data if None or single value
            if len(z_vector) != N:
                z_vector = [z_vector[0] for _ in range(N)]
            if len(width) != N:
                width = [width[0] for _ in range(N)]
            if len(height) != N:
                height = [height[0] for _ in range(N)]
            if len(category) != N:
                category = [category[0] for _ in range(N)]

            for line, z, w, h, c in zip(centerline, z_vector, width, height, category):
                guid, geometry = self._get_guid_and_geometry(line)
                rhino_line = rs.coerceline(geometry)
                line = line_to_compas(rhino_line)

                z = vector_to_compas(z) if z else None
                beam = CTBeam.from_centerline(centerline=line, width=w, height=h, z_vector=z)
                beam.attributes["rhino_guid"] = str(guid) if guid else None
                beam.attributes["category"] = c


                beams.append(beam)
                scene.add(beam.blank)

        blanks = scene.draw()

        return beams, blanks

    def _get_guid_and_geometry(self, line):
        # internalized curves and GH geometry will not have persistent GUIDs, referenced Rhino objects will
        # type hint on the input has to be 'ghdoc' for this to work
        guid = None
        geometry = line
        rhino_obj = Rhino.RhinoDoc.ActiveDoc.Objects.FindId(line)
        if rhino_obj:
            guid = line
            geometry = rhino_obj.Geometry
        return guid, geometry

    def _get_centerline_length(self, centerline):
        centerline_length = []
        for i in centerline:
            centerline_length.append(rs.CurveLength(i))
        if centerline_length:
            length_average = sum(centerline_length) / len(centerline_length)
        else:
            length_average = 1
        return length_average
# ---------- end beam ----------
python_3_script_8 = Python3Script(graph=python_3_script_6.graph_out)  # -> out, graph_out, line_tree
# ---------- python_3_script_8: Python ----------
import os, sys, importlib
gh_dir = os.path.dirname(ghenv.Component.OnPingDocument().FilePath)
if gh_dir not in sys.path:
    sys.path.insert(0, gh_dir)


from copy import deepcopy


ng = deepcopy(graph)








# points = []
# for node in ng.nodes():
#     group = ng.node_attribute(node, 'group')
#     sup_id = ng.node_attribute(node, 'support_id')

#     if group is not None:
#         points.append(ng.node_point(node))
#     print (group, sup_id)


from Grasshopper import DataTree
from Grasshopper.Kernel.Data import GH_Path
    
line_tree = DataTree[object]()

for edge in ng.edges():
    group = ng.edge_attribute(edge, 'group')
    sup_id = ng.edge_attribute(edge, 'nearest_support')

    attrs = ng.edge_attributes(edge)
    print (attrs)
    # print (group, sup_id)
    path = GH_Path(group)
    line_tree.Add(ng.edge_line(edge), path)
# ---------- end python_3_script_8 ----------
volume = Volume(Geometry=beam.Blank)  # -> Volume, Centroid
draw_16 = COMPASDraw(cg=python_3_script_8.line_tree)  # -> rg; same code as compas_draw
relay = Relay([beam.Blank, offset_surface])
branch = TreeBranch(Tree=draw_16, Path=Slider(3, range=0..3), MaintainPaths=True)
custom_preview = CustomPreview(Geometry=relay, Material=ColourSwatch(SwatchColor=RGB(219, 206, 167)))
mass_addition = MassAddition(Input=volume.Volume)  # -> Result, PartialResults
panel_3 = Panel(mass_addition.Result)
