# Grasshopper definition line_model_WN.gh (Grasshopper 1.0.8)
# plug-ins: Pufferfish, Human

range = Range(Domain=Domain(0, 1), Steps="3")
range_2 = Range(Domain=Domain(0, 1), Steps="3")
range_3 = Range(Domain=Domain(0, 1), Steps="3")
range_4 = Range(Domain=Domain(0, 1), Steps="3")
graph_mapper = GraphMapper(
    range_2,
    x0=0,
    x1=1,
    y0=0,
    y1=1,
    container_name="Bezier",
    cpx=[0, 0.415862143, 0.940971911, 1],
    cpy=[0, 0.0582934618, 0.3582203984, 1])
graph_mapper_2 = GraphMapper(
    range_3,
    x0=0,
    x1=1,
    y0=0,
    y1=1,
    container_name="Bezier",
    cpx=[0, 0.415862143, 0.940971911, 1],
    cpy=[0, 0.0582934618, 0.3582203984, 1])
graph_mapper_3 = GraphMapper(
    range,
    x0=0,
    x1=1,
    y0=0,
    y1=1,
    container_name="Bezier",
    cpx=[0, 0.415862143, 0.940971911, 1],
    cpy=[0, 0.0582934618, 0.3582203984, 1])
graph_mapper_4 = GraphMapper(
    range_4,
    x0=0,
    x1=1,
    y0=0,
    y1=1,
    container_name="Bezier",
    cpx=[0, 0.415862143, 0.8706001639, 1],
    cpy=[0, 0.0582934618, 0.2888201475, 1])

entwine = Entwine(Branch00=graph_mapper_4, Branch01=graph_mapper_2, Branch02=graph_mapper, Branch03=graph_mapper_3, FlattenInputs=True)  # -> simplify(Result)

# ----
# Overall Height
number_slider = Slider(3.5, range=0..10)

# ----
# Roof_Brep Generator
panel = Panel("4.81")
construct_point = ConstructPoint(XCoordinate="1.50", YCoordinate=panel, ZCoordinate=number_slider)
unit_y = UnitY(Factor=Slider(13.9, range=6..20))
move = Move(Geometry=construct_point, Motion=unit_y)  # -> Geometry, Transform
number_slider_2 = Slider(3, range=0..3)
number_slider_3 = Slider(2.4, range=0..10)
number_slider_4 = Slider(6, range=0..10)
python_3_script = Python3Script(
    mode=number_slider_2,
    center_pt=construct_point,
    peak_offset=Slider(0.5, range=-1..10),
    distY=Slider(6, range=0..10),
    distX=Slider(2.4, range=0..10),
    ellipseA=number_slider_3,
    ellipseB=number_slider_4,
    nSegments=Slider(4, range=4..20, expression="round(x/4)*4"))  # -> out, roof_brep, debug; inputs mode: Int32, center_pt: Point3d, peak_offset: Double, distY: Double, distX: Double, ellipseA: Double, ellipseB: Double, nSegments: Int32
# ---------- python_3_script: Python ----------
import Rhino.Geometry as rg
import math
import scriptcontext as sc

tol = sc.doc.ModelAbsoluteTolerance
debug_log = []

# ==================== Input ====================
C = center_pt
Cx, Cy, Cz = C.X, C.Y, C.Z
Z_base = Cz                   # Roof reference plane height
Z_peak = Cz + peak_offset     # Ridge/Cone Height

C_base = rg.Point3d(Cx, Cy, Z_base)

debug_log.append("=== INPUT ===")
debug_log.append("mode = {} (type: {})".format(mode, type(mode).__name__))
debug_log.append("center_pt = ({:.2f}, {:.2f}, {:.2f})".format(Cx, Cy, Cz))
debug_log.append("peak_offset = {}".format(peak_offset))
debug_log.append("Z_base = {}, Z_peak = {}".format(Z_base, Z_peak))
debug_log.append("distX = {}, distY = {}".format(distX, distY))
debug_log.append("ellipseA = {}, ellipseB = {}".format(ellipseA, ellipseB))

# ==================== Oval Cutting Tube ====================
def make_ellipse_cutter(center_xy, z_level, a, b, height=10000.0):
    plane = rg.Plane(rg.Point3d(center_xy.X, center_xy.Y, z_level - height/2.0),
                     rg.Vector3d.ZAxis)
    ell = rg.Ellipse(plane, a, b)
    ell_crv = ell.ToNurbsCurve()
    extr = rg.Extrusion.CreateExtrusion(ell_crv, rg.Vector3d(0, 0, height))
    return extr.ToBrep()

# ==================== Cut Brep using the X vertical plane + Y vertical plane ====================
def split_by_xy_axes(brep, center):
    big = 10000.0
    yz_plane = rg.Plane(center, rg.Vector3d.XAxis)
    xz_plane = rg.Plane(center, rg.Vector3d.YAxis)
    yz_srf = rg.PlaneSurface(yz_plane,
                             rg.Interval(-big, big), rg.Interval(-big, big)).ToBrep()
    xz_srf = rg.PlaneSurface(xz_plane,
                             rg.Interval(-big, big), rg.Interval(-big, big)).ToBrep()
    
    pieces1 = brep.Split(yz_srf, tol)
    if pieces1 is None or len(pieces1) == 0:
        pieces1 = [brep]
    
    result = []
    for p in pieces1:
        pieces2 = p.Split(xz_srf, tol)
        if pieces2 is not None and len(pieces2) > 0:
            result.extend(pieces2)
        else:
            result.append(p)
    return result

# ==================== Oval tube cutting ====================
def trim_with_ellipse(brep_list, ellipse_cutter, center_xy, a, b):
    out = []
    for bp in brep_list:
        splits = bp.Split(ellipse_cutter, tol)
        if splits is None or len(splits) == 0:
            amp = rg.AreaMassProperties.Compute(bp)
            ctr = amp.Centroid if amp else bp.GetBoundingBox(True).Center
            if ((ctr.X - center_xy.X)**2 / (a*a) +
                (ctr.Y - center_xy.Y)**2 / (b*b)) <= 1.0:
                out.append(bp)
            continue
        for s in splits:
            amp = rg.AreaMassProperties.Compute(s)
            if amp is None:
                continue
            ctr = amp.Centroid
            if ((ctr.X - center_xy.X)**2 / (a*a) +
                (ctr.Y - center_xy.Y)**2 / (b*b)) <= 0.99:
                out.append(s)
    return out

# ==================== Mode 0 (A): Rectangular Pitched Roof ====================
def build_mode_A():
    p_top = rg.Point3d(Cx, Cy + distY, Z_base)
    p_mid = rg.Point3d(Cx, Cy,         Z_peak)
    p_bot = rg.Point3d(Cx, Cy - distY, Z_base)
    pts = [p_bot, p_mid, p_top]
    
    crv = rg.PolylineCurve(pts)
    
    crv_start = crv.DuplicateCurve()
    crv_start.Translate(rg.Vector3d(-distX, 0, 0))
    extr_srf = rg.Surface.CreateExtrusion(crv_start, rg.Vector3d(2*distX, 0, 0))
    brep = rg.Brep.CreateFromSurface(extr_srf)
    return brep

# ==================== Mode 1 (B): Cone  ====================
def build_mode_B():
    n = int(nSegments) if nSegments else 16
    if n < 4:
        n = 4
    if n % 4 != 0:
        n = ((n // 4) + 1) * 4
    debug_log.append("Mode B (cone): nSegments = {}".format(n))
    
    pts_on_ellipse = []
    for i in range(n):
        ang = 2.0 * math.pi * i / n
        x = Cx + ellipseA * math.cos(ang)
        y = Cy + ellipseB * math.sin(ang)
        pts_on_ellipse.append(rg.Point3d(x, y, Z_base))
    
    apex = rg.Point3d(Cx, Cy, Z_peak)
    
    triangles = []
    for i in range(n):
        p0 = pts_on_ellipse[i]
        p1 = pts_on_ellipse[(i + 1) % n]
        tri = rg.Brep.CreateFromCornerPoints(apex, p0, p1, tol)
        if tri:
            triangles.append(tri)
    
    quad = [[], [], [], []]
    for t in triangles:
        ctr = t.GetBoundingBox(True).Center
        dx = ctr.X - Cx
        dy = ctr.Y - Cy
        if dx >= 0 and dy >= 0:
            quad[0].append(t)
        elif dx < 0 and dy >= 0:
            quad[1].append(t)
        elif dx < 0 and dy < 0:
            quad[2].append(t)
        else:
            quad[3].append(t)
    
    out = []
    for group in quad:
        if len(group) == 0:
            continue
        joined = rg.Brep.JoinBreps(group, tol)
        if joined and len(joined) > 0:
            out.extend(joined)
        else:
            out.extend(group)
    return out

# ==================== Mode 3 (C): Oval X Axis move Z ====================
def build_mode_C():
    ridge_L = rg.Point3d(Cx - distX, Cy, Z_peak)
    ridge_R = rg.Point3d(Cx + distX, Cy, Z_peak)
    yp_L = rg.Point3d(Cx - distX, Cy + distY, Z_base)
    yp_R = rg.Point3d(Cx + distX, Cy + distY, Z_base)
    yn_L = rg.Point3d(Cx - distX, Cy - distY, Z_base)
    yn_R = rg.Point3d(Cx + distX, Cy - distY, Z_base)
    
    face_yp = rg.Brep.CreateFromCornerPoints(ridge_L, ridge_R, yp_R, yp_L, tol)
    face_yn = rg.Brep.CreateFromCornerPoints(ridge_L, ridge_R, yn_R, yn_L, tol)
    
    joined = rg.Brep.JoinBreps([face_yp, face_yn], tol)
    if joined and len(joined) > 0:
        return joined[0]
    else:
        return [face_yp, face_yn]

# ==================== Mode 4 (D): Oval Y Axis move Z ====================
def build_mode_D():
    ridge_F = rg.Point3d(Cx, Cy - distY, Z_peak)
    ridge_B = rg.Point3d(Cx, Cy + distY, Z_peak)
    xp_F = rg.Point3d(Cx + distX, Cy - distY, Z_base)
    xp_B = rg.Point3d(Cx + distX, Cy + distY, Z_base)
    xn_F = rg.Point3d(Cx - distX, Cy - distY, Z_base)
    xn_B = rg.Point3d(Cx - distX, Cy + distY, Z_base)
    
    face_xp = rg.Brep.CreateFromCornerPoints(ridge_F, ridge_B, xp_B, xp_F, tol)
    face_xn = rg.Brep.CreateFromCornerPoints(ridge_F, ridge_B, xn_B, xn_F, tol)
    
    joined = rg.Brep.JoinBreps([face_xp, face_xn], tol)
    if joined and len(joined) > 0:
        return joined[0]
    else:
        return [face_xp, face_xn]

# ==================== Main process ====================
result = []
mode_int = int(mode) if mode is not None else 0
debug_log.append("=== ROUTING ===")
debug_log.append("mode_int = {}".format(mode_int))

if mode_int == 0:
    debug_log.append(">>> Running Mode A (rectangular)")
    raw = build_mode_A()
    result = split_by_xy_axes(raw, C_base)
    debug_log.append("Mode A: {} pieces after X/Y split".format(len(result)))

elif mode_int == 1:
    debug_log.append(">>> Running Mode B (cone)")
    result = build_mode_B()
    debug_log.append("Mode B: {} groups output".format(len(result)))


elif mode_int == 2:
    debug_log.append(">>> Running Mode D (X-ridge)")
    raw = build_mode_C()
    if isinstance(raw, list):
        pieces = []
        for r in raw:
            pieces.extend(split_by_xy_axes(r, C_base))
    else:
        pieces = split_by_xy_axes(raw, C_base)
    debug_log.append("Mode D: {} pieces after X/Y split".format(len(pieces)))
    cutter = make_ellipse_cutter(C_base, Z_base, ellipseA, ellipseB)
    result = trim_with_ellipse(pieces, cutter, C_base, ellipseA, ellipseB)
    debug_log.append("Mode D: {} pieces after ellipse trim".format(len(result)))

elif mode_int == 3:
    debug_log.append(">>> Running Mode E (Y-ridge)")
    raw = build_mode_D()
    if isinstance(raw, list):
        pieces = []
        for r in raw:
            pieces.extend(split_by_xy_axes(r, C_base))
    else:
        pieces = split_by_xy_axes(raw, C_base)
    debug_log.append("Mode E: {} pieces after X/Y split".format(len(pieces)))
    cutter = make_ellipse_cutter(C_base, Z_base, ellipseA, ellipseB)
    result = trim_with_ellipse(pieces, cutter, C_base, ellipseA, ellipseB)
    debug_log.append("Mode E: {} pieces after ellipse trim".format(len(result)))

else:
    debug_log.append(">>> ERROR: mode_int out of range, no output")

# ==================== Breps Tyoe check ====================
def ensure_brep(obj):
    if obj is None:
        return None
    if isinstance(obj, rg.Brep):
        return obj
    if isinstance(obj, rg.Surface):
        return rg.Brep.CreateFromSurface(obj)
    if isinstance(obj, rg.BrepFace):
        return obj.DuplicateFace(False)
    if isinstance(obj, rg.Extrusion):
        return obj.ToBrep()
    return None

debug_log.append("=== TYPE CHECK ===")
result_clean = []
for i, item in enumerate(result):
    b = ensure_brep(item)
    type_name = type(item).__name__
    if b is None:
        debug_log.append("result[{}] type={} -> FAILED to convert".format(i, type_name))
    else:
        result_clean.append(b)
        debug_log.append("result[{}] type={} -> Brep OK".format(i, type_name))
result = result_clean

debug_log.append("=== EDGE CHECK ===")
for i, b in enumerate(result):
    try:
        edge_count = b.Edges.Count
        face_count = b.Faces.Count
        is_solid = b.IsSolid
        debug_log.append("result[{}]: Faces={}, Edges={}, IsSolid={}".format(
            i, face_count, edge_count, is_solid))
    except AttributeError as e:
        debug_log.append("result[{}]: NO .Edges attribute! Error: {}".format(i, e))
    except Exception as e:
        debug_log.append("result[{}]: Error checking edges: {}".format(i, e))

debug_log.append("=== OUTPUT ===")
debug_log.append("Final result count: {}".format(len(result)))

roof_brep = result
debug = "\n".join(debug_log)

print(debug)
print(roof_brep)
# ---------- end python_3_script ----------
panel_2 = Panel(python_3_script.roof_brep)

yz_plane = YZPlane(Origin=construct_point)
number_slider_5 = Slider(1.1, range=0..10)
rotate = Rotate(Geometry=python_3_script.roof_brep, Angle=Slider(19, range=0..100), Plane=yz_plane)  # -> Geometry, Transform
number_slider_6 = Slider(0.2, range=0..3)

# ----
# Different heights Supports
point = Point([Point(2.7, 7.810000534, 1), Point(0.3, 1.810000534, 0), Point(2.7, 1.810000534, 0), Point(0.3, 7.810000534, 1)])

# ----
# Same heights Supports
point_2 = Point()

center_box = CenterBox(Base=point, X=number_slider_6, Y=number_slider_6, Z=number_slider_6)
panel_3 = Panel(rotate.Geometry)
scale_nu = ScaleNU(Geometry=rotate.Geometry, Plane=construct_point, ScaleX=1, ScaleY=Slider(1.1, range=0..10), ScaleZ=1)  # -> Geometry, Transform

# ----
# create and manipulate graph
python_3_script_2 = Python3Script(roof_breps=python_3_script.roof_brep, supports=point, z_steps=entwine)  # -> out, ridges_tree, all_edges, graph, all_nodes, node_keys; inputs roof_breps: list of Brep, supports: list of Point3d, z_steps: tree of Double
# ---------- python_3_script_2: Python ----------
import os
import sys
from compas_rhino import unload_modules
import compas
compas.PRECISION = ".3f"

gh_dir = os.path.dirname(ghenv.Component.OnPingDocument().FilePath)
sys.path.append(gh_dir)

import tree_builder_WN
import nodegraph
import importlib

importlib.reload(nodegraph)
importlib.reload(tree_builder_WN)


from tree_builder_WN import build_tree_graph_from_breps
from Grasshopper import DataTree
from Grasshopper.Kernel.Data import GH_Path

# lines_tree will be our output
lines_tree = DataTree[object]()
z_tree = []
# 1. Iterate using the Branch count
for i in range(z_steps.BranchCount):
    branch = list(z_steps.Branch(i)) 
    z_tree.append(branch)

# CONSTANTS #
div_x = 3
div_y = 3
num_levels = 3

inset_edge = 0.5
inset_interior = 0.5

# Build the graph (all logic is in tree_builder.py)
ng = build_tree_graph_from_breps(
    supports=supports,
    input_breps=roof_breps,
    div_x=div_x if div_x else 8,
    div_y=div_y if div_y else 6,
    num_levels=num_levels if num_levels else 4,
    z_steps=z_tree,
    inset_edge=inset_edge if inset_edge else 0.5,
    inset_interior=inset_interior if inset_interior else 0.4,
    reach_tol=0.05,
    debug=True
)

# Outputs
all_edges = ng.edge_lines()
graph = ng
all_nodes = ng.node_points()
node_keys = list(ng.nodes())
# ---------- end python_3_script_2 ----------
compas_draw = COMPASDraw(cg=python_3_script_2.all_nodes)  # -> rg
#   port cg: The COMPAS geometry or datastructure to be drawn.
#   port rg: The Rhino geometry object.
# ---------- compas_draw: Python ----------
# r: compas>=2.14.1
"""
Draws COMPAS geometry in Grasshopper.
"""

from typing import Any

import Grasshopper

from compas.scene import SceneObject


class CompasToRhinoGeometry(Grasshopper.Kernel.GH_ScriptInstance):
    def RunScript(self, cg):
        if not cg:
            return None

        return SceneObject(item=cg).draw()
# ---------- end compas_draw ----------
compas_draw_2 = COMPASDraw(cg=python_3_script_2.all_edges)  # -> rg; same code as compas_draw

# ----
# Filter nodes to diamond shape
python_3_script_3 = Python3Script(
    graph=python_3_script_2.graph,
    mode=number_slider_2,
    center_pt=construct_point,
    ellipseA=number_slider_3,
    ellipseB=number_slider_4)  # -> out, node_graph, edges, nodes; inputs mode: Int32, center_pt: Point3d, ellipseA: Double, ellipseB: Double
# ---------- python_3_script_3: Python ----------
import os, sys, importlib
gh_dir = os.path.dirname(ghenv.Component.OnPingDocument().FilePath)
if gh_dir not in sys.path:
    sys.path.insert(0, gh_dir)

import nodegraph
importlib.reload(nodegraph)

from copy import deepcopy
from compas.geometry import Point

debug_log = []

# ==================== auto enable ====================
mode_int = int(mode) if mode is not None else 0
enable = mode_int in [1, 2, 3]   # B, D, E (cone, X-ridge, Y-ridge) use filter

debug_log.append("=== INPUT ===")
debug_log.append("mode = {}, auto_enable = {}".format(mode_int, enable))
debug_log.append("center_pt = ({:.2f}, {:.2f}, {:.2f})".format(
    center_pt.X, center_pt.Y, center_pt.Z))
debug_log.append("ellipseA = {}, ellipseB = {}".format(ellipseA, ellipseB))

# ==================== Copy graph ====================
ng = deepcopy(graph)

if not enable:
    debug_log.append(">>> Filter DISABLED (Mode A 不裁剪)")
    debug_log.append("Pass-through: {} nodes, {} edges".format(
        ng.number_of_nodes(), ng.number_of_edges()))
else:
    Cx = center_pt.X
    Cy = center_pt.Y

    def is_in_diamond(pt, cx, cy, a, b, tol=1e-6):
        """点 (x, y) 是否在菱形内 (4 顶点 = 椭圆 ±a/±b 端点)"""
        if pt is None:
            return False
        return (abs(pt.x - cx) / a + abs(pt.y - cy) / b) <= 1.0 + tol

    # ==================== Find All nodes to be deleted ====================
    # Strategy: Delete all nodes outside the diamond shape, but forcibly retain supporting nodes (reached=True).
    nodes_before = ng.number_of_nodes()
    edges_before = ng.number_of_edges()
    support_nodes = set(ng.get_support_nodes())
    debug_log.append("Support nodes (will be preserved): {}".format(list(support_nodes)))
    
    # Collect the keys of the nodes to be deleted
    nodes_to_delete = []
    for node_key in list(ng.nodes()):  # Use list() to copy to avoid modification during iteration.
        # Forced retention of support nodes
        if node_key in support_nodes:
            continue
        pt = ng.node_attribute(node_key, "point")
        if pt is None:
            continue
        if not is_in_diamond(pt, Cx, Cy, ellipseA, ellipseB):
            nodes_to_delete.append((node_key, pt))
    
    debug_log.append("Nodes to delete: {} (out of {} non-support)".format(
        len(nodes_to_delete), nodes_before - len(support_nodes)))
    
    # ==================== Execute deletion ====================
    # compas Graph.delete_node Automatically delete associated edges
    # But NodeGraph._point_index Manual cleaning is required.
    for node_key, pt in nodes_to_delete:
        # Clean up point_index (to avoid misjudgments in subsequent get_or_add_point_node calls)
        pkey = ng.point_key(pt)
        if pkey in ng._point_index:
            del ng._point_index[pkey]
        # Delete a node (this will automatically delete any associated edges).
        ng.delete_node(node_key)
    
    nodes_after = ng.number_of_nodes()
    edges_after = ng.number_of_edges()
    debug_log.append("Nodes: {} -> {} (deleted {})".format(
        nodes_before, nodes_after, nodes_before - nodes_after))
    debug_log.append("Edges: {} -> {} (auto-removed with nodes)".format(
        edges_before, edges_after))

# ==================== 输出 ====================
node_graph = ng
edges = ng.edge_lines()
nodes = ng.node_points()

debug_log.append("=== OUTPUT ===")
debug_log.append("Final: {} nodes, {} edges".format(
    ng.number_of_nodes(), ng.number_of_edges()))

debug = "\n".join(debug_log)
print(debug)
# ---------- end python_3_script_3 ----------

# ----
# Attractor Move nodes
number_slider_7 = Slider(14.34, range=0..20)
value_list = ValueList({"Bipolar": 0, "Z Target": 1}, selected="Z Target")
point_3 = Point(Point(7.010255603, 7.039901537, 0.8571928508))
python_3_script_4 = Python3Script(
    graph=python_3_script_3.node_graph,
    attractor=point_3,
    max_dist=number_slider_7,
    strength=Slider(0.38, range=0..3),
    falloff_mode=value_list,
    enable=Toggle(False))  # -> out, node_graph, edges, nodes; inputs attractor: Point3d, max_dist: Double, strength: Double, falloff_mode: Int32, enable: Boolean
# ---------- python_3_script_4: Python ----------
import os, sys, importlib
gh_dir = os.path.dirname(ghenv.Component.OnPingDocument().FilePath)
if gh_dir not in sys.path:
    sys.path.insert(0, gh_dir)

import nodegraph
importlib.reload(nodegraph)

from copy import deepcopy
from compas.geometry import Vector

# ==================== Input ====================
# graph: NodeGraph
# attractor: Point3d
# max_dist: float (XY 影响半径, 米)
# strength: float (Mode 0: 最大 Z 偏移; Mode 1: 靠拢比例 0-1)
# falloff_mode: int (0=bipolar 近抬升远下沉, 1=z_target 向 attractor.Z 靠拢)
# enable: bool

debug_log = []
debug_log.append("=== INPUT ===")
debug_log.append("attractor = ({:.2f}, {:.2f}, {:.2f})".format(
    attractor.X, attractor.Y, attractor.Z))
debug_log.append("max_dist = {}, strength = {}".format(max_dist, strength))

mode_int = int(falloff_mode) if falloff_mode is not None else 0
mode_names = {0: "bipolar (近抬升远下沉)", 
              1: "z_target (向 attractor.Z 靠拢)"}
debug_log.append("falloff_mode = {} ({})".format(mode_int, mode_names.get(mode_int, "INVALID")))
debug_log.append("enable = {}".format(enable))

# ==================== Copy graph ====================
ng = deepcopy(graph)

if not enable:
    debug_log.append(">>> DISABLED, pass through")
else:
    Ax = attractor.X
    Ay = attractor.Y
    Az = attractor.Z
    
    # ==================== Z offset 公式 ====================
    def compute_z_offset(pt_x, pt_y, pt_z):
        dx = pt_x - Ax
        dy = pt_y - Ay
        dist = (dx*dx + dy*dy) ** 0.5
        
        if mode_int == 0:
            # Bipolar: 近抬升远下沉
            # dist=0       -> +strength
            # dist=max/2   -> 0
            # dist=max_dist -> -strength
            # dist>max_dist -> -strength (截断)
            if dist >= max_dist:
                return -strength
            return strength * (1.0 - 2.0 * dist / max_dist)
        
        elif mode_int == 1:
            # Z target: 影响范围内的节点向 attractor.Z 靠拢
            # strength 在这里是"靠拢比例" (0=不动, 1=完全到达 attractor.Z)
            if dist >= max_dist:
                return 0.0
            weight = 1.0 - dist / max_dist
            delta = Az - pt_z
            return delta * weight * strength
        
        else:
            return 0.0
    
    # ==================== Find supports ====================
    support_nodes = set(ng.get_support_nodes())
    debug_log.append("Support nodes (skipped): {}".format(list(support_nodes)))
    
    moved_count = 0
    skipped_fixed = 0
    
    for node_key in list(ng.nodes()):
        if node_key in support_nodes:
            continue
        pt = ng.node_attribute(node_key, "point")
        if pt is None:
            continue
        
        z_offset = compute_z_offset(pt.x, pt.y, pt.z)
        
        offset_vec = Vector(0, 0, z_offset)
        result = ng.move_node(node_key, offset_vec, 
                              axis_factors={"x": 1.0, "y": 1.0, "z": 1.0})
        
        if result is None:
            continue
        old_pt, new_pt, disp = result
        
        if disp < 1e-9:
            skipped_fixed += 1
        else:
            moved_count += 1
    
    debug_log.append("Moved: {}, Skipped (fixed): {}".format(moved_count, skipped_fixed))

# ==================== Output ====================
node_graph = ng
edges = ng.edge_lines()
nodes = ng.node_points()

debug_log.append("Final: {} nodes, {} edges".format(
    ng.number_of_nodes(), ng.number_of_edges()))

debug = "\n".join(debug_log)
print(debug)
# ---------- end python_3_script_4 ----------

plane_normal = PlaneNormal(Origin=point_3, ZAxis=Vector(0, 0, 1))
circle = Circle(Plane=plane_normal, Radius=number_slider_7)

# ----
# transform/Modify points
brep = Brep(<brep referenced from the Rhino model>)
python_3_script_5 = Python3Script(graph=python_3_script_4.node_graph, repellors=brep)  # -> out, edges, nodes, node_graph; inputs repellors: list of Brep
# ---------- python_3_script_5: Python ----------
import os, sys, importlib
gh_dir = os.path.dirname(ghenv.Component.OnPingDocument().FilePath)
if gh_dir not in sys.path:
    sys.path.insert(0, gh_dir)

### -----------------------------
## IMPORT
### -----------------------------
import nodegraph

importlib.reload(nodegraph)

from copy import deepcopy
from compas.geometry import Vector, Line, Point, centroid_points

ng = deepcopy(graph)



ng, results = ng.move_nodes_from_geometry(
    repellors,               # Mix of anything
    max_distance = 2.0,
    strength = 2,
    falloff = "smooth"
)

# Outputs
node_graph = ng
edges = ng.edge_lines()
nodes = ng.node_points()
moved_pts = [r['new'] for r in results.values()]
# ---------- end python_3_script_5 ----------

# ----
# preview graph
number_slider_8 = Slider(0.1, range=-0.5..0.5)
compas_draw_3 = COMPASDraw(cg=python_3_script_5.edges)  # -> rg; same code as compas_draw
compas_draw_4 = COMPASDraw(cg=python_3_script_5.nodes)  # -> rg; same code as compas_draw
dot_display = DotDisplay(Point=compas_draw_4, Colour=ColourSwatch(SwatchColor=RGB(128, 128, 128)), Size=number_slider_8)

custom_preview_lineweights = CustomPreviewLineweights(
    Geometry=compas_draw_3,
    Shader=ColourSwatch(SwatchColor=RGB(144, 209, 232)),
    Thickness=Slider(4, range=0..10),
    Absolute=False)

# ----
# Classfiy Edges
# op1 rotate
# op2 choose 1 to be primary and shift others
# op3 use design, cut diagonal
python_3_script_6 = Python3Script(graph=python_3_script_5.node_graph)  # -> out, primary_lines, secondary_lines, tertiary_lines, nodes_pts, nodes_idx, chosen_edge_lines, graph_out
# ---------- python_3_script_6: Python ----------
import os, sys, importlib

gh_dir = os.path.dirname(ghenv.Component.OnPingDocument().FilePath)
if gh_dir not in sys.path:
    sys.path.insert(0, gh_dir)

import edge_classifier
importlib.reload(edge_classifier)
from edge_classifier import classify_edges_by_support_direction, create_subgraphs
from compas.geometry import Line

primary_lines, secondary_lines, tertiary_lines, classification_data  = classify_edges_by_support_direction(
    graph,
    return_tertiary=True
)


# output 
graph_out = graph
# ---------- end python_3_script_6 ----------
draw = COMPASDraw(cg=python_3_script_6.primary_lines)  # -> rg; same code as compas_draw
draw_2 = COMPASDraw(cg=python_3_script_6.secondary_lines)  # -> rg; same code as compas_draw
draw_3 = COMPASDraw(cg=python_3_script_6.tertiary_lines)  # -> rg; same code as compas_draw
draw_4 = COMPASDraw(cg=python_3_script_6.nodes_pts)  # -> rg; same code as compas_draw
draw_5 = COMPASDraw(cg=python_3_script_6.chosen_edge_lines)  # -> rg; same code as compas_draw
custom_preview_lineweights_2 = CustomPreviewLineweights(Geometry=draw, Shader=ColourSwatch(SwatchColor=RGB(137, 50, 143)), Thickness="8", Absolute=False)
custom_preview_lineweights_3 = CustomPreviewLineweights(Geometry=draw_2, Shader=ColourSwatch(SwatchColor=RGB(50, 143, 103)), Thickness="6", Absolute=False)
custom_preview_lineweights_4 = CustomPreviewLineweights(Geometry=draw_3, Shader=ColourSwatch(SwatchColor=RGB(218, 157, 103)), Thickness="6", Absolute=False)

swatch = ColourSwatch(SwatchColor=RGB(51, 56, 66))
text_tag = TextTag(Location=draw_4, Text=python_3_script_6.nodes_idx, Colour=swatch)
dot_display_2 = DotDisplay(Point=draw_4, Colour=swatch, Size=Slider(0.1, range=0..0.1))

panel_4 = Panel(python_3_script_6.secondary_lines)

offset_surface = OffsetSurface(Surface=python_3_script.roof_brep, Distance=Slider(0.06, range=0..0.1), BothSides=0, CreateSolid=True)
ct_beam = CTBeam(centerline=compas_draw_3, width=Slider(0.1, range=0..0.1), height=Slider(0.12, range=0..1))  # -> Beam, Blank; inputs centerline: list, z_vector: list of Vector3d, width: list of Double, height: list of Double, category: list of String, updateRefObj: Boolean
#   port centerline: Referenced curve or line, Guid of curve or line in the active Rhino document.
#   port z_vector: Vector defining the orientation of the cross-section (corresponds to the height dimension). If None, a default will be taken.
#   port width: Width of the cross-section (usually the smaller dimension).
#   port height: Height of the cross-section (usually the larger dimension).
#   port category: Category of a beam.
#   port updateRefObj: (optional) If True, the attributes in the referenced object will be updated/overwritten with the new values given here.
#   port Beam: Beam object(s).
#   port Blank: Shape of the beam's blank.
# ---------- ct_beam: Python ----------
# r: compas_timber==1.0.5
"""Creates a Beam from a LineCurve."""

# flake8: noqa
import Grasshopper
import Rhino
import rhinoscriptsyntax as rs
import System
from compas.scene import Scene
from compas_rhino.conversions import line_to_compas
from compas_rhino.conversions import vector_to_compas

from compas_timber.elements import Beam as CTBeam
from compas_timber.ghpython.rhino_object_name_attributes import update_rhobj_attributes_name
from compas_timber.ghpython.ghcomponent_helpers import list_input_valid_cpython


class Beam_fromCurve(Grasshopper.Kernel.GH_ScriptInstance):
    def RunScript(self,
            centerline: System.Collections.Generic.List[object],
            z_vector: System.Collections.Generic.List[Rhino.Geometry.Vector3d],
            width: System.Collections.Generic.List[float],
            height: System.Collections.Generic.List[float],
            category: System.Collections.Generic.List[str],
            updateRefObj: bool):
        # minimum inputs required
        if not list_input_valid_cpython(ghenv, centerline, "Centerline"):
            return
        if not width:
            length = self._get_centerline_length(centerline)
            width = [length / 20]
        if not height:
            length = self._get_centerline_length(centerline)
            height = [length / 10]

        # reformat unset parameters for consistency
        if not z_vector:
            z_vector = [None]
        if not category:
            category = [None]

        beams = []
        blanks = []
        scene = Scene()

        if centerline and height and width:
            # check list lengths for consistency
            N = len(centerline)
            if len(z_vector) not in (0, 1, N):
                ghenv.Component.AddRuntimeMessage(
                    Grasshopper.Kernel.GH_RuntimeMessageLevel.Error, " In 'ZVector' I need either none, one or the same number of inputs as the Crv parameter."
                )
            if len(width) not in (1, N):
                ghenv.Component.AddRuntimeMessage(Grasshopper.Kernel.GH_RuntimeMessageLevel.Error, " In 'W' I need either one or the same number of inputs as the Crv parameter.")
            if len(height) not in (1, N):
                ghenv.Component.AddRuntimeMessage(Grasshopper.Kernel.GH_RuntimeMessageLevel.Error, " In 'H' I need either one or the same number of inputs as the Crv parameter.")
            if len(category) not in (0, 1, N):
                ghenv.Component.AddRuntimeMessage(
                    Grasshopper.Kernel.GH_RuntimeMessageLevel.Error, " In 'Category' I need either none, one or the same number of inputs as the Crv parameter."
                )

            # duplicate data if None or single value
            if len(z_vector) != N:
                z_vector = [z_vector[0] for _ in range(N)]
            if len(width) != N:
                width = [width[0] for _ in range(N)]
            if len(height) != N:
                height = [height[0] for _ in range(N)]
            if len(category) != N:
                category = [category[0] for _ in range(N)]

            for line, z, w, h, c in zip(centerline, z_vector, width, height, category):
                guid, geometry = self._get_guid_and_geometry(line)
                rhino_line = rs.coerceline(geometry)
                line = line_to_compas(rhino_line)

                z = vector_to_compas(z) if z else None
                beam = CTBeam.from_centerline(centerline=line, width=w, height=h, z_vector=z)
                beam.attributes["rhino_guid"] = str(guid) if guid else None
                beam.attributes["category"] = c
                if updateRefObj and guid:
                    update_rhobj_attributes_name(guid, "width", str(w))
                    update_rhobj_attributes_name(guid, "height", str(h))
                    update_rhobj_attributes_name(guid, "zvector", str(list(beam.frame.zaxis)))
                    update_rhobj_attributes_name(guid, "category", c)

                beams.append(beam)
                scene.add(beam.blank)

        blanks = scene.draw()

        return beams, blanks

    def _get_guid_and_geometry(self, line):
        # internalized curves and GH geometry will not have persistent GUIDs, referenced Rhino objects will
        # type hint on the input has to be 'ghdoc' for this to work
        guid = None
        geometry = line
        rhino_obj = Rhino.RhinoDoc.ActiveDoc.Objects.FindId(line)
        if rhino_obj:
            guid = line
            geometry = rhino_obj.Geometry
        return guid, geometry

    def _get_centerline_length(self, centerline):
        centerline_length = []
        for i in centerline:
            centerline_length.append(rs.CurveLength(i))
        if centerline_length:
            length_average = sum(centerline_length) / len(centerline_length)
        else:
            length_average = 1
        return length_average
# ---------- end ct_beam ----------
volume = Volume(Geometry=ct_beam.Blank)  # -> Volume, Centroid
mass_addition = MassAddition(Input=volume.Volume)  # -> Result, PartialResults
relay = Relay([ct_beam.Blank, offset_surface])
custom_preview = CustomPreview(Geometry=relay, Material=ColourSwatch(SwatchColor=RGB(219, 206, 167)))
panel_5 = Panel(mass_addition.Result)

# ----
# half the beam width?
number_slider_9 = Slider(0.02, range=0..0.1)

py3 = Python3Script(ng=python_3_script_6.graph_out, z_shift=number_slider_9)  # -> out, a, b, c, d, e, f, graph_out, edges, shifted; inputs z_shift: Double
# ---------- py3: Python ----------
import os, sys, importlib
from copy import deepcopy

gh_dir = os.path.dirname(ghenv.Component.OnPingDocument().FilePath)
if gh_dir not in sys.path:
    sys.path.insert(0, gh_dir)

import edge_classifier
import reciprocal
import line_constraints

importlib.reload(edge_classifier)
importlib.reload(reciprocal)
importlib.reload(line_constraints)

graph = deepcopy(ng)

# -----------------------------
# controls
# -----------------------------
sign_primary = +1
sign_secondary = +1
engage_len = 0.11
tol = 0.1
iters = 5


# -----------------------------
# 1) reciprocal primary
# -----------------------------
res_primary = reciprocal.reciprocal_width_from_subgraph(
    graph,
    target_hierarchy="primary",
    engage_len=engage_len,
    tol=tol,
    rotation_sign=sign_primary,
    min_degree=3,
    iterations=iters,
    max_angle=180.0
)
g = res_primary["graph"]

# -----------------------------
# 2) regenerate secondary (level 1 up)
# -----------------------------
line_constraints.snap_to_host(
    g,
    target_hierarchy="secondary",
    move_node_level = 1,
    host_hierarchy="primary",
    z_offset = z_shift,
    write_attribute=True,
    debug=False
)


# -----------------------------
# 3) reciprocal secondary
# -----------------------------
res_secondary = reciprocal.reciprocal_width_from_subgraph(
    g,
    target_hierarchy="secondary",
    engage_len=engage_len,
    tol=tol,
    rotation_sign=sign_secondary,
    min_degree=3,
    iterations=iters,
    max_angle=180.0
)
g = res_secondary["graph"]

# -----------------------------
# 5) regenerate tertiary (level 0 up)
# -----------------------------
line_constraints.snap_to_host(
    g,
    target_hierarchy="tertiary",
    move_node_level=0,
    host_hierarchy="secondary" ,
    z_offset = z_shift,
    write_attribute=True,
    debug=False
)

line_constraints.snap_to_host(
    g,
    target_hierarchy="tertiary",
    move_node_level=0,
    host_hierarchy="primary",
    z_offset = z_shift,
    write_attribute=True,
    debug=False
)

shifted = []
for e in g.edges():
    shifted.append(g.edge_attribute(e, "shifted_line"))

graph_out = g
# ---------- end py3 ----------
draw_6 = COMPASDraw(cg=py3.a)  # -> rg; same code as compas_draw
draw_7 = COMPASDraw(cg=py3.b)  # -> rg; same code as compas_draw
draw_8 = COMPASDraw(cg=py3.d)  # -> rg; same code as compas_draw
draw_9 = COMPASDraw(cg=py3.shifted)  # -> rg; same code as compas_draw
draw_10 = COMPASDraw(cg=py3.edges)  # -> rg; same code as compas_draw
draw_11 = COMPASDraw(cg=py3.c)  # -> rg; same code as compas_draw

panel_6 = Panel(py3.shifted)

# ----
# shifting and add shoes
python_3_script_7 = Python3Script(graph=python_3_script_6.graph_out)  # -> out, graph_out, shoe_lines
# ---------- python_3_script_7: Python ----------
import os, sys, importlib
gh_dir = os.path.dirname(ghenv.Component.OnPingDocument().FilePath)
if gh_dir not in sys.path:
    sys.path.insert(0, gh_dir)


import leaf_solver
importlib.reload(leaf_solver)
from leaf_solver import create_shoes_from_graph
from copy import deepcopy



ng = deepcopy(graph)
result = create_shoes_from_graph(ng, extension_length = 0.20)

shoe_lines = result["shoe_lines"]
graph_out = ng
# ---------- end python_3_script_7 ----------
draw_12 = COMPASDraw(cg=python_3_script_7.shoe_lines)  # -> rg; same code as compas_draw

# ----
# Foundation
python_3_script_8 = Python3Script(graph=py3.graph_out)  # -> out, graph_out, crosecs, cut_planes, sup_lines
# ---------- python_3_script_8: Python ----------
import os, sys, importlib
gh_dir = os.path.dirname(ghenv.Component.OnPingDocument().FilePath)
if gh_dir not in sys.path:
    sys.path.insert(0, gh_dir)


import foundation_solver
importlib.reload(foundation_solver)
from foundation_solver import trim_anchored_beams_and_find_cut_planes
from copy import deepcopy

from compas.geometry import Polygon

############--------Main Code----------#########
ng = deepcopy(graph)
result = trim_anchored_beams_and_find_cut_planes(ng, min_gap=0.01, min_height=0.0)

########--------Output Data---------#########
cro_sec_dict = result["cross_sections"]
crosecs = []
for node, cro_sec_list in cro_sec_dict.items():
    for crosec in cro_sec_list:
        poly = Polygon(crosec)
        crosecs.append(poly)

cut_pln_dict = result["cut_planes"]
cut_planes = []
for node, pln in cut_pln_dict.items():
    cut_planes.append(pln)


sup_lines = []
for edge in graph.get_support_edges():
    if "shifted_line" in graph.edge_attributes(edge):
        ln = graph.edge_attribute(edge, "shifted_line")
    else:
        ln = graph.edge_line(edge)
    sup_lines.append(ln)

#############-----------Print----------##########
# print (result["cross_sections"])
# print ()
# print (result["cut_planes"])
print (result["foundation_heights"])
# ---------- end python_3_script_8 ----------
draw_13 = COMPASDraw(cg=python_3_script_8.crosecs)  # -> rg; same code as compas_draw
draw_14 = COMPASDraw(cg=python_3_script_8.cut_planes)  # -> rg; same code as compas_draw
draw_15 = COMPASDraw(cg=python_3_script_8.sup_lines)  # -> rg; same code as compas_draw

panel_7 = Panel(python_3_script_8.crosecs)

# ----
# lines for compas_timber from graph
py3_2 = Python3Script(graph=py3.graph_out)  # -> out, a, b, c
# ---------- py3_2: Python ----------
import Rhino.Geometry as rg
from compas.geometry import Line, Point
from copy import deepcopy

ng = deepcopy(graph)

primary_shifted = []
secondary_shifted = []
tertiary_shifted = []

def to_rhino_line(compas_line):
    """compas Line -> Rhino.Geometry.Line"""
    if compas_line is None:
        return None
    if isinstance(compas_line, rg.Line):
        return compas_line
    try:
        s = compas_line.start
        e = compas_line.end
        return rg.Line(
            rg.Point3d(s.x, s.y, s.z),
            rg.Point3d(e.x, e.y, e.z)
        )
    except AttributeError:
        return None

for e in ng.edges():
    h = ng.edge_attribute(e, "hierarchy")
    ln = ng.edge_attribute(e, "shifted_line")
    if ln is None:
        continue
    
    rg_line = to_rhino_line(ln)
    if rg_line is None:
        continue

    if h == "primary":
        primary_shifted.append(rg_line)
    elif h == "secondary":
        secondary_shifted.append(rg_line)
    elif h == "tertiary":
        tertiary_shifted.append(rg_line)

a = primary_shifted
b = secondary_shifted
c = tertiary_shifted

# 验证
if a:
    print("a[0] type: {}".format(type(a[0]).__name__))
print("primary: {}, secondary: {}, tertiary: {}".format(
    len(a), len(b), len(c)))
# ---------- end py3_2 ----------

panel_8 = Panel(py3_2.b)

# ----
# Roof Brep extrusion in Z axis
number_slider_10 = Slider(0.06, range=0..1)
unit_z = UnitZ(Factor=number_slider_10)
extrude = Extrude(Base=python_3_script.roof_brep, Direction=unit_z)

line = Line([py3_2.a, py3_2.b, py3_2.c])
ct_beam_2 = CTBeam(centerline=line, width=Slider(0.1, range=0..0.5), height=Slider(0.12, range=0..1))  # -> Beam, Blank; inputs centerline: list, z_vector: list of Vector3d, width: list of Double, height: list of Double, category: list of String, updateRefObj: Boolean
#   port centerline: Referenced curve or line, Guid of curve or line in the active Rhino document.
#   port z_vector: Vector defining the orientation of the cross-section (corresponds to the height dimension). If None, a default will be taken.
#   port width: Width of the cross-section (usually the smaller dimension).
#   port height: Height of the cross-section (usually the larger dimension).
#   port category: Category of a beam.
#   port updateRefObj: (optional) If True, the attributes in the referenced object will be updated/overwritten with the new values given here.
#   port Beam: Beam object(s).
#   port Blank: Shape of the beam's blank.
# ---------- ct_beam_2: Python ----------
# env: D:\0000_ETH_DFAB\Github\timber_design\src
# r: compas_timber>=0.16.2
"""Creates a Beam from a LineCurve."""

# flake8: noqa
import Grasshopper
import Rhino
import rhinoscriptsyntax as rs
import System
from compas.scene import Scene
from compas_rhino.conversions import line_to_compas
from compas_rhino.conversions import vector_to_compas

from compas_timber.elements import Beam as CTBeam
from timber_design.ghpython.ghcomponent_helpers import list_input_valid_cpython


class Beam_fromCurve(Grasshopper.Kernel.GH_ScriptInstance):
    def RunScript(self,
            centerline: System.Collections.Generic.List[object],
            z_vector: System.Collections.Generic.List[Rhino.Geometry.Vector3d],
            width: System.Collections.Generic.List[float],
            height: System.Collections.Generic.List[float],
            category: System.Collections.Generic.List[str],
            updateRefObj: bool):
        # minimum inputs required
        if not list_input_valid_cpython(ghenv, centerline, "Centerline"):
            return
        if not width:
            length = self._get_centerline_length(centerline)
            width = [length / 20]
        if not height:
            length = self._get_centerline_length(centerline)
            height = [length / 10]

        # reformat unset parameters for consistency
        if not z_vector:
            z_vector = [None]
        if not category:
            category = [None]

        beams = []
        blanks = []
        scene = Scene()

        if centerline and height and width:
            # check list lengths for consistency
            N = len(centerline)
            if len(z_vector) not in (0, 1, N):
                ghenv.Component.AddRuntimeMessage(
                    Grasshopper.Kernel.GH_RuntimeMessageLevel.Error, " In 'ZVector' I need either none, one or the same number of inputs as the Crv parameter."
                )
            if len(width) not in (1, N):
                ghenv.Component.AddRuntimeMessage(Grasshopper.Kernel.GH_RuntimeMessageLevel.Error, " In 'W' I need either one or the same number of inputs as the Crv parameter.")
            if len(height) not in (1, N):
                ghenv.Component.AddRuntimeMessage(Grasshopper.Kernel.GH_RuntimeMessageLevel.Error, " In 'H' I need either one or the same number of inputs as the Crv parameter.")
            if len(category) not in (0, 1, N):
                ghenv.Component.AddRuntimeMessage(
                    Grasshopper.Kernel.GH_RuntimeMessageLevel.Error, " In 'Category' I need either none, one or the same number of inputs as the Crv parameter."
                )

            # duplicate data if None or single value
            if len(z_vector) != N:
                z_vector = [z_vector[0] for _ in range(N)]
            if len(width) != N:
                width = [width[0] for _ in range(N)]
            if len(height) != N:
                height = [height[0] for _ in range(N)]
            if len(category) != N:
                category = [category[0] for _ in range(N)]

            for line, z, w, h, c in zip(centerline, z_vector, width, height, category):
                guid, geometry = self._get_guid_and_geometry(line)
                rhino_line = rs.coerceline(geometry)
                line = line_to_compas(rhino_line)

                z = vector_to_compas(z) if z else None
                beam = CTBeam.from_centerline(centerline=line, width=w, height=h, z_vector=z)
                beam.attributes["rhino_guid"] = str(guid) if guid else None
                beam.attributes["category"] = c


                beams.append(beam)
                scene.add(beam.blank)

        blanks = scene.draw()

        return beams, blanks

    def _get_guid_and_geometry(self, line):
        # internalized curves and GH geometry will not have persistent GUIDs, referenced Rhino objects will
        # type hint on the input has to be 'ghdoc' for this to work
        guid = None
        geometry = line
        rhino_obj = Rhino.RhinoDoc.ActiveDoc.Objects.FindId(line)
        if rhino_obj:
            guid = line
            geometry = rhino_obj.Geometry
        return guid, geometry

    def _get_centerline_length(self, centerline):
        centerline_length = []
        for i in centerline:
            centerline_length.append(rs.CurveLength(i))
        if centerline_length:
            length_average = sum(centerline_length) / len(centerline_length)
        else:
            length_average = 1
        return length_average
# ---------- end ct_beam_2 ----------
relay_2 = Relay([ct_beam_2.Blank, center_box, extrude])
custom_preview_2 = CustomPreview(Geometry=relay_2, Material=ColourSwatch(SwatchColor=RGB(219, 206, 167)))
