# Grasshopper definition line_model_v3.ghx (Grasshopper 1.0.8)
# plug-ins: Human

py3 = Python3Script(x=Button())  # -> out, a
# ---------- py3: Python ----------
from compas_rhino import unload_modules

if x:
    unload_modules(("compas_timber", "timber_design", "compas_model"))
# ---------- end py3 ----------

range = Range(Domain=Domain(0, 1), Steps=Slider(4, range=0..10))
graph_mapper = GraphMapper(
    range,
    x0=0,
    x1=1,
    y0=0,
    y1=1,
    container_name="Bezier",
    cpx=[0, 0.6170566082, 0.8717642426, 1],
    cpy=[0, 0.0728777647, 0.464922905, 1])

# ----
# create and manipulate graph
curve = Curve(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)
brep = Brep(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)
point = Point([Point(163.5542514, 48.10027414, 15.94000248), Point(163.5542514, 57.72031214, 15.94000382), Point(173.1742514, 57.7202747, 19.94), Point(173.1742514, 48.1002747, 19.94)])
python_3_script = Python3Script(boundary=curve, roof_brep=brep, supports=point, z_steps=graph_mapper)  # -> out, ridges_tree, all_edges, graph, all_nodes, node_keys; inputs boundary: Curve, roof_brep: Brep, supports: list of Point3d, z_steps: list of Double
# ---------- python_3_script: Python ----------
import os
import sys
from compas_rhino import unload_modules
import compas
compas.PRECISION = ".3f"

gh_dir = os.path.dirname(ghenv.Component.OnPingDocument().FilePath)
sys.path.append(gh_dir)

import tree_builder
import nodegraph
import importlib

importlib.reload(nodegraph)
importlib.reload(tree_builder)


from tree_builder import build_tree_graph


# CONSTANTS #
div_x = 8
div_y = 6
num_levels = 4

inset_edge = 0.8
inset_interior = 0.7

# Build the graph (all logic is in tree_builder.py)
ng = build_tree_graph(
    boundary=boundary,
    supports=supports,
    roof_brep=roof_brep,
    div_x=div_x if div_x else 8,
    div_y=div_y if div_y else 6,
    num_levels=num_levels if num_levels else 4,
    z_steps=z_steps,
    inset_edge=inset_edge if inset_edge else 0.5,
    inset_interior=inset_interior if inset_interior else 0.4,
    reach_tol=0.05,
    debug=True
)

# Outputs
all_edges = ng.edge_lines()
graph = ng
all_nodes = ng.node_points()
node_keys = list(ng.nodes())
# ---------- end python_3_script ----------
compas_draw = COMPASDraw(cg=python_3_script.all_edges)  # -> rg
#   port cg: The COMPAS geometry or datastructure to be drawn.
#   port rg: The Rhino geometry object.
# ---------- compas_draw: Python ----------
# r: compas>=2.14.1
"""
Draws COMPAS geometry in Grasshopper.
"""

from typing import Any

import Grasshopper

from compas.scene import SceneObject


class CompasToRhinoGeometry(Grasshopper.Kernel.GH_ScriptInstance):
    def RunScript(self, cg):
        if not cg:
            return None

        return SceneObject(item=cg).draw()
# ---------- end compas_draw ----------
compas_draw_2 = COMPASDraw(cg=python_3_script.all_nodes)  # -> rg; same code as compas_draw
python_3_script_2 = Python3Script(graph=python_3_script.graph)  # -> out, edges, nodes, idx, node_graph, a, b, c
# ---------- python_3_script_2: Python ----------
from copy import deepcopy
import os
import sys

gh_dir = os.path.dirname(ghenv.Component.OnPingDocument().FilePath)
if gh_dir not in sys.path:
    sys.path.insert(0, gh_dir)

ng = deepcopy(graph)

# Delete nodes
for node_id in [288, 289]:
    if ng.has_node(node_id):
        ng.delete_node(node_id)

# Add new elements
target_pairs = [
    [286, 274, 275, True], [287, 276, 277, True], [290, 278, 279, True], [291, 280, 281, True],
    [286, 270, 271, False], [287, 272, 273, False], [290, 282, 283, False], [291, 284, 285, False],
    [246, 44, 81, False], [246, 48, 87, False], [248, 54, 91, False], [248, 58, 97, False],
    [258, 124, 161, False], [258, 128, 167, False], [260, 134, 171, False], [260, 138, 177, False],
    [249, 64, 101, False], [249, 68, 107, False], [251, 74, 111, False], [251, 78, 117, False],
    [261, 144, 181, False], [261, 148, 187, False], [263, 154, 191, False], [263, 158, 197, False],
    [286, 246], [287, 249], [290, 258], [291, 261],
    [286, 248], [287, 251], [290, 260], [291, 263],
    [296, 241], [297, 244], [298, 265], [299, 268],
    [296, 247], [297, 250], [298, 259], [299, 262],
    [296, 270], [297, 272], [298, 282], [299, 284],
    [296, 271], [297, 273], [298, 283], [299, 285],
]

ng.add_segments(target_pairs)


edges = ng.edge_lines_by_group(0) + ng.edge_lines_by_group(1)
nodes = ng.node_points()
idx = list(ng.nodes())
node_graph = ng

a = ng.points_by_mobility("fixed")     # supports + inset corners
b = ng.points_by_mobility("z_free")    # apex nodes
c = ng.points_by_mobility("yz_free")  # added via add_segment
# ---------- end python_3_script_2 ----------

swatch = ColourSwatch(SwatchColor=RGB(51, 56, 66))
text_tag = TextTag(Location=compas_draw_2, Text=python_3_script.node_keys, Colour=swatch)
dot_display = DotDisplay(Point=compas_draw_2, Colour=swatch, Size=Slider(0.1, range=0..0.1))

custom_preview_lineweights = CustomPreviewLineweights(
    Geometry=compas_draw,
    Shader=ColourSwatch(SwatchColor=RGB(144, 209, 232)),
    Thickness=Slider(4, range=0..10),
    Absolute=False)

# ----
# Transform points
number_slider = Slider(5, range=0..10)
brep_2 = Brep(<brep referenced from the Rhino model>)
brep_3 = Brep(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)
python_3_script_3 = Python3Script(graph=python_3_script_2.node_graph, interior_brep=brep_3, move=Toggle(True), sub_iterations=number_slider)  # -> out, edges, nodes, idx, node_graph, a, b, c, port, moved_points; inputs interior_brep: Brep, sub_iterations: Int32
# ---------- python_3_script_3: Python ----------
import os, sys, importlib
gh_dir = os.path.dirname(ghenv.Component.OnPingDocument().FilePath)
if gh_dir not in sys.path:
    sys.path.insert(0, gh_dir)

### -----------------------------
## IMPORT
### -----------------------------
import edge_classifier
import transformer
import nodegraph

importlib.reload(edge_classifier)
importlib.reload(transformer)
importlib.reload(nodegraph)

from edge_classifier import classify_single_segment
from transformer import edge_in_brep
from copy import deepcopy
from compas.geometry import Vector, Line, Point, centroid_points

### -----------------------------
## INITIALIZATION
### -----------------------------
ng = deepcopy(graph)

### -----------------------------
## EXECUTION
### -----------------------------
if move:
    intersecting_edges, is_clear, moved_points, pt = edge_in_brep(ng, interior_brep, sub_iterations=sub_iterations, debug=True)

target_pairs = [[298, 290], [296, 286], [297, 287], [299, 291]]
movement_data = [[graph.node_attribute(pair[0], "point"), ng.edge_line(pair).vector, pair[0]] for pair in target_pairs]
# move = [ng.node_attribute(data[2], "point", data[0] + data[1]/3) for data in movement_data]

move = []
for data in movement_data:
    key = data[2]
    moved_pt = data[0] + data[1]/3
    move.append(ng.node_attribute(key, "point", moved_pt))
    ng.node_attributes(key, names=["x", "y", "z"], values=[moved_pt.x, moved_pt.y, moved_pt.z])



### -----------------------------
## OUTPUTS
### -----------------------------
edges = ng.edge_lines_by_group(0) + ng.edge_lines_by_group(1)
nodes = ng.node_points()
idx = list(ng.nodes())
node_graph = ng

a = ng.points_by_mobility("fixed")     # supports + inset corners
b = ng.points_by_mobility("z_free")    # apex nodes
c = ng.points_by_mobility("yz_free")  # added via add_segment

### -----------------------------
## PRINT
### -----------------------------
# print(is_clear)
# ---------- end python_3_script_3 ----------

python_3_script_4 = Python3Script(graph=python_3_script_3.node_graph)  # -> out, primary, secondary, tertiary, special, result, new_ng
# ---------- python_3_script_4: Python ----------
import os, sys, importlib
gh_dir = os.path.dirname(ghenv.Component.OnPingDocument().FilePath)
if gh_dir not in sys.path:
    sys.path.insert(0, gh_dir)

import edge_classifier_v2
importlib.reload(edge_classifier_v2)
from edge_classifier_v2 import categorize_edge_types, classify_edges_by_Michael

from Grasshopper import DataTree
from Grasshopper.Kernel.Data import GH_Path


subs = classify_edges_by_Michael(graph, seg_x=8, seg_y=2)

primary = DataTree[object]()
secondary = DataTree[object]()
tertiary = DataTree[object]()
special = DataTree[object]()

for i, sub in enumerate(subs):
    path = GH_Path(i)

    sg = sub["graph"]
    for node in sg.nodes():
        attrs_n = sg.node_attributes(node)
        # print (attrs_n)
    
    for edge in sg.edges():
        attrs_e = sg.edge_attributes(edge)
        print (attrs_e)
        
        hie = "hierarchy"
        if hie not in attrs_e:
            continue
        
        if attrs_e[hie] == "primary" and attrs_e["e_category"] == "orthogonal":
            primary.Add(sg.edge_line(edge), path)
        elif attrs_e[hie] == "secondary":
            secondary.Add(sg.edge_line(edge), path)
        elif attrs_e[hie] == "tertiary":
            tertiary.Add(sg.edge_line(edge), path)
        elif attrs_e[hie] == "special":
            special.Add(sg.edge_line(edge), path)

subgraph = (subs[1]["graph"])

# result = []
# tertiary = []
# secondary = []
# for edge in graph.edges():
#     attrs = graph.edge_attributes(edge)
#     # print (attrs)
#     if "e_category" not in attrs:
#         continue
#     if attrs["e_category"] == "orthogonal":
#         result.append(graph.edge_line(edge))
#     elif attrs["e_category"] == "default_diagonal":
#         tertiary.append(graph.edge_line(edge))
#     elif attrs["e_category"] == "moved_diagonal":
#         secondary.append(graph.edge_line(edge)) 


from compas.datastructures import Graph
sgs = [sub["graph"] for sub in subs[0:2]]
new_ng = Graph()

for sg in sgs:
#     print (len(list(sg.nodes())))
    for node in sg.nodes():
        new_ng.add_node(node, **sg.node_attributes(node))
    for u, v in sg.edges():
        new_ng.add_edge(u, v, **sg.edge_attributes((u, v)))

print (new_ng)
# ---------- end python_3_script_4 ----------

python_3_script_5 = Python3Script(graph=python_3_script_3.node_graph, select=Slider(0, range=0..15))  # -> out, a, sub, edges, nodes; inputs select: Int32
# ---------- python_3_script_5: Python ----------
import os, sys, importlib
gh_dir = os.path.dirname(ghenv.Component.OnPingDocument().FilePath)
if gh_dir not in sys.path:
    sys.path.insert(0, gh_dir)

import edge_classifier
importlib.reload(edge_classifier)
from edge_classifier import classify_single_segment



attrs_node = graph.nodes_attributes()
for attrs in attrs_node:
    if 'group' in attrs:
        if attrs['group'] == 0:
            pass


print (attrs_node[0])
print (attrs_node[1])



attrs_edge = graph.edges_attributes()


# print (list(graph.nodes()))
# print (list(graph.edges()))
a = graph.node_points()

edges = list(graph.edges())

for edge in edges:
    if 296 in edge:
        print (edge)

graph.neighbors(3)
sub = graph.extract_subgraph([0, 1, 2, 3, 4, 240])


edges = []
for edge, attrs in zip(graph.edges(), graph.edges_attributes()):
    print (attrs)
    if 'nearest_support' not in attrs: continue
    if attrs['nearest_support'] == int(select):
        edges.append(graph.edge_line(edge))

nodes = []
for node, attrs in zip(graph.nodes(), graph.nodes_attributes()):
    if 'support_id' not in attrs: continue
    if attrs['support_id'] == int(select):
        nodes.append(graph.node_point(node))
# ---------- end python_3_script_5 ----------
python_3_script_6 = Python3Script(graph=python_3_script_3.node_graph)  # -> out, g0, g1, g2, sups, pc, ai
# ---------- python_3_script_6: Python ----------
import os, sys, importlib
gh_dir = os.path.dirname(ghenv.Component.OnPingDocument().FilePath)
if gh_dir not in sys.path:
    sys.path.insert(0, gh_dir)

import edge_classifier
importlib.reload(edge_classifier)
from edge_classifier import classify_single_segment



attrs_lst = graph.nodes_attributes()

all_keys = set(key for attrs in attrs_lst for key in attrs.keys())
print (all_keys)

attributes_lst = {}
for attrs in attrs_lst:
    for key, value in attrs.items():
        if key in ('x', 'y', 'z', 'point'): continue
        attributes_lst.setdefault(key, set()).add(str(value))

# print (attributes_lst)


for ch in attributes_lst['children']:
    # print (ch)
    result = [int(i) for i in ch.strip("[]").split(",") if i.strip()]
    # print (len(result))

######
test = graph.node_attributes(286)
print (test)
######




g0, g1, g2 = [], [], []
a2 = []
sups = []
for attrs in attrs_lst:
    # print (attrs)
    if 'group' in attrs:
        if attrs['group'] == 0:
            g0.append(attrs['point'])
        elif attrs['group'] == 1:
            g1.append(attrs['point'])
        else:
            # print (attrs)
            g2.append(attrs['point'])
        # print (attrs['group'])
    if 'reached' in attrs:
        # print (attrs['reached'])
        a2.append(attrs['reached'])
        if attrs['reached'] == True:
            sups.append(attrs['point'])


print ()
attrs_edge = graph.edges_attributes()
print (len(attrs_edge))

all_keys = set(key for attrs in attrs_edge for key in attrs.keys())
print (all_keys)

attributes_edge = {}
for attrs in attrs_edge:
    for key, value in attrs.items():
        if key in ('x', 'y', 'z', 'point'): continue
        attributes_edge.setdefault(key, set()).add(str(value))

print (attributes_edge)


pc, ai = [], []
for attrs in attrs_edge:
    if 'etype' in attrs:
        if attrs['etype'] == 'parent_child':
            pass


print (len(graph.connected_nodes()))
print (len(graph.connected_edges()))



from edge_classifier import create_subgraphs
sub_graph = create_subgraphs(graph, 8, 2)

print (sub_graph)

sub = graph.extract_subgraph([0])

print (sub.node_attributes(0))
# ---------- end python_3_script_6 ----------
draw = COMPASDraw(cg=python_3_script_5.edges)  # -> rg; same code as compas_draw
draw_2 = COMPASDraw(cg=python_3_script_5.nodes)  # -> rg; same code as compas_draw
draw_3 = COMPASDraw(cg=python_3_script_6.g0)  # -> rg; same code as compas_draw
draw_4 = COMPASDraw(cg=python_3_script_6.g1)  # -> rg; same code as compas_draw
draw_5 = COMPASDraw(cg=python_3_script_6.g2)  # -> rg; same code as compas_draw
draw_6 = COMPASDraw(cg=python_3_script_6.sups)  # -> rg; same code as compas_draw

compas_draw_3 = COMPASDraw(cg=python_3_script_2.edges)  # -> rg; same code as compas_draw
draw_7 = COMPASDraw(cg=python_3_script_4.primary)  # -> rg; same code as compas_draw
draw_8 = COMPASDraw(cg=python_3_script_4.result)  # -> rg; same code as compas_draw

compas_draw_4 = COMPASDraw(cg=python_3_script_3.moved_points)  # -> rg; same code as compas_draw
dot_display_2 = DotDisplay(Point=compas_draw_4, Colour=ColourSwatch(SwatchColor=RGB(255, 255, 255)), Size=Slider(0.2, range=-0.5..0.5))

draw_9 = COMPASDraw(cg=python_3_script_4.secondary)  # -> rg; same code as compas_draw
draw_10 = COMPASDraw(cg=python_3_script_4.tertiary)  # -> rg; same code as compas_draw
draw_11 = COMPASDraw(cg=python_3_script_4.special)  # -> rg; same code as compas_draw

python_3_script_7 = Python3Script(graph=python_3_script_3.node_graph)  # -> out, a, edges, scores
# ---------- python_3_script_7: Python ----------
import os, sys, importlib
gh_dir = os.path.dirname(ghenv.Component.OnPingDocument().FilePath)
if gh_dir not in sys.path:
    sys.path.insert(0, gh_dir)

import edge_classifier
importlib.reload(edge_classifier)
from edge_classifier import classify_single_segment


a = []
edges = []
scores = []

for edge in graph.edges():
    attrs = graph.edge_attributes(edge)
    a.append(attrs['main_secondary'])
    edges.append(graph.edge_line(edge))

    scores.append(attrs['parallel_score'])
# ---------- end python_3_script_7 ----------
panel = Panel(python_3_script_7.edges)
draw_12 = COMPASDraw(cg=python_3_script_7.edges)  # -> rg; same code as compas_draw
midpt = CurveMiddle(Curve=draw_12)
tag = TextTag(Location=midpt, Text=python_3_script_7.a)

custom_preview_lineweights_2 = CustomPreviewLineweights(Geometry=draw_10, Shader=ColourSwatch(SwatchColor=RGB(189, 172, 66)), Thickness="3", Absolute=False)
custom_preview_lineweights_3 = CustomPreviewLineweights(Geometry=draw_7, Shader=ColourSwatch(SwatchColor=RGB(137, 50, 143)), Thickness="8", Absolute=False)
custom_preview_lineweights_4 = CustomPreviewLineweights(Geometry=draw_9, Shader=ColourSwatch(SwatchColor=RGB(50, 143, 103)), Thickness="6", Absolute=False)
custom_preview_lineweights_5 = CustomPreviewLineweights(Geometry=draw_11, Shader=ColourSwatch(SwatchColor=RGB(78, 207, 222)), Thickness="3", Absolute=False)

# ----
# Preview segments
number_slider_2 = Slider(1, range=0..15)
python_3_script_8 = Python3Script(graph=python_3_script_3.node_graph, segment_id=number_slider_2)  # -> out, primary, secondary, subgraph; inputs segment_id: Int32; disabled
# ---------- python_3_script_8: Python ----------
import os, sys, importlib
gh_dir = os.path.dirname(ghenv.Component.OnPingDocument().FilePath)
if gh_dir not in sys.path:
    sys.path.insert(0, gh_dir)

import edge_classifier
importlib.reload(edge_classifier)
from edge_classifier import classify_single_segment

result = classify_single_segment(graph, segment_index = segment_id,parallel_tol=0.999, near_threshold=1.0)

primary = result["primary_lines"]
secondary = result["secondary_lines"]
subgraph = result["subgraph"]
# ---------- end python_3_script_8 ----------
compas_draw_5 = COMPASDraw(cg=python_3_script_8.secondary)  # -> rg; same code as compas_draw
compas_draw_6 = COMPASDraw(cg=python_3_script_8.primary)  # -> rg; same code as compas_draw
custom_preview_lineweights_6 = CustomPreviewLineweights(Geometry=compas_draw_5, Shader=ColourSwatch(SwatchColor=RGB(50, 143, 103)), Thickness="5", Absolute=False)
custom_preview_lineweights_7 = CustomPreviewLineweights(Geometry=compas_draw_6, Shader=ColourSwatch(SwatchColor=RGB(137, 50, 143)), Thickness="20", Absolute=False)

# ----
# Preview nodes
# fixed
# z-free
# yz-free
compas_draw_7 = COMPASDraw(cg=python_3_script_3.edges)  # -> rg; same code as compas_draw
compas_draw_8 = COMPASDraw(cg=python_3_script_3.nodes)  # -> rg; same code as compas_draw
text_tag_2 = TextTag(Location=compas_draw_8, Text=python_3_script_3.idx, Colour=ColourSwatch(SwatchColor=RGB(23, 64, 15)))
compas_draw_9 = COMPASDraw(cg=python_3_script_3.c)  # -> rg; same code as compas_draw
compas_draw_10 = COMPASDraw(cg=python_3_script_3.b)  # -> rg; same code as compas_draw
compas_draw_11 = COMPASDraw(cg=python_3_script_3.a)  # -> rg; same code as compas_draw
dot_display_3 = DotDisplay(Point=compas_draw_9, Colour=ColourSwatch(SwatchColor=RGB(173, 201, 107)), Size=Slider(0.1, range=0..0.1))
dot_display_4 = DotDisplay(Point=compas_draw_10, Colour=ColourSwatch(SwatchColor=RGB(107, 201, 160)), Size=Slider(0.1, range=0..0.1))
dot_display_5 = DotDisplay(Point=compas_draw_11, Colour=ColourSwatch(SwatchColor=RGB(201, 107, 107)), Size=Slider(0.1, range=0..0.1))

python_3_script_9 = Python3Script(subgraph=python_3_script_8.subgraph)  # -> out, edges, categories
# ---------- python_3_script_9: Python ----------
import os, sys, importlib
gh_dir = os.path.dirname(ghenv.Component.OnPingDocument().FilePath)
if gh_dir not in sys.path:
    sys.path.insert(0, gh_dir)

import edge_classifier
importlib.reload(edge_classifier)
from edge_classifier import classify_single_segment

from compas.geometry import Line




sg = subgraph

edges = []
categories = []


for edge in sg.edges():
    attrs = sg.edge_attributes(edge)
    print (edge)
    # u, v = edge
    # pu = sg.node_attribute(u, "point")
    # pv = sg.node_attribute(v, "point")
    # edges.append(Line(pu, pv))

    edges.append(sg.edge_line(edge))
    categories.append(attrs["main_secondary"])
# ---------- end python_3_script_9 ----------
draw_13 = COMPASDraw(cg=python_3_script_9.edges)  # -> rg; same code as compas_draw
number_slider_3 = Slider(1, range=0..10)
number_slider_4 = Slider(0, range=0..10)
python_3_script_10 = Python3Script(graph=python_3_script_4.new_ng, segment_id=Slider(1, range=0..15))  # -> out, primary, secondary, double, subgraph; inputs segment_id: Int32
# ---------- python_3_script_10: Python ----------
import os, sys, importlib
gh_dir = os.path.dirname(ghenv.Component.OnPingDocument().FilePath)
if gh_dir not in sys.path:
    sys.path.insert(0, gh_dir)

import edge_classifier
import config
import reciprocal

importlib.reload(config)
importlib.reload(edge_classifier)
importlib.reload(reciprocal)

from edge_classifier import create_subgraphs,classify_subgraph_edges,classify_edges_by_support_direction
from reciprocal import reciprocal_from_subgraph, reciprocal_width_from_subgraph

from compas.geometry import Line

# classify_edges_by_support_direction(graph, parallel_tol=0.9)
# subgraphs = create_subgraphs(graph, seg_x=8, seg_y=2) # could change double divisions here
# sup_pts = graph.get_support_points()

# # Then fetch any segment on demand
# def get_segment(idx):
#     sg_data = subgraphs[idx % len(subgraphs)]
#     return classify_subgraph_edges(sg_data, sup_pts, near_threshold=1.0, parallel_tol=0.9)

# # Use it
# primary, secondary, double, near_sup, subgraph = get_segment(segment_id)
# print(graph[1])
result = reciprocal_width_from_subgraph(graph, engage_len=.11, debug = True)
print(result)
primary = result["shifted_lines"]
secondary = result["secondary_lines"]
# ---------- end python_3_script_10 ----------
midpt_2 = CurveMiddle(Curve=draw_13)
tag_2 = TextTag(Location=midpt_2, Text=python_3_script_9.categories)
compas_draw_12 = COMPASDraw(cg=python_3_script_10.double)  # -> rg; same code as compas_draw
compas_draw_13 = COMPASDraw(cg=python_3_script_10.secondary)  # -> rg; same code as compas_draw
compas_draw_14 = COMPASDraw(cg=python_3_script_10.primary)  # -> rg; same code as compas_draw
py3_2 = Python3Script(x=python_3_script_10.primary)  # -> out, geom; inputs x: list
# ---------- py3_2: Python ----------
import compas
from compas.scene import Scene
from compas_timber.model import TimberModel
from compas_timber.elements import Beam
from compas_timber.connections import TStepJoint
# from compas_timber.connections import TopologyRules
from compas_timber.connections.solver import ConnectionSolver
from compas_timber.connections import ConnectionSolver


model = TimberModel()

for l in x:
    b = Beam.from_centerline(l, 0.14, 0.24)
    model.add_element(b)

rules = []
# rules.append(TopologyRules(JointTopology.TOPO_T, TStepJoint))

solver = ConnectionSolver()
pairs = solver.find_intersecting_pairs(model.beams)
for pair in pairs:
    topo = solver.find_topology(*pair)
    if topo.topology == 3:
        TStepJoint.create(model, topo.beam_a, topo.beam_b)

model.process_joinery()

scene = Scene()
for b in model.beams:
    scene.add(b.geometry)
geom = scene.draw()
# ---------- end py3_2 ----------

python_3_script_11 = Python3Script(graph=python_3_script_3.node_graph, offset=Slider(0.35, range=0..1))  # -> out, primary_tree, secondary_tree, subgraph_tree; inputs offset: Double; disabled
# ---------- python_3_script_11: Python ----------
import os, sys, importlib
gh_dir = os.path.dirname(ghenv.Component.OnPingDocument().FilePath)
if gh_dir not in sys.path:
    sys.path.insert(0, gh_dir)

import edge_classifier
importlib.reload(edge_classifier)
from edge_classifier import classify_single_segment


from Grasshopper import DataTree
from Grasshopper.Kernel.Data import GH_Path

from compas.geometry import Point, Vector

# Get center of structure
def average_points(points):
    x_coords = [p.x for p in points]
    y_coords = [p.y for p in points]
    z_coords = [p.z for p in points]
    length = len(points)
    cx, cy, cz = sum(x_coords) / length, sum(y_coords) / length, sum(z_coords) / length 
    return Point(cx, cy, cz)

supports = graph.get_support_points()
center = average_points(supports)


primary_tree = DataTree[object]()
secondary_tree = DataTree[object]()
subgraph_tree = DataTree[object]()

for i in range(16):
    path = GH_Path(i)
    result = classify_single_segment(graph, segment_index=i, parallel_tol=0.999, near_threshold=1.0)

    primary = result["primary_lines"]
    secondary = result["secondary_lines"]
    subgraph = result["subgraph"]
    

    mids = [ln.midpoint for ln in primary + secondary]
    cen = average_points(mids)
    vec = cen - center

    vec = Vector(vec.x, vec.y, 0.0)
    vec *= offset

    for p in primary:
        primary_tree.Add(p.translated(vec), path)
    
    for s in secondary:
        secondary_tree.Add(s.translated(vec), path)

    subgraph_tree.Add(subgraph)


for edge in graph.edges():
    attrs = graph.edge_attributes(edge)

    if len(attrs) == 4:
        print (attrs)
# ---------- end python_3_script_11 ----------
compas_draw_15 = COMPASDraw(cg=python_3_script_11.primary_tree)  # -> rg; same code as compas_draw
compas_draw_16 = COMPASDraw(cg=python_3_script_11.secondary_tree)  # -> rg; same code as compas_draw

panel_2 = Panel(python_3_script_11.subgraph_tree)
branch = TreeBranch(Tree=compas_draw_15, Path=[number_slider_4, number_slider_3], MaintainPaths=True)
branch_2 = TreeBranch(Tree=compas_draw_16, Path=[number_slider_4, number_slider_3], MaintainPaths=True)

custom_preview_lineweights_8 = CustomPreviewLineweights(Geometry=branch, Shader=ColourSwatch(SwatchColor=RGB(137, 50, 143)), Thickness="10", Absolute=False)
custom_preview_lineweights_9 = CustomPreviewLineweights(Geometry=branch_2, Shader=ColourSwatch(SwatchColor=RGB(50, 143, 103)), Thickness="5", Absolute=False)
