# Grasshopper definition line_model_v5.gh (Grasshopper 1.0.8)
# plug-ins: Human

py3 = Python3Script(l=Slider(5, range=0..10), coeff_h=Slider(0.43, range=0..1))  # -> out, D_heigts; inputs l: Int32, coeff_h: Double
# ---------- py3: Python ----------
import Rhino.Geometry as rg
import math
from ghpythonlib.treehelpers import list_to_tree, tree_to_list


def expo_num(coeff):
    max_heigth = 1
    h_coeficient = []
    for n in range(l):
        y = coeff ** (n*(-1)) # number 2 can be change so the exponential changes
        h_coeficient.append(abs(y - 1))
    heigts = []
    print(h_coeficient)
    for n in h_coeficient:
        param = n/h_coeficient[-1]
        r = max_heigth * param
        h = r - max_heigth
        # heigts.append(round(r, 1))
        heigts.append(r)
    D = heigts
    return D

D_heigts = expo_num(coeff_h)
# ---------- end py3 ----------
panel = Panel(py3.D_heigts)

curve = Curve(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)
brep = Brep(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)
point = Point([Point(163.54, 57.72, 15.455), Point(163.54, 48.1, 15.455), Point(173.16, 48.1, 19.455), Point(173.16, 57.72, 19.455)])

# ----
# * 120mm of CLT thickness &
# 80mm of half of the shoe thickness
panel_2 = Panel("{0, 0, -0.2}")
move = Move(Geometry=brep, Motion=panel_2)  # -> Geometry, Transform

# ----
# create and manipulate graph
python_3_script = Python3Script(boundary=curve, roof_brep=move.Geometry, supports=point, z_steps=py3.D_heigts)  # -> out, ridges_tree, all_edges, graph, all_nodes, node_keys; inputs boundary: Curve, roof_brep: Brep, supports: list of Point3d, z_steps: list of Double
# ---------- python_3_script: Python ----------
import os
import sys
from compas_rhino import unload_modules
import compas
compas.PRECISION = ".3f"

gh_dir = os.path.dirname(ghenv.Component.OnPingDocument().FilePath)
sys.path.append(gh_dir)

import tree_builder
import nodegraph
import importlib

importlib.reload(nodegraph)
importlib.reload(tree_builder)


from tree_builder import build_tree_graph


# CONSTANTS #
div_x = 8
div_y = 6
num_levels = 4

inset_edge = 0.5
inset_interior = 0.5

# Build the graph (all logic is in tree_builder.py)
ng = build_tree_graph(
    boundary=boundary,
    supports=supports,
    roof_brep=roof_brep,
    div_x=div_x if div_x else 8,
    div_y=div_y if div_y else 6,
    num_levels=num_levels if num_levels else 4,
    z_steps=z_steps,
    inset_edge=inset_edge if inset_edge else 0.5,
    inset_interior=inset_interior if inset_interior else 0.4,
    reach_tol=0.05,
    debug=True
)

# Outputs
all_edges = ng.edge_lines()
graph = ng
all_nodes = ng.node_points()
node_keys = list(ng.nodes())
# ---------- end python_3_script ----------
compas_draw = COMPASDraw(cg=python_3_script.all_edges)  # -> rg
#   port cg: The COMPAS geometry or datastructure to be drawn.
#   port rg: The Rhino geometry object.
# ---------- compas_draw: Python ----------
# r: compas>=2.14.1
"""
Draws COMPAS geometry in Grasshopper.
"""

from typing import Any

import Grasshopper

from compas.scene import SceneObject


class CompasToRhinoGeometry(Grasshopper.Kernel.GH_ScriptInstance):
    def RunScript(self, cg):
        if not cg:
            return None

        return SceneObject(item=cg).draw()
# ---------- end compas_draw ----------
compas_draw_2 = COMPASDraw(cg=python_3_script.all_nodes)  # -> rg; same code as compas_draw
python_3_script_2 = Python3Script(graph=python_3_script.graph)  # -> out, edges, nodes, idx, node_graph, a, b, c
# ---------- python_3_script_2: Python ----------
from copy import deepcopy
import os
import sys

gh_dir = os.path.dirname(ghenv.Component.OnPingDocument().FilePath)
if gh_dir not in sys.path:
    sys.path.insert(0, gh_dir)

ng = deepcopy(graph)

# Delete nodes
for node_id in [288, 289]:
    if ng.has_node(node_id):
        ng.delete_node(node_id)

# Add new elements
target_pairs = [
    [286, 274, 275, True], [287, 276, 277, True], [290, 278, 279, True], [291, 280, 281, True],
    [286, 270, 271, False], [287, 272, 273, False], [290, 282, 283, False], [291, 284, 285, False],
    [246, 44, 81, False], [246, 48, 87, False], [248, 54, 91, False], [248, 58, 97, False],
    [258, 124, 161, False], [258, 128, 167, False], [260, 134, 171, False], [260, 138, 177, False],
    [249, 64, 101, False], [249, 68, 107, False], [251, 74, 111, False], [251, 78, 117, False],
    [261, 144, 181, False], [261, 148, 187, False], [263, 154, 191, False], [263, 158, 197, False],
    [286, 246], [287, 249], [290, 258], [291, 261],
    [286, 248], [287, 251], [290, 260], [291, 263],
    [296, 241], [297, 244], [298, 265], [299, 268],
    [296, 247], [297, 250], [298, 259], [299, 262],
    [296, 270], [297, 272], [298, 282], [299, 284],
    [296, 271], [297, 273], [298, 283], [299, 285],
]

ng.add_segments(target_pairs)


edges = ng.edge_lines_by_group(0) + ng.edge_lines_by_group(1)
nodes = ng.node_points()
idx = list(ng.nodes())
node_graph = ng

a = ng.points_by_mobility("fixed")     # supports + inset corners
b = ng.points_by_mobility("z_free")    # apex nodes
c = ng.points_by_mobility("yz_free")  # added via add_segment
# ---------- end python_3_script_2 ----------

custom_preview_lineweights = CustomPreviewLineweights(
    Geometry=compas_draw,
    Shader=ColourSwatch(SwatchColor=RGB(144, 209, 232)),
    Thickness=Slider(4, range=0..10),
    Absolute=False)

swatch = ColourSwatch(SwatchColor=RGB(51, 56, 66))
text_tag = TextTag(Location=compas_draw_2, Text=python_3_script.node_keys, Colour=swatch)
dot_display = DotDisplay(Point=compas_draw_2, Colour=swatch, Size=Slider(0.1, range=0..0.1))

# ----
# Transform points
number_slider = Slider(5, range=0..10)
brep_2 = Brep(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)
python_3_script_3 = Python3Script(graph=python_3_script_2.node_graph, interior_brep=brep_2, move=Toggle(True), sub_iterations=number_slider)  # -> out, edges, nodes, idx, node_graph, a, b, c, port, moved_points; inputs interior_brep: Brep, sub_iterations: Int32
# ---------- python_3_script_3: Python ----------
import os, sys, importlib
gh_dir = os.path.dirname(ghenv.Component.OnPingDocument().FilePath)
if gh_dir not in sys.path:
    sys.path.insert(0, gh_dir)

### -----------------------------
## IMPORT
### -----------------------------
import edge_classifier
import transformer
import nodegraph

importlib.reload(edge_classifier)
importlib.reload(transformer)
importlib.reload(nodegraph)

from edge_classifier import classify_single_segment
from transformer import edge_in_brep
from copy import deepcopy
from compas.geometry import Vector, Line, Point, centroid_points

### -----------------------------
## INITIALIZATION
### -----------------------------
ng = deepcopy(graph)

### -----------------------------
## EXECUTION
### -----------------------------
if move:
    intersecting_edges, is_clear, moved_points, pt = edge_in_brep(ng, interior_brep, sub_iterations=sub_iterations, debug=True)

target_pairs = [[298, 290], [296, 286], [297, 287], [299, 291]]
movement_data = [[graph.node_attribute(pair[0], "point"), ng.edge_line(pair).vector, pair[0]] for pair in target_pairs]
# move = [ng.node_attribute(data[2], "point", data[0] + data[1]/3) for data in movement_data]

move = []
for data in movement_data:
    key = data[2]
    moved_pt = data[0] + data[1]/3
    move.append(ng.node_attribute(key, "point", moved_pt))
    ng.node_attributes(key, names=["x", "y", "z"], values=[moved_pt.x, moved_pt.y, moved_pt.z])



### -----------------------------
## OUTPUTS
### -----------------------------
edges = ng.edge_lines_by_group(0) + ng.edge_lines_by_group(1)
nodes = ng.node_points()
idx = list(ng.nodes())
node_graph = ng

a = ng.points_by_mobility("fixed")     # supports + inset corners
b = ng.points_by_mobility("z_free")    # apex nodes
c = ng.points_by_mobility("yz_free")  # added via add_segment

### -----------------------------
## PRINT
### -----------------------------
# print(is_clear)
# ---------- end python_3_script_3 ----------

compas_draw_3 = COMPASDraw(cg=python_3_script_2.edges)  # -> rg; same code as compas_draw

compas_draw_4 = COMPASDraw(cg=python_3_script_3.moved_points)  # -> rg; same code as compas_draw
dot_display_2 = DotDisplay(Point=compas_draw_4, Colour=ColourSwatch(SwatchColor=RGB(255, 255, 255)), Size=Slider(0.2, range=-0.5..0.5))

compas_draw_5 = COMPASDraw(cg=python_3_script_3.nodes)  # -> rg; same code as compas_draw
panel_3 = Panel("""0
1""")

# ----
# Classfiy Edges
toggle = BooleanToggle(True)
panel_4 = Panel("""0
1
2
3""")
python_3_script_4 = Python3Script(graph=python_3_script_3.node_graph, sub=toggle, sub_ids=panel_3)  # -> out, primary, secondary, tertiary, special, graph_out; inputs sub: Boolean, sub_ids: list of Int32
# ---------- python_3_script_4: Python ----------
import os, sys, importlib
gh_dir = os.path.dirname(ghenv.Component.OnPingDocument().FilePath)
if gh_dir not in sys.path:
    sys.path.insert(0, gh_dir)

import edge_classifier_v3
importlib.reload(edge_classifier_v3)
from edge_classifier_v3 import combine_graphs, classify_edges_by_Michael

from Grasshopper import DataTree
from Grasshopper.Kernel.Data import GH_Path


subgraphs = classify_edges_by_Michael(graph, seg_x=8, seg_y=2)

primary = DataTree[object]()
secondary = DataTree[object]()
tertiary = DataTree[object]()
special = DataTree[object]()

for i, sg in enumerate(subgraphs):
    path = GH_Path(i)

    for node in sg.nodes():
        attrs_n = sg.node_attributes(node)
        # print (attrs_n)
    
    for edge in sg.edges():
        attrs_e = sg.edge_attributes(edge)
        # print (attrs_e)
        
        hie = "hierarchy"
        if hie not in attrs_e:
            continue
        
        if sub and i not in sub_ids:
            continue

        if attrs_e[hie] == "primary":
            primary.Add(sg.edge_line(edge), path)
        elif attrs_e[hie] == "secondary":
            secondary.Add(sg.edge_line(edge), path)
        elif attrs_e[hie] == "tertiary":
            tertiary.Add(sg.edge_line(edge), path)
        elif attrs_e[hie] == "special":
            special.Add(sg.edge_line(edge), path)
    

sgs = []
if not sub:
    sub_ids = list(range(len(subgraphs)))
    
for i in sub_ids:
    sgs.append(subgraphs[i])
graph_out = combine_graphs(sgs)
# ---------- end python_3_script_4 ----------
draw = COMPASDraw(cg=python_3_script_4.primary)  # -> rg; same code as compas_draw
draw_2 = COMPASDraw(cg=python_3_script_4.secondary)  # -> rg; same code as compas_draw
draw_3 = COMPASDraw(cg=python_3_script_4.tertiary)  # -> rg; same code as compas_draw
draw_4 = COMPASDraw(cg=python_3_script_4.special)  # -> rg; same code as compas_draw
custom_preview_lineweights_2 = CustomPreviewLineweights(Geometry=draw_3, Shader=ColourSwatch(SwatchColor=RGB(189, 172, 66)), Thickness="3", Absolute=False)
custom_preview_lineweights_3 = CustomPreviewLineweights(Geometry=draw, Shader=ColourSwatch(SwatchColor=RGB(137, 50, 143)), Thickness="8", Absolute=False)
custom_preview_lineweights_4 = CustomPreviewLineweights(Geometry=draw_4, Shader=ColourSwatch(SwatchColor=RGB(78, 207, 222)), Thickness="3", Absolute=False)
custom_preview_lineweights_5 = CustomPreviewLineweights(Geometry=draw_2, Shader=ColourSwatch(SwatchColor=RGB(50, 143, 103)), Thickness="6", Absolute=False)

tag = TextTag(Location=compas_draw_5, Text=python_3_script_3.idx)

# ----
# Snap leaf points and create shoes
brep_3 = Brep(move.Geometry)
python_3_script_5 = Python3Script(graph=python_3_script_4.graph_out, brep=brep_3)  # -> out, graph_out, leaf_lines, leaf_points, shoe_lines, other_lines; inputs brep: Brep
# ---------- python_3_script_5: Python ----------
import os, sys, importlib
gh_dir = os.path.dirname(ghenv.Component.OnPingDocument().FilePath)
if gh_dir not in sys.path:
    sys.path.insert(0, gh_dir)


import leaf_solver
importlib.reload(leaf_solver)
from leaf_solver import create_shoes_and_shift_leaves
from copy import deepcopy



ng = deepcopy(graph)

result = create_shoes_and_shift_leaves(ng, brep, min_length=0.30, min_angle=0)


########--------Output Data---------#########
leaf_lines = [ng.edge_line(edge) for edge in ng.edges() if ng.is_leaf_edge(edge)]
other_lines = [ng.edge_line(edge) for edge in ng.edges() if not ng.is_leaf_edge(edge)]

leaf_points = result["leaf_points"]
shoe_lines = result["shoe_lines"]

graph_out = ng

#############-----------Print----------##########
group = result["group_dict"]
print (group)
# ---------- end python_3_script_5 ----------
draw_5 = COMPASDraw(cg=python_3_script_5.other_lines)  # -> rg; same code as compas_draw
draw_6 = COMPASDraw(cg=python_3_script_5.shoe_lines)  # -> rg; same code as compas_draw
draw_7 = COMPASDraw(cg=python_3_script_5.leaf_points)  # -> rg; same code as compas_draw
draw_8 = COMPASDraw(cg=python_3_script_5.leaf_lines)  # -> rg; same code as compas_draw

# ----
# Run reciprocal
python_3_script_6 = Python3Script(graph=python_3_script_5.graph_out)  # -> out, primary, secondary, double, subgraph; disabled
# ---------- python_3_script_6: Python ----------
import os, sys, importlib
gh_dir = os.path.dirname(ghenv.Component.OnPingDocument().FilePath)
if gh_dir not in sys.path:
    sys.path.insert(0, gh_dir)

import edge_classifier
import config
import reciprocal

importlib.reload(config)
importlib.reload(edge_classifier)
importlib.reload(reciprocal)

from edge_classifier import create_subgraphs,classify_subgraph_edges,classify_edges_by_support_direction
from reciprocal import reciprocal_from_subgraph, reciprocal_width_from_subgraph

from compas.geometry import Line

# classify_edges_by_support_direction(graph, parallel_tol=0.9)
# subgraphs = create_subgraphs(graph, seg_x=8, seg_y=2) # could change double divisions here
# sup_pts = graph.get_support_points()

# # Then fetch any segment on demand
# def get_segment(idx):
#     sg_data = subgraphs[idx % len(subgraphs)]
#     return classify_subgraph_edges(sg_data, sup_pts, near_threshold=1.0, parallel_tol=0.9)

# # Use it
# primary, secondary, double, near_sup, subgraph = get_segment(segment_id)
# print(graph[1])
result = reciprocal_width_from_subgraph(graph, engage_len=.11, debug = True)
print(result)
primary = result["shifted_lines"]
secondary = result["secondary_lines"]
# ---------- end python_3_script_6 ----------
compas_draw_6 = COMPASDraw(cg=python_3_script_6.primary)  # -> rg; disabled; same code as compas_draw
compas_draw_7 = COMPASDraw(cg=python_3_script_6.secondary)  # -> rg; disabled; same code as compas_draw
compas_draw_8 = COMPASDraw(cg=python_3_script_6.double)  # -> rg; disabled; same code as compas_draw
py3_2 = Python3Script(x=python_3_script_6.primary)  # -> out, geom; inputs x: list; disabled
# ---------- py3_2: Python ----------
import compas
from compas.scene import Scene
from compas_timber.model import TimberModel
from compas_timber.elements import Beam
from compas_timber.connections import TStepJoint
# from compas_timber.connections import TopologyRules
from compas_timber.connections.solver import ConnectionSolver
from compas_timber.connections import ConnectionSolver
from compas.tolerance import TOL, Tolerance


model = TimberModel(Tolerance(unit='MM'))

for l in x:
    b = Beam.from_centerline(l, 0.14, 0.24)
    model.add_element(b)

rules = []
# rules.append(TopologyRules(JointTopology.TOPO_T, TStepJoint))

solver = ConnectionSolver()
pairs = solver.find_intersecting_pairs(model.beams)
for pair in pairs:
    topo = solver.find_topology(*pair)
    if topo.topology == 3:
        TStepJoint.create(model, topo.beam_a, topo.beam_b)

model.process_joinery()

scene = Scene()
for b in model.beams:
    scene.add(b.geometry)
geom = scene.draw()
# ---------- end py3_2 ----------

py3_3 = Python3Script(subgraph=python_3_script_5.graph_out)  # -> out, a, b, c, d, e, f, h, p3
# ---------- py3_3: Python ----------
import os
import sys
import importlib

# -----------------------------------------------------------------------------
# Setup
# -----------------------------------------------------------------------------
gh_dir = os.path.dirname(ghenv.Component.OnPingDocument().FilePath)
if gh_dir not in sys.path:
    sys.path.insert(0, gh_dir)

import reciprocal_staged
import line_constraints

importlib.reload(reciprocal_staged)
importlib.reload(line_constraints)

# -----------------------------------------------------------------------------
# Helpers
# -----------------------------------------------------------------------------
def find_diag_driver_nodes(graph, level=1, required_diag=2, required_ortho=3):
    nodes = []
    for n in graph.nodes():
        if graph.node_attribute(n, "level") != level:
            continue
        edges = list(graph.node_edges(n))
        n_diag = 0
        n_ortho = 0
        for e in edges:
            if graph.edge_attribute(e, "hierarchy") != "primary":
                continue
            cat = graph.edge_attribute(e, "e_category")
            if cat in ("default_diagonal", "moved_diagonal"):
                n_diag += 1
            elif cat == "orthogonal":
                n_ortho += 1
        if n_diag == required_diag and n_ortho == required_ortho:
            nodes.append(n)
    return nodes

# -----------------------------------------------------------------------------
# 1) Reciprocal stage: orthogonal first
# -----------------------------------------------------------------------------
stage = reciprocal_staged.reciprocal_staged_primary_from_subgraph(subgraph)
g = stage["graph"]

# -----------------------------------------------------------------------------
# 2) Constrain primary diagonals (level 1, specific driving nodes), move up
# -----------------------------------------------------------------------------
diag_nodes = find_diag_driver_nodes(g, level=1, required_diag=2, required_ortho=3)

diag_dep = line_constraints.regenerate_edges_move_one_node_vertical(
    g,
    target_hierarchy="primary",
    target_categories=("default_diagonal", "moved_diagonal"),
    target_level_pair=(0,1),
    target_nodes=[246],                 # key filter for your old rule
    move_node_level=1,
    host_hierarchy="primary",
    host_categories="orthogonal",
    host_level_pair=None,
    choose="up",
    prefer_on_segment=True,
    debug=True,
)

print(diag_dep["info"])
print("target edges:", len(diag_dep["target_edges"]))
print("generated:", len(diag_dep["generated_lines"]))
print("untouched:", len(diag_dep["untouched_lines"]))
print("host_debug:", len(diag_dep["host_debug"] or []))

for d in (diag_dep["host_debug"] or []):
    print(d)

line_constraints.commit_generated_lines(
    g,
    hierarchy_filter="primary",
    category_filter=("default_diagonal", "moved_diagonal"),
)
for e in g.edges():
    if g.edge_attribute(e, "hierarchy") != "primary":
        continue
    if g.edge_attribute(e, "e_category") not in ("default_diagonal", "moved_diagonal"):
        continue
    u, v = e
    lu = g.node_attribute(u, "level")
    lv = g.node_attribute(v, "level")
    if tuple(sorted((lu, lv))) == (1, 1):
        if u == 246 or v == 246:
            print("match:", e, "levels:", (lu, lv))

# -----------------------------------------------------------------------------
# 3) Reciprocal stage: diagonals only
# -----------------------------------------------------------------------------
diag_rec = reciprocal_staged.reciprocal_diagonal_primary_from_subgraph(g)
g = diag_rec["graph"]

# -----------------------------------------------------------------------------
# 4) Secondary: move level-0 endpoint up
# -----------------------------------------------------------------------------
sec_shift = line_constraints.regenerate_edges_move_one_node_vertical(
    g,
    target_hierarchy="secondary",
    move_node_level=0,
    host_hierarchy="primary",
    host_categories=("orthogonal", "default_diagonal", "moved_diagonal"),
    host_level_pair=None,
    choose="up",
    prefer_on_segment=True,
    debug=True,
)
line_constraints.commit_generated_lines(g, hierarchy_filter="secondary")

# -----------------------------------------------------------------------------
# 5) Tertiary pass A: move level-0 endpoint down
# -----------------------------------------------------------------------------
ter_shift_l0 = line_constraints.regenerate_edges_move_one_node_vertical(
    g,
    target_hierarchy="tertiary",
    move_node_level=0,
    host_hierarchy="primary",
    host_categories=("orthogonal", "default_diagonal", "moved_diagonal"),
    host_level_pair=None,
    choose="down",
    prefer_on_segment=True,
    debug=True,
)
line_constraints.commit_generated_lines(g, hierarchy_filter="tertiary")

# -----------------------------------------------------------------------------
# 6) Tertiary pass B: move level-1 endpoint up (keeps previous shift)
# -----------------------------------------------------------------------------
ter_shift_l1 = line_constraints.regenerate_edges_move_one_node_vertical(
    g,
    target_hierarchy="tertiary",
    move_node_level=1,
    host_hierarchy="primary",
    host_categories=("orthogonal", "default_diagonal", "moved_diagonal"),
    host_level_pair=None,
    choose="up",
    prefer_on_segment=True,
    debug=True,
)
line_constraints.commit_generated_lines(g, hierarchy_filter="tertiary")

# -----------------------------------------------------------------------------
# 7) Special (example): move level-2 endpoint up using host pair (2,3)
# -----------------------------------------------------------------------------
sp = line_constraints.regenerate_edges_move_one_node_vertical(
    g,
    target_hierarchy="special",
    move_node_level=2,
    host_hierarchy="primary",
    host_categories=("orthogonal", "default_diagonal", "moved_diagonal"),
    host_level_pair=(2, 3),
    choose="up",
    prefer_on_segment=True,
    debug=True,
)
line_constraints.commit_generated_lines(g, hierarchy_filter="special")

# -----------------------------------------------------------------------------
# GH outputs
# -----------------------------------------------------------------------------
a = stage["viz"]["stage_1_shifted_lines"]      # orthogonal reciprocal
b = diag_dep["generated_lines"]                # constrained diagonals
c = diag_nodes                                 # driver nodes used
d = diag_rec["shifted_diagonal_lines"]         # diagonal reciprocal

e = sec_shift["generated_lines"]               # secondary shifted
f = ter_shift_l0["generated_lines"]            # tertiary l0 down
h = ter_shift_l1["generated_lines"]            # tertiary l1 up
i = sp["generated_lines"]                      # special shifted

# debug geometry
o = sec_shift["viz"]["all_intersection_points"]
p = sec_shift["viz"]["selected_points"]

g_out = g
# ---------- end py3_3 ----------
draw_9 = COMPASDraw(cg=py3_3.c)  # -> rg; same code as compas_draw
draw_10 = COMPASDraw(cg=py3_3.a)  # -> rg; same code as compas_draw
draw_11 = COMPASDraw(cg=py3_3.f)  # -> rg; same code as compas_draw
draw_12 = COMPASDraw(cg=py3_3.e)  # -> rg; same code as compas_draw
draw_13 = COMPASDraw(cg=py3_3.p3)  # -> rg; same code as compas_draw
draw_14 = COMPASDraw(cg=py3_3.d)  # -> rg; same code as compas_draw
draw_15 = COMPASDraw(cg=py3_3.h)  # -> rg; same code as compas_draw
draw_16 = COMPASDraw(cg=py3_3.b)  # -> rg; same code as compas_draw
