# Grasshopper definition 260527_add_gripper_feature.gh (Grasshopper 1.0.8)
# plug-ins: Human

panel = Panel("""T2_2026
Consoles / Gripper Positioner""")

# ----
# Load json file
toggle = BooleanToggle(True)
py3 = Python3Script(load=toggle)  # -> out, timber_models, a; inputs load: Boolean
# ---------- py3: Python ----------
from compas.data import json_load
import os, sys, importlib

from copy import deepcopy



gh_dir = os.path.dirname(ghenv.Component.OnPingDocument().FilePath)
gh_par = os.path.dirname(gh_dir)

file_path = os.path.join(gh_par,"modularization", "data", "260527_v1_timber_models.json")
print(file_path)

if load:
    results = json_load(file_path)
    results = deepcopy(results)

    for data in results:
        model = data['model']
        attrs = data['attributes']
        print (model.attributes.keys())

        model.attributes = attrs
        print (model.attributes.keys())

    timber_models = [data['model'] for data in results]
# ---------- end py3 ----------

py3_2 = Python3Script(unload=Button())  # -> out; inputs unload: Boolean
# ---------- py3_2: Python ----------
from compas_rhino import unload_modules
import compas_timber

if unload:
    unload_modules('compas_timber')
    print("Module Unloaded")
# ---------- end py3_2 ----------
check = Python3Script()  # -> out, a
# ---------- check: Python ----------
import compas
import compas_timber

print(compas.__version__)
print(compas_timber.__version__)
print(compas_timber.__file__)
# ---------- end check ----------
panel_2 = Panel(check.out)
py3_3 = Python3Script(model=py3.timber_models)  # -> out, geo, frames, out_model
# ---------- py3_3: Python ----------
from compas.geometry import Line, Plane, Frame
from compas.geometry import intersection_segment_plane
from compas.geometry import angle_vectors
from compas.geometry import dot_vectors
from compas.tolerance import TOL
from compas_timber.fabrication import Drilling

from compas.geometry import Transformation

GRIPPER_SEPARATION = 0.8
DRILL_DEPTH = 0.04
DRILL_DIAMETER = 0.0205

BIG_GRIPPER = 0.8
SMALL_GRIPPER = 0.5

from copy import deepcopy

mod = deepcopy(model)


def get_default_ref_side_index(plane, beam):
        """Get the default reference side index for the given cutting plane and beam.
        This method checks if the cutting plane intersects with the reference sides of the beam
        and returns the index of the reference side with the smallest angle to the plane's normal.

        # NOTE: Consider moving all connection-agnostic utilities (including this one) to a shared location for reuse in fabrication and other modules.

        Parameters
        ----------
        plane : :class:`~compas.geometry.Plane` or :class:`~compas.geometry.Frame`
            The cutting plane.
        beam : :class:`~compas_timber.elements.Beam`
            The beam that is cut by this instance.

        Returns
        -------
        int
            The default ref_side_index for the given cutting plane and beam.

        """
        angles = {}
        max = 100000
        key = 0
        for i, ref_side in enumerate(beam.ref_sides[:4]):
            width, _ = beam.get_dimensions_relative_to_side(i)
            y_seg = Line.from_point_and_vector(ref_side.point, ref_side.yaxis * width)
            # check if the plane intersects with the reference side and the angle between their normals is positive
            dot = dot_vectors(plane.normal, ref_side.normal)
            if dot<max:
                max=dot
                key=i
        return key

geo = []
frames = []
for beam in mod.beams:
    level = beam.attributes.get("level")
    grasp = beam.attributes.get("grasp_frame")
    T = beam.transformation_to_local()
    gc = grasp.copy()
    ref_side = get_default_ref_side_index(Plane.from_frame(grasp), beam)
    T = Transformation.from_change_of_basis(Frame.worldXY(), beam.ref_sides[ref_side])
    frames.append(grasp)
    print(gc.transformed(T))
    w,h=beam.get_dimensions_relative_to_side(ref_side)
    if beam.attributes["assembly_method"]=="robot":
        if beam.blank_length >= 1.0:
            drilling = Drilling(
                start_x=gc.transformed(T).point.x + BIG_GRIPPER/2,
                start_y=gc.transformed(T).point.y,
                depth_limited=True,
                depth=DRILL_DEPTH,
                diameter=DRILL_DIAMETER,
                ref_side_index=ref_side,
                is_joinery=False,
            )
            beam.add_feature(drilling)
            drilling = Drilling(
                start_x=gc.transformed(T).point.x - BIG_GRIPPER/2,
                start_y=gc.transformed(T).point.y,
                depth_limited=True,
                depth=DRILL_DEPTH,
                diameter=DRILL_DIAMETER,
                ref_side_index=ref_side,
                is_joinery=False,
            )
            beam.add_feature(drilling)
            drilling = Drilling(
                start_x=gc.transformed(T).point.x - (BIG_GRIPPER/2 - 0.20),
                start_y=gc.transformed(T).point.y,
                depth_limited=True,
                depth=DRILL_DEPTH,
                diameter=DRILL_DIAMETER,
                ref_side_index=ref_side,
                is_joinery=False,
            )
            beam.add_feature(drilling)

        elif beam.blank_length >= 0.6:
            drilling = Drilling(
                start_x=gc.transformed(T).point.x + SMALL_GRIPPER/2,
                start_y=gc.transformed(T).point.y,
                depth_limited=True,
                depth=DRILL_DEPTH,
                diameter=DRILL_DIAMETER,
                ref_side_index=ref_side,
                is_joinery=False,
            )
            beam.add_feature(drilling)
            drilling = Drilling(
                start_x=gc.transformed(T).point.x - SMALL_GRIPPER/2,
                start_y=gc.transformed(T).point.y,
                depth_limited=True,
                depth=DRILL_DEPTH,
                diameter=DRILL_DIAMETER,
                ref_side_index=ref_side,
                is_joinery=False,
            )
            beam.add_feature(drilling)
            drilling = Drilling(
                start_x=gc.transformed(T).point.x - (SMALL_GRIPPER/2 - 0.05),
                start_y=gc.transformed(T).point.y,
                depth_limited=True,
                depth=DRILL_DEPTH,
                diameter=DRILL_DIAMETER,
                ref_side_index=ref_side,
                is_joinery=False,
            )
            beam.add_feature(drilling)


    try:
        if level==0:
            geo.append(beam.geometry)
    except Exception as e:
        pass

out_model = mod
# ---------- end py3_3 ----------
draw = COMPASDraw(cg=py3_3.geo)  # -> rg
#   port cg: The COMPAS geometry or datastructure to be drawn.
#   port rg: The Rhino geometry object.
# ---------- draw: Python ----------
# r: compas>=2.14.1
"""
Draws COMPAS geometry in Grasshopper.
"""

from typing import Any

import Grasshopper

from compas.scene import SceneObject


class CompasToRhinoGeometry(Grasshopper.Kernel.GH_ScriptInstance):
    def RunScript(self, cg):
        if not cg:
            return None

        return SceneObject(item=cg).draw()
# ---------- end draw ----------
panel_3 = Panel(py3_3.frames)

# ----
# Process joinery
# (seems cannot orient elements only),
# maybe we can create timber model that is oriented already
toggle_2 = BooleanToggle(True)
py3_4 = Python3Script(models=py3_3.out_model, process=toggle_2)  # -> out, model; inputs process: Boolean
# ---------- py3_4: Python ----------
import os, sys, importlib

gh_dir = os.path.dirname(ghenv.Component.OnPingDocument().FilePath)

parent = os.path.dirname(gh_dir)              # go up one level
src_dir = os.path.join(parent, "src")         # go into src folder
if src_dir not in sys.path:
    sys.path.insert(0, src_dir)

print(src_dir)


import timber_config
importlib.reload(timber_config)

import timber_model
importlib.reload(timber_model)
from timber_model import apply_processings

from copy import deepcopy

model = deepcopy(models)

#
if process:
    apply_processings(model)
# ---------- end py3_4 ----------

# ---- group: sequence preview with hierarchy colors
# Preview
python_3_script = Python3Script(model=py3_4.model, step=Slider(100, range=0..100))  # -> out, geometry_to_show, colors_to_show, plate, midpoints_to_show, texts_to_show; inputs step: Int32
# ---------- python_3_script: Python ----------
import rhinoscriptsyntax as rs
import scriptcontext as sc
import Rhino.Display as rd
import System.Drawing as sd

from compas.scene import Scene
from compas.geometry import Line, Point
from copy import deepcopy


alpha = 180

COLORS = {
    "primary":      sd.Color.FromArgb(alpha, 220,  50,  50),
    "main_primary": sd.Color.FromArgb(alpha, 150,  80, 220),
    "secondary":    sd.Color.FromArgb(alpha,  50, 150, 220),
    "tertiary":     sd.Color.FromArgb(alpha,  80, 200, 100),
    "shoe":         sd.Color.FromArgb(alpha,  20, 150, 100),
    "plate":        sd.Color.FromArgb(alpha, 100, 100, 100)
}

geometry = []
colors = []


sorted_geometry = []
sorted_colors = []
sorted_midpoints = []
sorted_texts = []
seen = set()


for plate in model.plates:
    geometry.append(plate.geometry)
    colors.append(COLORS["plate"])

sorting_data = []

for beam in model.beams:
    sorting_data.append(beam.attributes.get("sequence_id"))
    hie = beam.attributes.get("hierarchy", "secondary")
    geometry.append(beam.geometry)
    colors.append(COLORS.get(hie, COLORS["secondary"]))

beams = model.beams

sorted_beams = sorted(beams, key = lambda j: beam.attributes.get("sequence_id"))

for beam in sorted_beams:

    sorted_geometry.append(beam.geometry)
    sorted_colors.append(
        COLORS.get(
            beam.attributes.get("hierarchy", "secondary"),
            COLORS["secondary"]
        )
    )


step = max(0, min(step, len(sorted_geometry)))

geometry_to_show = sorted_geometry[:step]
colors_to_show = sorted_colors[:step]
plate = geometry[0]
midpoints_to_show = sorted_midpoints[:step]
texts_to_show = sorted_texts[:step]
# ---------- end python_3_script ----------
compas_draw = COMPASDraw(cg=python_3_script.geometry_to_show)  # -> rg; same code as draw
wires = BrepWireframe(Brep=compas_draw, Density=-1)
preview = CustomPreview(Geometry=compas_draw, Material=python_3_script.colors_to_show)
previewlw = CustomPreviewLineweights(Geometry=wires, Shader=ColourSwatch(SwatchColor=RGB(255, 255, 255)), Absolute=False)

# ----
compas_draw_2 = COMPASDraw(cg=python_3_script.plate)  # -> rg; same code as draw
compas_draw_3 = COMPASDraw(cg=python_3_script.plate)  # -> rg; same code as draw
compas_draw_4 = COMPASDraw(cg=python_3_script.midpoints_to_show)  # -> rg; same code as draw
tag = TextTag(Location=compas_draw_4, Text=python_3_script.texts_to_show)
preview_2 = CustomPreview(Geometry=compas_draw_2, Material=ColourSwatch(SwatchColor=RGBA(0, 0, 0, 159)))
py3_5 = Python3Script(models=py3_4.model, version=Slider(1, range=1..10), save=Button())  # inputs models: list, version: Int32
# ---------- py3_5: Python ----------
import os, sys, importlib
from datetime import date

from compas.data import json_dump

gh_dir = os.path.dirname(ghenv.Component.OnPingDocument().FilePath)
gh_par = os.path.dirname(gh_dir)
file_path = os.path.join(gh_par, "modularization", "data")

# print(file_path)
today = date.today().strftime("%y%m%d")
# print(today)



if save:
    serializable = []
    for m in models:
        serializable.append({
            "attributes": dict(m.attributes),
            "model": m
        })
        
    output_path = os.path.join(file_path, f"{today}_v{version}_fabrication_model.json")
    dump = json_dump(serializable, output_path, pretty=True)
    print(f"Model written to {output_path}")


# serializable = []
# for m in models:
#     serializable.append({
#         "attributes": dict(m.attributes),
#         "model": m
#     })
# print (serializable)
# ---------- end py3_5 ----------
