# Grasshopper definition base_plates.ghx (Grasshopper 1.0.8)
# plug-ins: Human, LadybugGrasshopper

list = ValueList({"parallel_to_ground", "Perpendicular_to_grain"}, selected="Perpendicular_to_grain")
falsestart = LBFalseStartToggle(True)
falsestart_2 = LBFalseStartToggle(True)
annotations = Python3Script()  # -> out, messages
# ---------- annotations: Python ----------
import importlib.util
import os
import sys
import traceback

ROOT = r"C:\Users\Juste\Documents\_facade_tools\projects\03_tests\_structural graph"
HELPER_PATH = os.path.join(ROOT, "gh", "py", "base_footing_annotation_component.py")


def _load_helper():
    module_name = "base_footing_annotation_component"
    sys.modules.pop(module_name, None)
    spec = importlib.util.spec_from_file_location(module_name, HELPER_PATH)
    if spec is None or spec.loader is None:
        raise ImportError("Could not load {0}".format(HELPER_PATH))
    module = importlib.util.module_from_spec(spec)
    spec.loader.exec_module(module)
    return module


try:
    helper = _load_helper()
    result = helper.run(
        timber_brep=timber_brep,
        plate_brep=plate_brep,
        bolt_points=bolt_points,
        washer_recess_breps=washer_recess_breps,
        slot_cut_brep=slot_cut_brep,
        metadata=metadata,
        show_top_dimensions=show_top_dimensions,
        show_front_dimensions=show_front_dimensions,
        show_section_dimensions=show_section_dimensions,
        show_code_labels=show_code_labels,
        dim_offset=dim_offset,
        text_height=text_height,
        arrow_size=arrow_size,
        view_scale=view_scale,
    )

    dim_lines = result["dim_lines"]
    extension_lines = result["extension_lines"]
    arrowheads = result["arrowheads"]
    text_labels = result["text_labels"]
    leader_lines = result["leader_lines"]
    code_check_labels = result["code_check_labels"]
    annotation_groups = result["annotation_groups"]
    annotation_planes = result["annotation_planes"]
    messages = result["messages"]

except Exception:
    dim_lines = []
    extension_lines = []
    arrowheads = []
    text_labels = []
    leader_lines = []
    code_check_labels = []
    annotation_groups = {}
    annotation_planes = {}
    messages = [traceback.format_exc()]
# ---------- end annotations ----------
py3 = Python3Script(
    target_cluster_index=Slider(4, range=1..4),
    baseplate_top_z=Slider(0.368, range=0..1),
    webplate_hole_rows=Slider(2, range=1..2),
    include_stiffeners=falsestart,
    enabled=falsestart_2,
    bottom_face_mode=list)  # -> out, payload, preview_breps, footing_debug
# ---------- py3: Python ----------
import importlib.util
import os
import sys
import traceback

try:
    import Rhino  # type: ignore
except Exception:
    Rhino = None

ROOT = r"C:\Users\Juste\Documents\_GitHub\MAS-2526\10_llhil-t2-fabrication\design\structure_model\Base_Plates"
DEFAULT_PLATE_LENGTH = 0.8
DEFAULT_PLATE_WIDTH = 0.8
DEFAULT_PLATE_THICKNESS = 0.02
DEFAULT_BASEPLATE_TOP_Z = 0.3658
RUN_TAG = "BPG_WRAPPER_SYNC_2026_05_16_FIXED_Z"

# Diagnostic: print resolved path
print("[GH Wrapper] RUN_TAG:", RUN_TAG)
print("[GH Wrapper] ROOT:", ROOT)
HELPER_PATH = os.path.join(ROOT, "py", "base_plate_geometry.py")
print("[GH Wrapper] HELPER_PATH:", HELPER_PATH)
print("[GH Wrapper] HELPER_EXISTS:", os.path.exists(HELPER_PATH))



def _load_helper():
    module_name = "base_plate_geometry"
    sys.modules.pop(module_name, None)
    spec = importlib.util.spec_from_file_location(module_name, HELPER_PATH)
    if spec is None or spec.loader is None:
        raise ImportError("Could not load {0}".format(HELPER_PATH))
    module = importlib.util.module_from_spec(spec)
    # Required for dataclasses/type resolution during module execution in GH Py3.
    sys.modules[module_name] = module
    try:
        spec.loader.exec_module(module)
    except Exception as e:
        print("[GH Wrapper] Error importing base_plate_geometry.py:", e)
        import traceback
        print(traceback.format_exc())
        raise
    return module


def _unit_system_from_name(units_name):
    if Rhino is None:
        return None
    text = str(units_name or "").strip().lower()
    if text in ("m", "meter", "meters", "metre", "metres"):
        return Rhino.UnitSystem.Meters
    if text in ("mm", "millimeter", "millimeters", "millimetre", "millimetres"):
        return Rhino.UnitSystem.Millimeters
    return None


def _payload_to_doc_scale(payload_units):
    if Rhino is None:
        return 1.0
    try:
        doc = Rhino.RhinoDoc.ActiveDoc
        if doc is None:
            return 1.0
        source_units = _unit_system_from_name(payload_units)
        if source_units is None:
            return 1.0
        return float(Rhino.RhinoMath.UnitScale(source_units, doc.ModelUnitSystem))
    except Exception:
        return 1.0


def _scale_breps_copy(breps, scale_factor):
    if Rhino is None:
        return [b for b in (breps or []) if b is not None]
    if abs(scale_factor - 1.0) <= 1e-12:
        return [b for b in (breps or []) if b is not None]

    scaled = []
    transformed_count = 0
    passthrough_count = 0
    try:
        xform = Rhino.Geometry.Transform.Scale(Rhino.Geometry.Plane.WorldXY, scale_factor)
    except Exception:
        return [b for b in (breps or []) if b is not None]

    for geom in (breps or []):
        if geom is None:
            continue
        try:
            dup = None

            # Prefer geometry-preserving duplicate when available.
            duplicate = getattr(geom, "Duplicate", None)
            if callable(duplicate):
                dup = duplicate()

            # Fall back to Brep duplication path.
            if dup is None:
                duplicate_brep = getattr(geom, "DuplicateBrep", None)
                if callable(duplicate_brep):
                    dup = duplicate_brep()

            # Last resort: convert to Brep if possible.
            if dup is None:
                to_brep = getattr(geom, "ToBrep", None)
                if callable(to_brep):
                    try:
                        dup = to_brep(False)
                    except TypeError:
                        dup = to_brep()

            if dup is None:
                passthrough_count += 1
                scaled.append(geom)
                continue

            if not dup.Transform(xform):
                passthrough_count += 1
                scaled.append(geom)
                continue

            transformed_count += 1
            scaled.append(dup)
        except Exception:
            passthrough_count += 1
            scaled.append(geom)

    print(
        "[GH Wrapper] footing scale transform: transformed={0}, passthrough={1}".format(
            transformed_count,
            passthrough_count,
        )
    )
    return scaled


def _coerce_geometry_list(items):
    """Return only Rhino geometry objects, converting to Brep when possible."""
    coerced = []
    for item in (items or []):
        if item is None:
            continue
        geom = item
        if Rhino is not None:
            try:
                if isinstance(geom, Rhino.Geometry.GeometryBase):
                    coerced.append(geom)
                    continue
            except Exception:
                pass
        try:
            duplicate = getattr(item, "Duplicate", None)
            if callable(duplicate):
                geom = duplicate()
        except Exception:
            geom = item
        if Rhino is not None:
            try:
                if isinstance(geom, Rhino.Geometry.GeometryBase):
                    coerced.append(geom)
                    continue
            except Exception:
                pass
        try:
            to_brep = getattr(item, "ToBrep", None)
            if callable(to_brep):
                try:
                    brep = to_brep(False)
                except TypeError:
                    brep = to_brep()
                if brep is not None:
                    coerced.append(brep)
                    continue
        except Exception:
            pass
    return coerced


def _to_python_data(value):
    if isinstance(value, dict):
        return {key: _to_python_data(item) for key, item in value.items()}
    try:
        keys = list(value.Keys)
    except Exception:
        keys = None
    if keys is not None:
        return {
            _to_python_data(key): _to_python_data(value[key])
            for key in keys
        }
    if isinstance(value, (list, tuple)):
        return [_to_python_data(item) for item in value]
    return value


def _coerce_webplate_hole_rows(value):
    """Accept both the intended 1/2 integer control and a GH bool toggle."""
    if isinstance(value, bool):
        return 2 if value else 1
    text = str(value).strip().lower()
    if text == "true":
        return 2
    if text == "false":
        return 1
    try:
        numeric = int(value)
    except Exception:
        return None
    if numeric in (1, 2):
        return numeric
    if numeric == 0:
        return 1
    return 2 if numeric > 1 else 1


try:
    helper = _load_helper()

    if "enabled" in globals() and enabled is False:
        print("[GH Wrapper] Branch: disabled")
        out = "Base plate geometry disabled."
        payload = {}
        members = []
        base_plates = []
        preview_breps = []
        footing_debug = []
    else:
        print("[GH Wrapper] Branch: active")
        kwargs = {}
        if "payload_override" in globals() and payload_override:
            payload_candidate = _to_python_data(payload_override)
            payload = payload_candidate if isinstance(payload_candidate, dict) else payload_override
        else:
            kwargs = {
                "plate_length": DEFAULT_PLATE_LENGTH,
                "plate_width": DEFAULT_PLATE_WIDTH,
                "plate_thickness": DEFAULT_PLATE_THICKNESS,
                "bottom_face_mode": "Perpendicular_to_grain",
                "target_support_nodes_only": True,
                "deduplicate_support_nodes": True,
                "geometry_kind": "footing",
                "baseplate_top_z": DEFAULT_BASEPLATE_TOP_Z,
            }
            if "line_model_path" in globals() and line_model_path:
                from pathlib import Path
                kwargs["line_model_path"] = Path(str(line_model_path))
            else:
                # Fallback for GH context: use absolute path to repo's line_model data
                from pathlib import Path
                data_dir = Path(r"C:\Users\Juste\Documents\_GitHub\MAS-2526\10_llhil-t2-fabrication\design\line_model\data")
                # Prefer the latest explicit line-model export before legacy variants.
                for candidate in ["260516_v1_line_model.json", "0806_shifted_lines.json", "shifted_lines.json", "meters_shifted_lines.json"]:
                    candidate_path = data_dir / candidate
                    if candidate_path.exists():
                        kwargs["line_model_path"] = candidate_path
                        break
            if "plate_length" in globals() and plate_length is not None:
                kwargs["plate_length"] = float(plate_length)
            if "plate_width" in globals() and plate_width is not None:
                kwargs["plate_width"] = float(plate_width)
            if "plate_thickness" in globals() and plate_thickness is not None:
                kwargs["plate_thickness"] = float(plate_thickness)
            if "bottom_face_mode" in globals() and bottom_face_mode:
                kwargs["bottom_face_mode"] = str(bottom_face_mode)
            if "include_hierarchies" in globals() and include_hierarchies:
                kwargs["include_hierarchies"] = include_hierarchies
            if "target_support_nodes_only" in globals() and target_support_nodes_only is not None:
                kwargs["target_support_nodes_only"] = bool(target_support_nodes_only)
            if "support_z_tolerance" in globals() and support_z_tolerance is not None:
                kwargs["support_z_tolerance"] = float(support_z_tolerance)
            if "deduplicate_support_nodes" in globals() and deduplicate_support_nodes is not None:
                kwargs["deduplicate_support_nodes"] = bool(deduplicate_support_nodes)
            if "support_node_merge_tolerance" in globals() and support_node_merge_tolerance is not None:
                kwargs["support_node_merge_tolerance"] = float(support_node_merge_tolerance)
            if "target_cluster_index" in globals() and target_cluster_index is not None:
                kwargs["target_cluster_index"] = int(target_cluster_index)
            elif "target_member_index" in globals() and target_member_index is not None:
                # Backward compatibility only: use target_cluster_index (1..4) going forward.
                kwargs["target_cluster_index"] = int(target_member_index)
                print("[GH Wrapper] target_member_index is deprecated; use target_cluster_index (1..4).")
            if "geometry_kind" in globals() and geometry_kind:
                kwargs["geometry_kind"] = str(geometry_kind)
            if "baseplate_top_z" in globals() and baseplate_top_z is not None:
                kwargs["baseplate_top_z"] = float(baseplate_top_z)
            if "base_plate_brep" in globals() and base_plate_brep is not None:
                kwargs["base_plate_brep"] = base_plate_brep
            if "base_diameter" in globals() and base_diameter is not None:
                kwargs["base_diameter"] = float(base_diameter)
            if "min_hole_edge_spacing" in globals() and min_hole_edge_spacing is not None:
                kwargs["min_hole_edge_spacing"] = float(min_hole_edge_spacing)
            if "heel_fillet_radius" in globals() and heel_fillet_radius is not None:
                kwargs["heel_fillet_radius"] = float(heel_fillet_radius)
            if "timber_bottom_gap" in globals() and timber_bottom_gap is not None:
                kwargs["timber_bottom_gap"] = float(timber_bottom_gap)
            if "min_timber_gap" in globals() and min_timber_gap is not None:
                kwargs["min_timber_gap"] = float(min_timber_gap)
            if "webplate_thickness" in globals() and webplate_thickness is not None:
                kwargs["webplate_thickness"] = float(webplate_thickness)
            if "webplate_hole_diameter" in globals() and webplate_hole_diameter is not None:
                kwargs["webplate_hole_diameter"] = float(webplate_hole_diameter)
            if "webplate_hole_pitch" in globals() and webplate_hole_pitch is not None:
                kwargs["webplate_hole_pitch"] = float(webplate_hole_pitch)
            if "webplate_hole_transverse_spacing" in globals() and webplate_hole_transverse_spacing is not None:
                kwargs["webplate_hole_transverse_spacing"] = float(webplate_hole_transverse_spacing)
            row_input_name = None
            row_input_value = None
            if "webplate_hole_rows" in globals() and webplate_hole_rows is not None:
                row_input_name = "webplate_hole_rows"
                row_input_value = webplate_hole_rows
            elif "plate_hole_rows" in globals() and plate_hole_rows is not None:
                row_input_name = "plate_hole_rows"
                row_input_value = plate_hole_rows
            if row_input_name is not None:
                resolved_rows = _coerce_webplate_hole_rows(row_input_value)
                if resolved_rows is not None:
                    kwargs["webplate_hole_rows"] = resolved_rows
                    print(
                        "[GH Wrapper] hole row input {0}={1!r} -> rows={2}".format(
                            row_input_name,
                            row_input_value,
                            resolved_rows,
                        )
                    )
                    if row_input_name == "plate_hole_rows":
                        print("[GH Wrapper] plate_hole_rows is a supported alias; prefer webplate_hole_rows.")

            pair_axis_shift_input_name = None
            pair_axis_shift_input_value = None
            for candidate_name in (
                "stiffener_pair_axis_shift",
                "stiffener_pair_shift",
                "stiffener_pair_translate",
            ):
                if candidate_name in globals() and globals().get(candidate_name) is not None:
                    pair_axis_shift_input_name = candidate_name
                    pair_axis_shift_input_value = globals().get(candidate_name)
                    break
            if pair_axis_shift_input_name is not None:
                kwargs["stiffener_pair_axis_shift"] = float(pair_axis_shift_input_value)
                print(
                    "[GH Wrapper] stiffener pair axis shift {0}={1!r}".format(
                        pair_axis_shift_input_name,
                        pair_axis_shift_input_value,
                    )
                )

            pair_from_input_name = None
            pair_from_input_value = None
            for candidate_name in (
                "stiffener_pair_from_point",
                "stiffener_point_1",
                "stiffener_point1",
            ):
                if candidate_name in globals() and globals().get(candidate_name) is not None:
                    pair_from_input_name = candidate_name
                    pair_from_input_value = globals().get(candidate_name)
                    break
            if pair_from_input_name is not None:
                kwargs["stiffener_pair_from_point"] = pair_from_input_value
                print("[GH Wrapper] stiffener pair from point input: {0}".format(pair_from_input_name))

            pair_to_input_name = None
            pair_to_input_value = None
            for candidate_name in (
                "stiffener_pair_to_point",
                "stiffener_point_2",
                "stiffener_point2",
            ):
                if candidate_name in globals() and globals().get(candidate_name) is not None:
                    pair_to_input_name = candidate_name
                    pair_to_input_value = globals().get(candidate_name)
                    break
            if pair_to_input_name is not None:
                kwargs["stiffener_pair_to_point"] = pair_to_input_value
                print("[GH Wrapper] stiffener pair to point input: {0}".format(pair_to_input_name))

            if "include_stiffeners" in globals() and include_stiffeners is not None:
                kwargs["include_stiffeners"] = bool(include_stiffeners)
            if "sizing_recommendations" in globals() and sizing_recommendations:
                kwargs["sizing_recommendations"] = _to_python_data(sizing_recommendations)
            elif "calc_payload" in globals() and calc_payload:
                kwargs["sizing_recommendations"] = _to_python_data(calc_payload)

            print("[GH Wrapper] kwargs:", kwargs)

            payload = helper.build_geometry_payload(**kwargs)
        members = payload.get("members", [])
        base_plate_records = payload.get("base_plates", [])
        base_plates = []
        footing_breps = payload.get("footing_breps", []) if isinstance(payload, dict) else []
        metadata = payload.get("metadata", {}) if isinstance(payload, dict) else {}
        handoff = payload.get("handoff", {}) if isinstance(payload, dict) else {}
        footing_debug_records = metadata.get("footing_debug", []) if isinstance(metadata, dict) else []
        footing_debug = [repr(item) for item in footing_debug_records]
        print("[GH Wrapper] Extracted members: {0}".format(len(members)))
        print("[GH Wrapper] Extracted base_plates: {0}".format(len(base_plate_records)))
        if metadata.get("support_cluster_member_indices"):
            print(
                "[GH Wrapper] support cluster member indices: {0}".format(
                    metadata.get("support_cluster_member_indices")
                )
            )
        if footing_debug_records:
            first_debug = footing_debug_records[0] if isinstance(footing_debug_records[0], dict) else {}
            stiffener_debug = first_debug.get("stiffener_specs") if isinstance(first_debug, dict) else []
            if stiffener_debug:
                print(
                    "[GH Wrapper] stiffeners: count={0}, kinds={1}".format(
                        len(stiffener_debug),
                        [item.get("stiffener_kind") for item in stiffener_debug],
                    )
                )
                face_stiffener_shifts = [
                    {
                        "member": item.get("target_anchor_member_id"),
                        "face_depth": item.get("webplate_depth"),
                        "target_source": item.get("webplate_intersection_source"),
                        "collision_point": item.get("collision_point_input"),
                        "plane_projection": item.get("projected_collision_point"),
                        "edge_projection": item.get("edge_projected_collision_point"),
                        "edge_name": item.get("edge_projected_collision_name"),
                        "heel_face_start": item.get("heel_face_midline_start"),
                        "heel_face_end": item.get("heel_face_midline_end"),
                        "heel_face_target": item.get("heel_face_midpoint_at_timber_face"),
                        "heel_face_t": item.get("heel_face_intersection_param"),
                        "target": item.get("webplate_intersection_target"),
                        "from_midpoint": item.get("unsnapped_pair_shared_edge_midpoint"),
                        "pair_snap": item.get("pair_snap_vector"),
                        "side_span": item.get("side_mount_span"),
                        "side_offset": item.get("side_mount_center_offset"),
                        "heel_y": item.get("heel_side_alignment_y"),
                        "toe_y": item.get("toe_side_alignment_y"),
                        "center_shift": item.get("bottom_face_center_shift"),
                        "pair_axis_shift": item.get("pair_axis_shift"),
                        "pair_axis_shift_source": item.get("pair_axis_shift_source"),
                        "pair_axis_shift_vector": item.get("pair_axis_shift_vector"),
                    }
                    for item in stiffener_debug
                    if item.get("stiffener_kind") == "timber_bottom_face"
                ]
                if face_stiffener_shifts:
                    print(
                        "[GH Wrapper] timber-face stiffener edge alignment: {0}".format(
                            face_stiffener_shifts
                        )
                    )
        milling_metadata = handoff.get("milling", {}) if isinstance(handoff, dict) else {}
        if isinstance(milling_metadata, dict) and milling_metadata.get("bolt_hole_diameter") is not None:
            print(
                "[GH Wrapper] web plate holes: rows={0}, per_row={1}, total={2}, mode={3}, dia_mm={4}, gage_mm={5}, pitch_mm={6}, source={7}".format(
                    milling_metadata.get("plate_hole_rows"),
                    milling_metadata.get("plate_holes_per_row"),
                    milling_metadata.get("plate_total_hole_count"),
                    milling_metadata.get("plate_hole_row_mode"),
                    None if milling_metadata.get("bolt_hole_diameter") is None else 1000.0 * float(milling_metadata.get("bolt_hole_diameter")),
                    None if milling_metadata.get("gage_perp") is None else 1000.0 * float(milling_metadata.get("gage_perp")),
                    None if milling_metadata.get("pitch_parallel") is None else 1000.0 * float(milling_metadata.get("pitch_parallel")),
                    milling_metadata.get("bolt_hole_dimension_source"),
                )
            )
            if milling_metadata.get("plate_hole_center_counts"):
                print(
                    "[GH Wrapper] web plate hole center counts per plate: {0}".format(
                        milling_metadata.get("plate_hole_center_counts")
                    )
                )
            if milling_metadata.get("plate_hole_pattern_diagnostics"):
                print(
                    "[GH Wrapper] web plate hole pattern diagnostics: {0}".format(
                        [
                            {
                                "plate_index": item.get("plate_index"),
                                "expected": item.get("expected_count"),
                                "generated": item.get("generated_count"),
                                "inside": item.get("inside_plate_count"),
                                "status": item.get("status"),
                            }
                            for item in milling_metadata.get("plate_hole_pattern_diagnostics")
                        ]
                    )
                )
        geometry_metadata = handoff.get("geometry", {}) if isinstance(handoff, dict) else {}
        if isinstance(geometry_metadata, dict) and geometry_metadata.get("stiffener_specs"):
            print(
                "[GH Wrapper] stiffener targets: {0}".format(
                    [
                        {
                            "source": item.get("target_source"),
                            "member_id": item.get("target_anchor_member_id"),
                            "member_index": item.get("target_anchor_member_index"),
                            "azimuth_deg": item.get("azimuth_deg"),
                        }
                        for item in geometry_metadata.get("stiffener_specs")
                    ]
                )
            )
        if footing_debug_records:
            print("[GH Wrapper] footing debug: {0}".format(footing_debug_records))
        if "target_cluster_index" in kwargs:
            print(
                "[GH Wrapper] target_cluster_index={0}, mode={1}".format(
                    kwargs.get("target_cluster_index"),
                    metadata.get("target_member_index_mode"),
                )
            )
            try:
                available_indices = [int((m or {}).get("index")) for m in members if isinstance(m, dict) and (m or {}).get("index") is not None]
                print("[GH Wrapper] available member indices: {0}".format(available_indices))
            except Exception:
                pass
        
        preview_breps = []
        if footing_breps:
            footing_units = metadata.get("footing_output_units") or metadata.get("geometry_units") or "millimeters"
            payload_to_doc = _payload_to_doc_scale(footing_units)
            _scaled_breps = _scale_breps_copy(footing_breps, payload_to_doc)
            preview_breps = _coerce_geometry_list(_scaled_breps)
            if isinstance(payload, dict):
                payload["preview"] = {
                    "breps_doc_units": preview_breps,
                    "source_units": footing_units,
                    "document_scale_factor": payload_to_doc,
                }
            print(
                "[GH Wrapper] Built {0} footing preview breps ({1}->doc scale={2})".format(
                    len(preview_breps),
                    footing_units,
                    payload_to_doc,
                )
            )
            if len(preview_breps) != len(_scaled_breps):
                print("[GH Wrapper] Dropped {0} non-geometry footing items during coercion".format(
                    len(_scaled_breps) - len(preview_breps)
                ))
        elif hasattr(helper, "BasePlateRecord") and base_plate_records:
            try:
                bp_records = [helper.BasePlateRecord(**bp) for bp in base_plate_records]
                preview_breps = _coerce_geometry_list(helper.build_preview_breps(bp_records))
                print("[GH Wrapper] Built {0} preview breps".format(len(preview_breps)))
            except Exception as bp_err:
                print("[GH Wrapper] Error building preview breps: {0}".format(bp_err))
                import traceback
                print(traceback.format_exc())

        # GH output "base_plates" is commonly wired to geometry params; emit breps
        # directly to avoid Goo->Geometry conversion failures on dict records.
        if preview_breps:
            base_plates = _coerce_geometry_list(preview_breps)
            if isinstance(payload, dict):
                payload["base_plate_records"] = base_plate_records
            print("[GH Wrapper] base_plates output mapped to preview breps: {0}".format(len(base_plates)))
        else:
            base_plates = []
        
        unit_hint = ""
        if members and base_plate_records:
            try:
                mw = float((members[0] or {}).get("width") or 0.0)
                pl = float((base_plate_records[0] or {}).get("length") or 0.0)
                if mw > 0.0 and pl / mw > 20.0:
                    unit_hint = " | WARNING: plate/member scale looks too large; check mm vs m"
            except Exception:
                pass
        out = "Loaded {0} members and built {1} base plate records; output {2} preview breps{3}".format(
            len(members),
            len(base_plate_records),
            len(preview_breps),
            unit_hint,
        )
        print("[GH Wrapper] " + out)

except Exception:
    out = traceback.format_exc()
    payload = {}
    members = []
    base_plates = []
    preview_breps = []
    footing_debug = []
    print("[GH Wrapper] Exception caught:")
    print(out)
# ---------- end py3 ----------
layouts = Python3Script()  # -> out, named_view_data
# ---------- layouts: Python ----------
import importlib.util
import os
import sys
import traceback

ROOT = r"C:\Users\Juste\Documents\_facade_tools\projects\03_tests\_structural graph"
HELPER_PATH = os.path.join(ROOT, "gh", "py", "base_footing_layout_component.py")


def _load_helper():
    module_name = "base_footing_layout_component"
    sys.modules.pop(module_name, None)
    spec = importlib.util.spec_from_file_location(module_name, HELPER_PATH)
    if spec is None or spec.loader is None:
        raise ImportError("Could not load {0}".format(HELPER_PATH))
    module = importlib.util.module_from_spec(spec)
    spec.loader.exec_module(module)
    return module


try:
    helper = _load_helper()
    result = helper.run(
        geometry_objects=geometry_objects,
        annotation_objects=annotation_objects,
        metadata=metadata,
        combined_report=combined_report,
        create_named_views=create_named_views,
        create_layout_guides=create_layout_guides,
        sheet_size=sheet_size,
        drawing_scale=drawing_scale,
        title_block_info=title_block_info,
        project_name=project_name,
        detail_name=detail_name,
    )

    sheet_boundary = result["sheet_boundary"]
    viewport_guides = result["viewport_guides"]
    title_block_curves = result["title_block_curves"]
    title_block_text = result["title_block_text"]
    view_labels = result["view_labels"]
    report_text_block = result["report_text_block"]
    print_ready_groups = result["print_ready_groups"]
    named_view_data = result["named_view_data"]
    messages = result["messages"]

except Exception:
    sheet_boundary = None
    viewport_guides = []
    title_block_curves = []
    title_block_text = []
    view_labels = []
    report_text_block = []
    print_ready_groups = {}
    named_view_data = {}
    messages = [traceback.format_exc()]
# ---------- end layouts ----------
preview = CustomPreview(Geometry=py3.preview_breps, Material=ColourSwatch(SwatchColor=RGB(192, 192, 192)))
panel = Panel(py3.footing_debug)
falsestart_3 = LBFalseStartToggle(True)
list_2 = ValueList({"parallel_to_ground", "Perpendicular_to_grain"}, selected="parallel_to_ground")
bp_calculations = Python3Script(
    geometry_payload=py3.payload,
    min_allowable_clearance=Slider(80, range=0..100),
    base_plate_min_thickness=Slider(0.15, range=0..1),
    bottom_face_mode=list,
    enabled=falsestart_3)  # -> out, report_text, package, pass_fail_summary, utilization_values, payload, synced_geometry_payload
# ---------- bp_calculations: Python ----------
import importlib.util
import os
import sys
import traceback

ROOT = r"C:\Users\Juste\Documents\_GitHub\MAS-2526\10_llhil-t2-fabrication\design\structure_model\Base_Plates"
HELPER_PATH = os.path.join(ROOT, "py", "base_plate_calculations.py")


def _load_helper():
    module_name = "base_plate_calculations"
    sys.modules.pop(module_name, None)
    spec = importlib.util.spec_from_file_location(module_name, HELPER_PATH)
    if spec is None or spec.loader is None:
        raise ImportError("Could not load {0}".format(HELPER_PATH))
    module = importlib.util.module_from_spec(spec)
    spec.loader.exec_module(module)
    return module


try:
    helper = _load_helper()

    if "enabled" in globals() and enabled is False:
        out = "Base plate calculations disabled."
        payload = {}
    else:
        if "geometry_payload" not in globals() or not geometry_payload:
            raise ValueError("geometry_payload input is required")

        kwargs = {
            "geometry_payload": geometry_payload,
            "bottom_face_mode": str(bottom_face_mode) if "bottom_face_mode" in globals() and bottom_face_mode else "Perpendicular_to_grain",
            "min_allowable_clearance": float(min_allowable_clearance) if "min_allowable_clearance" in globals() and min_allowable_clearance is not None else 80.0,
            "shift_step": float(shift_step) if "shift_step" in globals() and shift_step is not None else 10.0,
            "max_shift": float(max_shift) if "max_shift" in globals() and max_shift is not None else 400.0,
            "base_plate_min_thickness": float(base_plate_min_thickness) if "base_plate_min_thickness" in globals() and base_plate_min_thickness is not None else 10.0,
            "base_plate_max_thickness": float(base_plate_max_thickness) if "base_plate_max_thickness" in globals() and base_plate_max_thickness is not None else 60.0,
            "sync_plate_dimensions_from_engineering": bool(sync_plate_dimensions_from_engineering) if "sync_plate_dimensions_from_engineering" in globals() else True,
            "sync_iterations": int(sync_iterations) if "sync_iterations" in globals() and sync_iterations is not None else 1,
        }
        merged_engineering_overrides = {}
        if "engineering_overrides" in globals() and isinstance(engineering_overrides, dict):
            merged_engineering_overrides.update(engineering_overrides)
        for name in (
            "bolt_dia",
            "bolt_hole_dia",
            "hole_clearance",
            "project_min_bolt_hole_dia",
            "rows",
            "holes_per_row",
            "pitch_parallel",
            "gage_perp",
            "end_distance",
            "edge_distance",
            "run_aisc_steel_node_checks",
            "run_stress_concentration_check",
            "corner_radius",
            "corner_radius_mode",
            "stress_concentration_factor",
            "use_gusset_plates",
            "use_web_stiffeners",
            "weld_utilization_limit_for_gusset_warning",
            "plate_slenderness_limit",
            "min_corner_radius",
            "project_min_corner_radius",
            "preferred_corner_radius_factor",
            "unsupported_plate_width",
            "eccentricity_mm",
            "concentrated_force_kN",
            "wall_thickness_mm",
            "concentrated_force_per_wall_thickness_limit",
        ):
            if name in globals() and globals()[name] is not None:
                merged_engineering_overrides[name] = globals()[name]
        if merged_engineering_overrides:
            kwargs["engineering_overrides"] = merged_engineering_overrides

        payload = helper.run_validation(**kwargs)
        out = "Validated {0} members".format(len(payload.get("member_results", [])))

    report_text = payload.get("report_text", "") if payload else ""
    combined_report = payload.get("combined_report", "") if payload else ""
    pass_fail_summary = payload.get("pass_fail_summary", {}) if payload else {}
    utilization_values = payload.get("utilization_values", {}) if payload else {}
    sizing_recommendations = payload.get("engineering", {}).get("sizing_recommendations", {}) if payload else {}
    steel_node_report = payload.get("steel_node_report", "") if payload else ""
    steel_node_checks = payload.get("steel_node_checks", {}) if payload else {}
    steel_node_recommendations = payload.get("steel_node_recommendations", {}) if payload else {}
    corner_radius_recommendation = sizing_recommendations.get("corner_radius") if sizing_recommendations else None
    synced_geometry_payload = payload.get("synced_geometry_payload", {}) if payload else {}

    a = payload.get("a") if payload else None
    b = payload.get("b") if payload else None
    c = payload.get("c") if payload else None
    d = payload.get("d") if payload else None
    e = payload.get("e") if payload else None
    f = payload.get("f") if payload else None
    g = payload.get("g") if payload else None
    h = payload.get("h") if payload else None
    i = payload.get("i") if payload else None
    j = payload.get("j") if payload else None
    k = payload.get("k") if payload else None
    l = payload.get("l") if payload else None
    m = payload.get("m") if payload else None
    n = payload.get("n") if payload else None

except Exception:
    out = traceback.format_exc()
    payload = {}
    report_text = ""
    combined_report = ""
    pass_fail_summary = {}
    utilization_values = {}
    sizing_recommendations = {}
    steel_node_report = ""
    steel_node_checks = {}
    steel_node_recommendations = {}
    corner_radius_recommendation = None
    synced_geometry_payload = {}
    a = b = c = d = e = f = g = h = i = j = k = l = m = n = None
# ---------- end bp_calculations ----------
bp_ct_json = Python3Script(
    geometry_payload=bp_calculations.synced_geometry_payload,
    calc_payload=bp_calculations.payload,
    bottom_face_mode=list_2,
    enabled=Button())  # -> out, package, inspection_breps, json_path; inputs bottom_face_mode: String
# ---------- bp_ct_json: Python ----------
import importlib.util
import os
import sys
import traceback
from pathlib import Path

ROOT = r"C:\Users\Juste\Documents\_GitHub\MAS-2526\10_llhil-t2-fabrication\design\structure_model\Base_Plates"
HELPER_PATH = os.path.join(ROOT, "ct_anchor_milling.py")


def _load_helper():
    module_name = "ct_anchor_milling"
    sys.modules.pop(module_name, None)
    spec = importlib.util.spec_from_file_location(module_name, HELPER_PATH)
    if spec is None or spec.loader is None:
        raise ImportError("Could not load {0}".format(HELPER_PATH))
    module = importlib.util.module_from_spec(spec)
    spec.loader.exec_module(module)
    return module


try:
    helper = _load_helper()

    if "enabled" in globals() and enabled is False:
        out = "CT export disabled."
        package = {}
        records = []
        timber_model_schema = {}
        inspection_breps = []
        json_path = None
    else:
        if "geometry_payload" not in globals() or not geometry_payload:
            raise ValueError("geometry_payload input is required")
        if "calc_payload" not in globals() or not calc_payload:
            raise ValueError("calc_payload input is required")

        effective_geometry_payload = geometry_payload
        if isinstance(calc_payload, dict):
            maybe_synced = calc_payload.get("synced_geometry_payload")
            if isinstance(maybe_synced, dict) and maybe_synced:
                effective_geometry_payload = maybe_synced

        target_path = Path(str(out_json_path)) if "out_json_path" in globals() and out_json_path else (Path(ROOT) / "ct_anchor_milling_export.json")

        package = helper.export_ct_json(
            geometry_payload=effective_geometry_payload,
            calc_payload=calc_payload,
            out_json_path=target_path,
            process_only_passed=bool(process_only_passed) if "process_only_passed" in globals() else False,
        )
        records = package.get("records", [])
        timber_model_schema = package.get("timber_model_schema", {})
        inspection_breps = helper.build_inspection_breps(records)
        json_path = str(target_path)
        out = "Exported {0} CT records".format(len(records))

except Exception:
    out = traceback.format_exc()
    package = {}
    records = []
    timber_model_schema = {}
    inspection_breps = []
    json_path = None
# ---------- end bp_ct_json ----------
panel_2 = Panel(bp_ct_json.json_path)
panel_3 = Panel(bp_ct_json.out)
previewmat = CustomPreviewMaterials(Geometry=bp_ct_json.inspection_breps, DiffuseColor=RGB(255, 255, 255))
preview_2 = CustomPreview(Geometry=bp_ct_json.inspection_breps, Material=ColourSwatch(SwatchColor=RGB(0, 0, 0)))
panel_4 = Panel(bp_calculations.report_text)
panel_5 = Panel(bp_calculations.package)
panel_6 = Panel(bp_calculations.utilization_values)
panel_7 = Panel(bp_calculations.pass_fail_summary)
preview_3 = CustomPreview(Geometry=bp_calculations.synced_geometry_payload, Material=ColourSwatch(SwatchColor=RGB(152, 152, 152)))
