# Grasshopper definition 0528_timber_model.ghx (Grasshopper 1.0.8)
# plug-ins: Human

py3 = Python3Script()  # -> out, line_model
# ---------- py3: Python ----------
from compas.data import json_load
import os, sys, importlib

gh_dir = os.path.dirname(ghenv.Component.OnPingDocument().FilePath)
gh_par = os.path.dirname(gh_dir)

line_path = os.path.join(gh_par, 'line_model')
json_path = os.path.join(
    gh_par, 'line_model', 'data', '260527_v4_line_model.json'
)

if line_path not in sys.path:
    sys.path.insert(0, line_path)

import nodegraph
importlib.reload(nodegraph)
from nodegraph import NodeGraph


line_model = json_load(json_path)

print (type(line_model))
# ---------- end py3 ----------

# ----
# Construct Timber Models
py3_2 = Python3Script(graph=py3.line_model)  # -> out, models
# ---------- py3_2: Python ----------
import os, sys, importlib

gh_dir = os.path.dirname(ghenv.Component.OnPingDocument().FilePath)

parent = os.path.dirname(gh_dir)              # go up one level
src_dir = os.path.join(parent, "src")         # go into src folder
if src_dir not in sys.path:
    sys.path.insert(0, src_dir)

print (gh_dir)
print (parent)
print (src_dir)


#######---------Imports------------##########
import timber_config
importlib.reload(timber_config)

import timber_model
importlib.reload(timber_model)
from timber_model import graph_to_timber_models


########----------Main Code-----------_###########
models = graph_to_timber_models(graph, align_shoe=False)

print (list(m.attributes['group'] for m in models))


models.sort(key=lambda m: m.attributes['group'])

print (list(m.attributes['group'] for m in models))
# ---------- end py3_2 ----------

# ----
# Apply Joints
list = ValueList({"Zero": 0, "One": 1, "Two": 2, "Three": 2² - 1}, selected="Zero")
item = ListItem(List=py3_2.models, Index=list, Wrap=True)
py3_3 = Python3Script(models=item)  # -> out, models; inputs models: list
# ---------- py3_3: Python ----------
import os, sys, importlib

gh_dir = os.path.dirname(ghenv.Component.OnPingDocument().FilePath)

parent = os.path.dirname(gh_dir)              # go up one level
src_dir = os.path.join(parent, "src")         # go into src folder
if src_dir not in sys.path:
    sys.path.insert(0, src_dir)

import timber_config
importlib.reload(timber_config)

import timber_model
importlib.reload(timber_model)
from timber_model import apply_joints

from copy import deepcopy

models = deepcopy(models)


#
for model in models:
    apply_joints(
        model,
        max_distance=0.065,
        k_miter_type="AVERAGE",
        k_miter_flag=False,
        x_lap_flip=False,
        debug=True
    )
# ---------- end py3_3 ----------

panel = Panel(py3_3.out)
panel_2 = Panel(py3_3.models)

# ----
# Process joinery
toggle = BooleanToggle(True)
py3_4 = Python3Script(models=py3_3.models, process=toggle)  # -> out, models; inputs models: list, process: Boolean
# ---------- py3_4: Python ----------
import os, sys, importlib

gh_dir = os.path.dirname(ghenv.Component.OnPingDocument().FilePath)

parent = os.path.dirname(gh_dir)              # go up one level
src_dir = os.path.join(parent, "src")         # go into src folder
if src_dir not in sys.path:
    sys.path.insert(0, src_dir)

print (gh_dir)
print (parent)
print (src_dir)

import timber_config
importlib.reload(timber_config)

import timber_model
importlib.reload(timber_model)
from timber_model import apply_processings

from copy import deepcopy

models = deepcopy(models)


#
if process:
    for model in models:
        apply_processings(model)
# ---------- end py3_4 ----------

py3_5 = Python3Script(models=py3_4.models)  # -> out, locations, txts, vectors, port, geos, graft(vecs), struts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; inputs models: list; disabled
# ---------- py3_5: Python ----------
import os, sys, importlib

gh_dir = os.path.dirname(ghenv.Component.OnPingDocument().FilePath)

parent = os.path.dirname(gh_dir)              # go up one level
src_dir = os.path.join(parent, "src")         # go into src folder
if src_dir not in sys.path:
    sys.path.insert(0, src_dir)

import screw_planning
importlib.reload(screw_planning)
from screw_planning import apply_screws_2, ScrewSolver

import joint_wrappers
importlib.reload(joint_wrappers)
from joint_wrappers import TMSJ

import screw_spec
importlib.reload(screw_spec)
from screw_spec import ScrewSpecification

from copy import deepcopy

from Grasshopper import DataTree
from Grasshopper.Kernel.Data import GH_Path

from compas_timber.connections import TMultiStepJoint
from compas_rhino.conversions import frame_to_rhino
from compas.geometry import angle_vectors, Point
import math

# models = deepcopy(models)
JOINT_MAP = {
    TMultiStepJoint : TMSJ,

}
def _average_points(points):
    x = sum(p.x for p in points) / len(points)
    y = sum(p.y for p in points) / len(points)
    z = sum(p.z for p in points) / len(points)
    return Point(x, y, z)

locations = DataTree[object]()
txts = DataTree[object]()

geos = DataTree[object]()
struts = DataTree[object]()
lines = DataTree[object]()
volumes = DataTree[object]()
pts = DataTree[object]()
cylinders = DataTree[object]()

vectors = DataTree[object]()
orient = "perp_tread"
for model in models:
    g = model.attributes['group']
    
    solver = ScrewSolver(model)
    for j, joint in enumerate(model.joints):
        if joint.name != "TMultiStepJoint":
            continue

        # Wrap the joint with the corresponding class in JOINT_MAP if it exists
        joint_class = joint.__class__
        if joint_class in JOINT_MAP:
            joint = JOINT_MAP[joint_class](joint)

        path = GH_Path(g, j)
        
        txts.Add(round(joint.acute_angle), path)
        # txts.Add(joint.step_shape, path)

        # for ele in joint.elements:
        #     geos.Add(ele.geometry, path)

        polyline = joint.get_strut_boundary(data_type="polyline")
        locations.Add(_average_points(polyline[:-1]), path)

        entry_type = solver.determine_entry_type(joint)
        if entry_type == "crossed":
            pts_grid = solver.populate_crossed_entry_points(joint, "cross_section")
            pts.AddRange(pts_grid, path)
            strut = joint.get_strut_boundary(data_type="polyline")
            struts.Add(strut, path)
            polys = joint.find_screw_boundaries("cross_section", data_type="polylines")
            volumes.AddRange(polys, path)
            lns = solver.populate_crossed_screw_lines(joint, "cross_section")
            lines.AddRange(lns, path)
            cyls = solver.create_screw_cylinders(joint, "cross_section")
            cylinders.AddRange(cyls, path)

            solver.add_drilling_features(joint, "cross_section")
            continue
        
        
        strut = joint.get_strut_boundary(data_type="polyline")
        polys = joint.find_screw_boundaries(orient, data_type="polylines")
        pts_grid = solver.populate_aligned_entry_points(joint, orient)
        lns = solver.populate_aligned_screw_lines(joint, orient)
        cyls = solver.create_screw_cylinders(joint, orient)
        solver.add_drilling_features(joint, orient)

        struts.Add(strut, path)
        volumes.AddRange(polys, path)
        pts.AddRange(pts_grid, path)
        lines.AddRange(lns, path)
        cylinders.AddRange(cyls, path)
    
    model.process_joinery()
    for beam in model.beams:
        geos.Add(beam.geometry)
# ---------- end py3_5 ----------
draw = COMPASDraw(cg=py3_5.geos)  # -> rg
#   port cg: The COMPAS geometry or datastructure to be drawn.
#   port rg: The Rhino geometry object.
# ---------- draw: Python ----------
# r: compas>=2.14.1
"""
Draws COMPAS geometry in Grasshopper.
"""

from typing import Any

import Grasshopper

from compas.scene import SceneObject


class CompasToRhinoGeometry(Grasshopper.Kernel.GH_ScriptInstance):
    def RunScript(self, cg):
        if not cg:
            return None

        return SceneObject(item=cg).draw()
# ---------- end draw ----------
py3_6 = Python3Script(models=py3_4.models)  # -> out, locations, txts, geos, entry_point_tree, screw_line_tree; inputs models: list
# ---------- py3_6: Python ----------
import os, sys, importlib
gh_dir = os.path.dirname(ghenv.Component.OnPingDocument().FilePath)

parent = os.path.dirname(gh_dir)
src_dir = os.path.join(parent, "src")
if src_dir not in sys.path:
    sys.path.insert(0, src_dir)

import screw_planning
import screw_spec
import joint_wrappers

importlib.reload(screw_planning)
importlib.reload(screw_spec)
importlib.reload(joint_wrappers)

from screw_planning import apply_screws
from screw_spec import ScrewSpecification
from joint_wrappers import TMSJ

from Grasshopper import DataTree
from Grasshopper.Kernel.Data import GH_Path


entry_point_tree = DataTree[object]()
screw_line_tree = DataTree[object]()

for model in models:
    g = model.attributes["group"]

    results = apply_screws(
        model,
        spec_model="WT-plus-6.5",
        orientation_aligned="perp_tread",
        orientation_crossed="cross_section",
        drill_target="main",
        depth_limited=True,
        with_data=True
    )
    
    for (main, cross), result in results.items():
        entry_points = result["entry_points"]
        screw_lines = result["screw_lines"]
        path = GH_Path(g)
        entry_point_tree.AddRange(entry_points, path)
        screw_line_tree.AddRange(screw_lines, path)
    
    # geos = [b.geometry for b in model.beams]
# ---------- end py3_6 ----------
preview = CustomPreview(Geometry=draw, Material=ColourSwatch(SwatchColor=RGBA(38, 56, 36, 0)))
draw_2 = COMPASDraw(cg=py3_5.cylinders)  # -> rg; same code as draw
draw_3 = COMPASDraw(cg=py3_5.pts)  # -> rg; same code as draw
draw_4 = COMPASDraw(cg=py3_5.struts)  # -> rg; same code as draw
disc = Discontinuity(Curve=draw_4, Level=1)  # -> Points, Parameters
draw_5 = COMPASDraw(cg=py3_5.volumes)  # -> rg; same code as draw
draw_6 = COMPASDraw(cg=py3_5.lines)  # -> rg; same code as draw
item_2 = ListItem(List=disc.Points, Index=0, Wrap=True)
draw_7 = COMPASDraw(cg=py3_6.geos)  # -> rg; same code as draw
draw_8 = COMPASDraw(cg=py3_6.screw_line_tree)  # -> rg; same code as draw
draw_9 = COMPASDraw(cg=py3_6.entry_point_tree)  # -> rg; same code as draw
panel_3 = Panel(py3_5.out)
py3_7 = Python3Script(models=py3_4.models)  # -> out, locations, txts; inputs models: list
# ---------- py3_7: Python ----------
from compas_timber.fabrication import Drilling
from compas_rhino.conversions import line_to_compas


locations = []
txts = []
for model in models:
    for beam in model.beams:
        txts.append(beam.name)
        locations.append(beam.centerline.midpoint)
# ---------- end py3_7 ----------
draw_10 = COMPASDraw(cg=py3_7.locations)  # -> rg; same code as draw
tag = TextTag(Location=draw_10, Text=py3_7.txts)

# ----
# Preview
number_slider = Slider(94, range=0..255)
python_3_script = Python3Script(models=py3_4.models, alpha=number_slider)  # -> out, geos, colors, cut_planes, models; inputs models: list, alpha: Int32
# ---------- python_3_script: Python ----------
import rhinoscriptsyntax as rs
import scriptcontext as sc
import Rhino.Display as rd
import System.Drawing as sd

from compas.scene import Scene
from compas.geometry import Line, Point
from copy import deepcopy


COLORS = {
    "primary":      sd.Color.FromArgb(alpha, 220,  50,  50),
    "main_primary": sd.Color.FromArgb(alpha, 150,  80, 220),
    "secondary":    sd.Color.FromArgb(alpha,  50, 150, 220),
    "tertiary":     sd.Color.FromArgb(alpha,  80, 200, 100),
    "shoe":         sd.Color.FromArgb(alpha,  20, 150, 100),
    "plate":        sd.Color.FromArgb(alpha, 100, 100, 100)
}


geos = []
colors = []
cut_planes = []

for model in models:
    for plate in model.plates:
        pass
        # geos.append(plate.geometry)
        # colors.append(COLORS['plate'])

    for beam in model.beams:
        # if beam.attributes['hierarchy'] != 'shoe':
            # continue
        hie = beam.attributes.get('hierarchy')

        geos.append(beam.geometry)
        colors.append(COLORS[hie])

    cut_planes.append(model.attributes['cut_plane'])
# ---------- end python_3_script ----------
compas_draw = COMPASDraw(cg=python_3_script.geos)  # -> rg; same code as draw
compas_draw_2 = COMPASDraw(cg=python_3_script.cut_planes)  # -> rg; same code as draw
preview_2 = CustomPreview(Geometry=compas_draw, Material=python_3_script.colors)
wires = BrepWireframe(Brep=compas_draw, Density=-1)
previewlw = CustomPreviewLineweights(Geometry=wires, Shader=ColourSwatch(SwatchColor=RGB(255, 255, 255)), Absolute=False)

number_slider_2 = Slider(0.604, range=0..1)
py3_8 = Python3Script(models=py3_4.models)  # -> out, locations, txts, port, butts, cuts, steps, notchs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; inputs models: list
# ---------- py3_8: Python ----------
from Grasshopper import DataTree
from Grasshopper.Kernel.Data import GH_Path

from compas_rhino.conversions import frame_to_rhino


locations = DataTree[object]()
txts = DataTree[object]()

butts = DataTree[object]()
cuts = DataTree[object]()
steps = DataTree[object]()
notchs = DataTree[object]()
bases = DataTree[object]()

geos = DataTree[object]()

a = DataTree[object]()
b = DataTree[object]()
c = DataTree[object]()
refs_m = DataTree[object]()
refs_c = DataTree[object]()

for model in models:
    g = model.attributes['group']
    for j, joint in enumerate(model.joints):
        if joint.name != "TMultiStepJoint":
            continue
        print (joint)
        path = GH_Path(g, j)
        locations.Add(joint.location, path)
        # txts.Add(len(joint.features), path)
        txts.Add(joint.step_shape, path)
        
        butt_pln = joint._get_butt_plane()
        cut_plns = joint._get_cut_planes()
        step_plns = joint._get_step_planes()
        notch_plns = joint._get_notch_planes()

        butts.Add(butt_pln, path)
        cuts.AddRange(cut_plns, path)
        steps.AddRange(step_plns, path)
        notchs.AddRange(notch_plns, path)
        bases.AddRange(joint._compute_base_planes(), path)

        for ele in joint.elements:
            geos.Add(ele.geometry, path)

        for frame in joint.main_beam.ref_sides:
            a.Add(frame_to_rhino(frame), path)
        for frame in joint.cross_beam.ref_sides:
            b.Add(frame_to_rhino(frame), path)

        # print (j, joint._main_beam_ref_side_index, joint._cross_beam_ref_side_index)
        c.Add(frame_to_rhino(joint.main_beam.front_side(joint.main_beam_ref_side_index)), path)
        refs_m.Add(joint.main_beam_ref_side_index, path)
        refs_c.Add(joint.cross_beam_ref_side_index, path)
# ---------- end py3_8 ----------
draw_11 = COMPASDraw(cg=py3_8.locations)  # -> rg; same code as draw
tstat = TreeStatistics(Tree=draw_11)  # -> Paths, Length, Count
item_3 = ListItem(List=tstat.Paths, Index=Slider(8, range=0..40), Wrap=True)
branch = TreeBranch(Tree=py3_8.b, Path=item_3, MaintainPaths=True)
branch_2 = TreeBranch(Tree=py3_8.refs_c, Path=item_3, MaintainPaths=True)
branch_3 = TreeBranch(Tree=py3_8.c, Path=item_3, MaintainPaths=True)
branch_4 = TreeBranch(Tree=py3_8.refs_m, Path=item_3, MaintainPaths=True)
branch_5 = TreeBranch(Tree=py3_8.a, Path=item_3, MaintainPaths=True)
item_4 = ListItem(List=branch, Index=branch_2, Wrap=True)
item_5 = ListItem(List=branch_5, Index=branch_4, Wrap=True)
cluster = Cluster(P=branch_3, num=number_slider_2)
cluster_2 = Cluster(P=item_5, num=number_slider_2)
cluster_3 = Cluster(P=item_4, num=number_slider_2)
branch_6 = TreeBranch(Tree=py3_8.geos, Path=item_3, MaintainPaths=True)
branch_7 = TreeBranch(Tree=py3_8.butts, Path=item_3, MaintainPaths=True)
branch_8 = TreeBranch(Tree=py3_8.cuts, Path=item_3, MaintainPaths=True)
branch_9 = TreeBranch(Tree=py3_8.steps, Path=item_3, MaintainPaths=True)
branch_10 = TreeBranch(Tree=py3_8.notchs, Path=item_3, MaintainPaths=True)
branch_11 = TreeBranch(Tree=py3_8.bases, Path=item_3, MaintainPaths=True)
draw_12 = COMPASDraw(cg=branch_6)  # -> rg; same code as draw
draw_13 = COMPASDraw(cg=branch_7)  # -> rg; same code as draw
draw_14 = COMPASDraw(cg=branch_8)  # -> rg; same code as draw
draw_15 = COMPASDraw(cg=branch_9)  # -> rg; same code as draw
draw_16 = COMPASDraw(cg=branch_10)  # -> rg; same code as draw
draw_17 = COMPASDraw(cg=branch_11)  # -> rg; same code as draw
item_6 = ListItem(List=draw_12, Index=0, Wrap=True)  # -> Item, Item1
branch_12 = TreeBranch(Tree=draw_11, Path=item_3, MaintainPaths=True)
branch_13 = TreeBranch(Tree=py3_8.txts, Path=item_3, MaintainPaths=True)
preview_3 = CustomPreview(Geometry=item_6.Item, Material=ColourSwatch(SwatchColor=RGB(189, 88, 0)))
preview_4 = CustomPreview(Geometry=item_6.Item1, Material=ColourSwatch(SwatchColor=RGB(84, 84, 84)))
tag_2 = TextTag3D(Location=branch_12, Text=branch_13, Size=Slider(0.123, range=0..1), Justification=7)
branch_14 = TreeBranch(Tree=simplify(draw_17), Path=Slider(0, range=0..1), MaintainPaths=True)
preview_5 = CustomPreview(
    Geometry=branch_14,
    Material={diffuse=RGB(221, 160, 221), emission=RGB(66, 48, 66), shine=0.5, specular=RGB(255, 255, 255), transparency=0})

# ----
# Write to json
number_slider_3 = Slider(1, range=1..10)
py3_9 = Python3Script(models=py3_4.models, version=number_slider_3, save=Button())  # inputs models: list, version: Int32
# ---------- py3_9: Python ----------
import os, sys, importlib
from datetime import date

from compas.data import json_dump

gh_dir = os.path.dirname(ghenv.Component.OnPingDocument().FilePath)
gh_par = os.path.dirname(gh_dir)
file_path = os.path.join(gh_par, "timber_design", "data")

today = date.today().strftime("%y%m%d")
print(today)



if save:
    serializable = []
    for m in models:
        serializable.append({
            "attributes": dict(m.attributes),
            "model": m
        })
        
    output_path = os.path.join(file_path, f"{today}_v{version}_timber_models.json")
    dump = json_dump(serializable, output_path, pretty=False)
    print(f"Model written to {output_path}")


# serializable = []
# for m in models:
#     serializable.append({
#         "attributes": dict(m.attributes),
#         "model": m
#     })
# print (serializable)
# ---------- end py3_9 ----------

# ==== cluster Cluster
P = ClusterInput()
num = ClusterInput()
deplane = DeconstructPlane(Plane=P)  # -> Origin, XAxis, YAxis, ZAxis
num_2 = Number(num)
entwine = Entwine(Branch00=deplane.XAxis, Branch01=deplane.YAxis, Branch02=deplane.ZAxis, FlattenInputs=True)
multiplication = Multiplication(A=entwine, B=num_2)
merge = Merge(
    Data1=ColourSwatch(SwatchColor=RGB(255, 0, 0)),
    Data2=ColourSwatch(SwatchColor=RGB(0, 255, 0)),
    Data3=ColourSwatch(SwatchColor=RGB(0, 0, 255)))  # -> graft(Result)
vdisex = VectorDisplayEx(Point=deplane.Origin, Vector=multiplication, Colour=merge, Width=2)
