# Grasshopper definition middle_prototype_tm.ghx (Grasshopper 1.0.8)

panel = Panel("""0.06
0.08""")
py3 = Python3Script()  # -> out, line_model
# ---------- py3: Python ----------
from compas.data import json_load

import os, sys, importlib

gh_dir = os.path.dirname(ghenv.Component.OnPingDocument().FilePath)
gh_par = os.path.dirname(gh_dir)
file_path = os.path.join(gh_par, "line_model","data", "260512_v3_shifted_lines.json")

print(file_path)

line_model = json_load(file_path)





for edge in line_model.edges():
    mid = line_model.edge_attribute(edge, 'middle_joint')
    print (mid)
# ---------- end py3 ----------
unit_z = UnitZ(Factor=Slider(0.2, range=0..1))

# ----
# Construct Timber Models
py3_2 = Python3Script(graph=py3.line_model)  # -> out, models, a
# ---------- py3_2: Python ----------
import os, sys, importlib

gh_dir = os.path.dirname(ghenv.Component.OnPingDocument().FilePath)
if gh_dir not in sys.path:
    sys.path.insert(0, gh_dir)

import timber_config
importlib.reload(timber_config)

import timber_model
importlib.reload(timber_model)
from timber_model import graph_to_timber_models

#
models = graph_to_timber_models(graph, align_shoe=False)

print (list(m.attributes['group'] for m in models))


models.sort(key=lambda m: m.attributes['group'])

print (list(m.attributes['group'] for m in models))
# ---------- end py3_2 ----------

# ----
# Apply Joints
list = ValueList({"Zero": 0, "One": 1, "Two": 2, "Three": 2² - 1}, selected="One")
item = ListItem(List=py3_2.models, Index=list, Wrap=True)
py3_3 = Python3Script(models=item)  # -> out, models; inputs models: list
# ---------- py3_3: Python ----------
import os, sys, importlib

gh_dir = os.path.dirname(ghenv.Component.OnPingDocument().FilePath)
if gh_dir not in sys.path:
    sys.path.insert(0, gh_dir)

import timber_config
importlib.reload(timber_config)

import timber_model
importlib.reload(timber_model)
from timber_model import apply_joints

from copy import deepcopy

models = deepcopy(models)


#
for model in models:
    apply_joints(model)
# ---------- end py3_3 ----------

python_3_script = Python3Script(x=item)  # -> out, a
# ---------- python_3_script: Python ----------
from compas_timber.model import TimberModel
from compas_timber.elements import Beam
from compas.scene import Scene

scene = Scene()

for b in x.beams:
    ln = b.centerline
    scene.add(ln)

plane = x.attributes.get("clt_plate")
scene.add(plane.geometry)

a = scene.draw()
# ---------- end python_3_script ----------
py3_4 = Python3Script(models=item)  # -> out, models; inputs models: list; disabled
# ---------- py3_4: Python ----------
import os, sys, importlib

gh_dir = os.path.dirname(ghenv.Component.OnPingDocument().FilePath)
if gh_dir not in sys.path:
    sys.path.insert(0, gh_dir)

import timber_model
importlib.reload(timber_model)
from timber_model import apply_joints
from copy import deepcopy

from compas_timber.model import TimberModel
from compas.tolerance import Tolerance

models = deepcopy(models)
#
nm = TimberModel(Tolerance(unit="M", absolute=0.001))
for model in models:
    nm.add_elements(model.plates)

nm.connect_adjacent_plates()

for cand in nm.joint_candidates:
    print (cand)
# ---------- end py3_4 ----------

# ----
# Process joinery
toggle = BooleanToggle(True)
py3_5 = Python3Script(models=py3_3.models, process=toggle)  # -> out, models; inputs models: list, process: Boolean
# ---------- py3_5: Python ----------
import os, sys, importlib

gh_dir = os.path.dirname(ghenv.Component.OnPingDocument().FilePath)
if gh_dir not in sys.path:
    sys.path.insert(0, gh_dir)

import timber_config
importlib.reload(timber_config)

import timber_model
importlib.reload(timber_model)
from timber_model import apply_processings

from copy import deepcopy

models = deepcopy(models)


#
if process:
    for model in models:
        model.process_joinery()
        model = apply_processings(model)
# ---------- end py3_5 ----------

file_path = FilePath("/Users/minghip/Desktop/")

# ----
# Preview
python_3_script_2 = Python3Script(models=py3_5.models)  # -> out, geos, colors, cut_planes, models; inputs models: list
# ---------- python_3_script_2: Python ----------
import rhinoscriptsyntax as rs
import scriptcontext as sc
import Rhino.Display as rd
import System.Drawing as sd

from compas.scene import Scene
from compas.geometry import Line, Point
from copy import deepcopy


COLORS = {
    "primary":      sd.Color.FromArgb(100, 220,  50,  50),
    "main_primary": sd.Color.FromArgb(100, 150,  80, 220),
    "secondary":    sd.Color.FromArgb(100,  50, 150, 220),
    "tertiary":     sd.Color.FromArgb(100,  80, 200, 100),
    "shoe":         sd.Color.FromArgb(100,  20, 150, 100),
    "plate":        sd.Color.FromArgb(100,  100, 100, 100)
}


geos = []
colors = []
cut_planes = []

for model in models:
    for plate in model.plates:
        geos.append(plate.geometry)
        colors.append(COLORS['plate'])

    for beam in model.beams:
        hie = beam.attributes.get('hierarchy')

        geos.append(beam.geometry)
        colors.append(COLORS[hie])

    cut_planes.append(model.attributes['cut_plane'])
# ---------- end python_3_script_2 ----------
compas_draw = COMPASDraw(cg=python_3_script_2.geos)  # -> rg
#   port cg: The COMPAS geometry or datastructure to be drawn.
#   port rg: The Rhino geometry object.
# ---------- compas_draw: Python ----------
# r: compas>=2.14.1
"""
Draws COMPAS geometry in Grasshopper.
"""

from typing import Any

import Grasshopper

from compas.scene import SceneObject


class CompasToRhinoGeometry(Grasshopper.Kernel.GH_ScriptInstance):
    def RunScript(self, cg):
        if not cg:
            return None

        return SceneObject(item=cg).draw()
# ---------- end compas_draw ----------
compas_draw_2 = COMPASDraw(cg=python_3_script_2.cut_planes)  # -> rg; same code as compas_draw
preview = CustomPreview(Geometry=compas_draw, Material=python_3_script_2.colors)

py3_6 = Python3Script(models=py3_5.models, save=Button())  # inputs models: list
# ---------- py3_6: Python ----------
import os, sys, importlib
from compas.data import json_dump

gh_dir = os.path.dirname(ghenv.Component.OnPingDocument().FilePath)
gh_par = os.path.dirname(gh_dir)
file_path = os.path.join(gh_par, "timber_design","data")

if save:
    for i, m in enumerate(models):
        """Serialize models to .JSON"""
        output_path = os.path.join(file_path, f"1205_timber_model_{i}.json")
        m.to_json(output_path, pretty=True)
        print(f"Model written to {output_path}")
# ---------- end py3_6 ----------

# ---- group: Middle Node Prototype
curve = Curve([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])
curve_2 = Curve(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)
curve_3 = Curve([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])
curve_4 = Curve([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])
plane = Plane(Plane(origin=(2.799809662, 1.809560759, 1.7118025), x=(0, 1, 0), y=(1, 0, 0)))

# ----
move = Move(Geometry=plane, Motion=unit_z)  # -> Geometry, Transform

# ---- group: Middle Node Prototype (continued)
python_3_script_3 = Python3Script(stock=panel, shoe=curve_3, main_primary=curve, primary=curve_4, clt_plate=curve_2, cut_plane=move.Geometry)  # -> out, timber_model; inputs stock: list of Double, shoe: list of Line, main_primary: list of Line, primary: list of Line, clt_plate: Polyline, cut_plane: Plane
# ---------- python_3_script_3: Python ----------
from compas_timber.model import TimberModel
from compas_timber.elements import Beam, Plate
from compas_timber.utils import get_polyline_normal_vector
from compas.tolerance import Tolerance
from compas_rhino.conversions import line_to_compas, plane_to_compas, polyline_to_compas
from compas.geometry import Polyline, Translation, Vector
# --------------------------------------
# Dimensions
# --------------------------------------

stock_1_width = stock[0]
stock_1_height = stock[1]

if len(stock) > 2:
    stock_2_width = stock[2]
    stock_2_height = stock[3]

# --------------------------------------
# Helpers
# --------------------------------------

def create_add_beams(model, lines, w, h, hierarchy, is_mid, level=0):
    if not is_mid:
        is_mid = False
    beams = []
    for line in lines:
        centerline = line_to_compas(line)
        beam = Beam.from_centerline(centerline, w, h)
        beam.name = hierarchy
        beam.attributes = {
            'hierarchy': hierarchy,
            'level': level,
            'is_middle_joint': is_mid
        }
        beams.append(beam)
    model.add_elements(beams)

def orientate_plane_negative(plane):
    if plane.normal.z < 0:
        plane.normal = -plane.normal
    return plane

# --------------------------------------
# Build Model
# --------------------------------------

timber_model = TimberModel(Tolerance(unit="M", absolute= 0.001))

#beams
create_add_beams(timber_model, shoe, stock_1_width, stock_1_height, "shoe", True)
create_add_beams(timber_model, main_primary, stock_1_width, stock_1_height, "main_primary", True)
create_add_beams(timber_model, primary, stock_1_width, stock_1_height, "primary", True)

#plate
clt_polyline = polyline_to_compas(clt_plate)
clt_polyline.transform(Translation.from_vector(Vector(0,0,0.03)))
vector = get_polyline_normal_vector(clt_polyline)
if vector.z < 0:
    vector = -vector
plate = Plate.from_outline_thickness(clt_polyline, 0.1, vector)
timber_model.add_element(plate)
timber_model.attributes['clt_plate'] = plate

#plane
c_plane = plane_to_compas(cut_plane)
c_plane = orientate_plane_negative(c_plane)
timber_model.attributes['cut_plane'] = c_plane
timber_model = timber_model

print(timber_model.beams)
# ---------- end python_3_script_3 ----------

# ----
panel_2 = Panel(python_3_script_3.timber_model)
py3_7 = Python3Script(models=python_3_script_3.timber_model)  # -> out, models; inputs models: list; same code as py3_3
py3_8 = Python3Script(models=py3_7.models, process=Toggle(True))  # -> out, models; inputs models: list, process: Boolean; same code as py3_5

# ----
# Preview
python_3_script_4 = Python3Script(models=py3_8.models)  # -> out, geos, colors, cut_planes, models; inputs models: list
# ---------- python_3_script_4: Python ----------
import rhinoscriptsyntax as rs
import scriptcontext as sc
import Rhino.Display as rd
import System.Drawing as sd

from compas.scene import Scene
from compas.geometry import Line, Point
from copy import deepcopy


COLORS = {
    "primary":      sd.Color.FromArgb(100, 220,  50,  50),
    "main_primary": sd.Color.FromArgb(100, 150,  80, 220),
    "secondary":    sd.Color.FromArgb(100,  50, 150, 220),
    "tertiary":     sd.Color.FromArgb(100,  80, 200, 100),
    "shoe":         sd.Color.FromArgb(100,  20, 150, 100),
    "plate":        sd.Color.FromArgb(100,  100, 100, 100)
}


geos = []
colors = []
cut_planes = []

for model in models:
    # for plate in model.plates:
    #     geos.append(plate.geometry)
    #     colors.append(COLORS['plate'])

    for beam in model.beams:
        hie = beam.attributes.get('hierarchy')

        geos.append(beam.geometry)
        colors.append(COLORS[hie])

    cut_planes.append(model.attributes['cut_plane'])
# ---------- end python_3_script_4 ----------
compas_draw_3 = COMPASDraw(cg=python_3_script_4.cut_planes)  # -> rg; same code as compas_draw
compas_draw_4 = COMPASDraw(cg=python_3_script_4.geos)  # -> rg; same code as compas_draw
preview_2 = CustomPreview(Geometry=compas_draw_4, Material=python_3_script_4.colors)

py3_9 = Python3Script(models=py3_8.models, save=Button(), set_file_path=file_path)  # inputs models: list
# ---------- py3_9: Python ----------
import os, sys, importlib
from compas.data import json_dump

gh_dir = os.path.dirname(ghenv.Component.OnPingDocument().FilePath)
gh_par = os.path.dirname(gh_dir)
file_path = os.path.join(gh_par, "timber_design","data")
if set_file_path:
    file_path = set_file_path

if save:
    for i, m in enumerate(models):
        """Serialize models to .JSON"""
        output_path = os.path.join(file_path, f"1605_timber_model_{i}.json")
        m.to_json(output_path, pretty=True)
        print(f"Model written to {output_path}")
# ---------- end py3_9 ----------
