# Grasshopper definition export_hops.ghx (Grasshopper 1.0.8)
# plug-ins: Human, Increment

panel = Panel("""M0L0_6
M0L0_8
M0L0_12
M0L0_13
M0L0_14
M0L0_15
M0L0_25
M0L0_31
M0L0_33
M0L1_58
M0L1_59
M0L1_60
M0L1_61
M0L1_67
M0L2_71""")
item = ListItem(Index=0, Wrap=True)

py3 = Python3Script(unload=Button())  # inputs unload: Boolean
# ---------- py3: Python ----------
from compas_rhino import unload_modules

import easyhops
if unload:
    unload_modules("easyhops")
# ---------- end py3 ----------

increment = Increment(BeginningNumber=0, StepSize=1, currentValue=1, increment=1, oldStart=0)  # -> Output, Item
list = ValueList({"main_primary", "primary", "secondary", "tertiary", "shoe"}, selected="shoe")
list_2 = ValueList({"zero": 0, "1", "2", "3", "4"}, selected="zero")
btlx = Button()  # disabled
hops = Button()  # disabled
path = FilePath("C:\Users\kapso\GitHub\llhil-t2-fabrication\design\modularization\data\260608_v1_fabrication_model_2.json")
panel_2 = Panel(path)
py3_2 = Python3Script()  # -> out, a; unedited script template
py3_3 = Python3Script(filepath=path, level=list_2, index=increment.Output, write=btlx, export=hops)  # -> out, model, geometry, processing_report, HOPSJob; inputs filepath: String, hierarchy: String, level: Int32, index: Int32, export: Boolean, names: list
# ---------- py3_3: Python ----------
import os, sys, importlib
import copy
import math
from compas.scene import Scene
from compas_timber.model import TimberModel
from compas_timber.fabrication import BTLxWriter
from compas_rhino.conversions import plane_to_rhino

from compas.geometry import angle_vectors

gh_dir = os.path.dirname(ghenv.Component.OnPingDocument().FilePath)

repo_root = os.path.dirname(os.path.dirname(gh_dir))
cnc_dir = os.path.join(repo_root, "fabrication", "cnc")
# if hierarchy:
#     name = str(hierarchy)
# elif level:
#     name = "level_" + str(level)
name = "level_0"
btlx_dir = cnc_dir + "\\BTLx\\" + name
hops_dir =cnc_dir + "\\HOPS\\" + name

if cnc_dir not in sys.path:
    sys.path.insert(0, cnc_dir)

import hops_exporter as he
importlib.reload(he)

scene = Scene()

model = he.load_model(filepath)
# for beam in model.beams:
#     for f in beam.features:
#         if f.PROCESSING_NAME == "Drilling":
#             if f.depth*1000 == 0:
#                 f.depth_limited = False
#             #     beam.remove_features(f)
#             #     print("removed_one!")
#             # else:
#             #     print(f.depth*1000)
#     beam.reset_computed_properties()
            
export_dir = os.path.join(os.path.dirname(filepath), "hops")
beam = he.resolve_beam(model, index, hierarchy, level)

if beam:
    he.override_features(beam)
    if beam.attributes.get("hierarchy") != "shoe":
        print(beam.debug_info)
        geometry = he.visualize_geometry(beam)
        processing_report = he.get_processing_report(beam)

if write:
    new_model = TimberModel()
    for beam in model.beams:
        # if hierarchy:
        #     if beam.attributes.get("hierarchy") == hierarchy:
        #         new_model.add_element(beam)
        # if level:
        if beam.attributes.get("level") == level and beam.attributes.get("hierarchy") != "shoe":
            new_model.add_element(beam)
    writer = BTLxWriter()
    xml = writer.write(new_model, file_path=btlx_dir)

if export:
    HOPSJob = he.export_hop(beam, hops_dir)

for f in beam.features:
    if f.PROCESSING_NAME == "StepJoint":
        planes = f.planes_from_params_and_beam(beam)
        angle = angle_vectors(planes[1].normal, planes[0].normal)
        print(math.degrees(angle))
# ---------- end py3_3 ----------
panel_3 = Panel(py3_3.out)
panel_4 = Panel(py3_3.processing_report)
py3_4 = Python3Script(unload=Button())  # -> out
# ---------- py3_4: Python ----------
from compas_rhino import unload_modules
import compas_timber

if unload:
    unload_modules("compas_timber")
    print("Succesfully unloaded CT!")
# ---------- end py3_4 ----------
panel_5 = Panel(py3_4)
data = Data(py3_3.geometry)
brep = Brep(data)
null = NullItem(Item=brep)  # -> NullFlags, InvalidFlags, Description
py3_5 = Python3Script(model=py3_3.model, viz=Toggle(False))  # -> a, b
# ---------- py3_5: Python ----------
from compas.scene import Scene
from compas_rhino.conversions import line_to_compas
scene = Scene()
debug_scene = Scene()

if viz:
    for beam in model.beams:
        # if beam == i:
        #     beam.add_features(Drilling.from_line_and_element(line_to_compas(line), beam))
        # if name is not None:
        #     if beam.name == name:
        scene.add(beam.geometry)
        if beam.debug_info:
            for fae in beam.debug_info:
                if isinstance(fae.feature_geometry, list):
                    debug_scene.add(fae.feature_geometry[0])
                else:
                    debug_scene.add(fae.feature_geometry)
    a = scene.draw()
    b = debug_scene.draw()
# ---------- end py3_5 ----------
py3_6 = Python3Script()  # -> out, a
# ---------- py3_6: Python ----------
print((2 - 0) % 4)
# ---------- end py3_6 ----------
dispatch = Dispatch(List=data, DispatchPattern=null.NullFlags)  # -> ListA, ListB
edges = BrepEdges(Brep=py3_5.a)  # -> Naked, Interior, NonManifold
geo = Geometry(py3_5.b)
preview = CustomPreview(Geometry=py3_5.a, Material=ColourSwatch(SwatchColor=RGBA(158, 150, 108, 184)))
preview_2 = CustomPreview(Geometry=dispatch.ListB, Material=ColourSwatch(SwatchColor=RGBA(158, 150, 108, 184)))
previewlw = CustomPreviewLineweights(Geometry=edges.Interior, Shader=ColourSwatch(SwatchColor=RGBA(0, 0, 0, 184)), Absolute=False)
previewlw_2 = CustomPreviewLineweights(Geometry=dispatch.ListA, Shader=ColourSwatch(SwatchColor=RGBA(255, 0, 0, 184)), Absolute=False)
